# Grasshopper definition Design Seeds - Sprout Space - 55.gh (Grasshopper 0.9.76)

list = ValueList({"Coarse": 0, "Fine": 1}, selected="Fine")

# ---- group: Path Points
pt = Point([Point(26.22280765, 34.27700129, 0), Point(26.22280765, 102.8870139, 0), Point(87.68198575, 102.8870139, 0)])

# ---- group: Locations
pt_2 = Point([Point(60.33523755, 47.28339146, 0), Point(49.05445738, 59.53043522, 0), Point(46.70927879, 75.68610996, 0), Point(57.65344555, 70.73517738, 0), Point(65.47070753, 79.07359015, 0), Point(68.33703692, 60.57273681, 0), Point(80.58408068, 64.7419432, 0), Point(85.53501326, 56.66410583, 0)])

pt_3 = Point([Point(54.18956445, 74.60163647, 0), Point(60.73443762, 64.70728154, 0), Point(70.44767182, 70.27128482, 0)])

# ---- group: Sprout Space Location
pt_4 = Point(Point(65.68741736, 14.30647949, 0))

# ----
# Define the View Target
number_slider = Slider(-27, range=-50..50)
vec = VectorXYZ(XComponent=number_slider, YComponent="80", ZComponent="18")  # -> Vector, Length
sprout_space_location_pt = Point(pt_4)
move = Move(Geometry=sprout_space_location_pt, Motion=vec.Vector)  # -> Geometry, Transform

# ----
# Create a Background Mesh
cluster = Cluster_14(street_cl_pts=pt)

panel = Panel("""Operable
Fixed""")
panel_2 = Panel("""Fixed
Operable
Fixed""")
panel_3 = Panel("""Operable
Fixed
Operable""")

# ----
# Create a Foreground Mesh
cluster_2 = Cluster_8(pts=pt_3, coarse_fine=list)

# ----
# Unit Conversion
list_2 = ValueList({"1:1": 1, "mm to ft": 0.0032808, "mm to m": 0.001}, selected="mm to ft")

cluster_3 = Cluster_9(location_pt=pt_4, length="42", depth_width="12", height="10.5", qty_cells="7")

# ---- group: Jamb Thickness
panel_4 = Panel("50")

# ---- group: Header Depth
panel_5 = Panel("44")

# ---- group: Sill Depth
panel_6 = Panel("50")

# ---- group: Mullion Thickness
panel_7 = Panel("50")

# ---- group: Inner Face 'Y'
panel_8 = Panel("50")

# ---- group: Outer Face 'Y'
panel_9 = Panel("124")

# ---- group: Header Topside 'Z'
panel_10 = Panel("-1")

# ---- group: Sill Underside 'Z'
panel_11 = Panel("1")

# ---- group: Caulking Thickness
panel_12 = Panel("1")

# ---- group: Caulking Recess
panel_13 = Panel("1")

# ----
# Location & Orientation
number_slider_2 = Slider(0, range=0..100)
xy = XYPlane(Origin=Point(0, 0, 0))
rad = Radians(Degrees=number_slider_2)
prot = RotatePlane(Plane=xy, Angle=rad)

# ---- group: Vent Height
panel_14 = Panel("1600")

# ---- group: Min. Vent Width
panel_15 = Panel("450")

# ----
# Cell Types
cluster_4 = Cluster_33(corner_width="0.5", typical_width="5.5")

panel_16 = Panel("""50
20
10
100""")
panel_17 = Panel("""150
150""")

# ----
# Envelope Description
cluster_5 = Cluster_29(
    sub_division=cluster_4,
    base_plane=prot,
    module_offset="6",
    length="42",
    depth_width="12",
    valley_height="10.5",
    max_height="12.5")

# ---- group: Test mountains and towers example
brep = Brep([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])
crv = Curve(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)
swatch = ColourSwatch(SwatchColor=RGB(120, 120, 120))
mesh = MeshBrep(
    Brep=crv,
    Settings={GridMaxCount=0, GridMinCount=16, JaggedSeams=False, MaxEdgeLength=0, MinEdgeLength=0.0001, MinTolerance=0, Refine=True, RefineAngle=0, RelativeTolerance=0.65, SimplePlanes=True, Tolerance=0})
smesh = SimpleMesh(Brep=brep)  # -> graft(Mesh)
preview = CustomPreview(Geometry=brep, Shader=swatch)
mcol = MeshColours(Mesh=smesh, Colours=swatch)

# ----
# North Facade
cluster_6 = Cluster_13(mesh=cluster_3)

cell_crvs = Curve(cluster_6)
txt = Text(Tree({0}: ["{1;*} Profile: Jamb", "{2;*} Profile: Caulking", "{3;*} Profile: Header", "{4;*} Profile: Sill", "{5;*} Profile: Horizontal Mullion", "{6;*} Profile: Vertical Mullion"], {1;0}: ["name:Jamb", "colour:{0.498039215686275, 0.498039215686275, 0.498039215686275}", "bottom, -0.16404, 0.0032808", "bottom, 0.2427792, 0.0032808", "top, 0.2427792, -0.0032808", "top, -0.16404, -0.0032808", "thickness:0.16404", "inset:0.0032808", "Q{0;1;2;3}", "YZ"], {2;0}: ["name:Caulking", "colour:{-1, -1, -1}", "bottom, -0.1607592, 0.0065616", "bottom, 0.2427792, 0.0065616", "top, 0.2427792, -0.0032808", "top, -0.1607592, -0.0032808", "thickness:0.0032808", "inset:0", "Q{0;1;2;3}", "YZ"], {3;0}: ["name:Header", "colour:{0.498039215686275, 0.498039215686275, 0.498039215686275}", "top, -0.16404, -0.147636", "top, -0.16404, -0.0032808", "top, 0.2427792, -0.0032808", "top, 0.2427792, -0.147636", "length:cell", "inset:0.1673208", "Q{0;1;2;3}", "YZ"], {4;0}: ["name:Sill", "colour:{0.498039215686275, 0.498039215686275, 0.498039215686275}", "bottom, -0.16404, 0.0032808", "bottom, 0.2427792, 0.0032808", "bottom, 0.2427792, 0.1673208", "bottom, -0.16404, 0.1673208", "length:cell", "inset:0.1673208", "Q{0;1;2;3}", "YZ"]))
txt_2 = Text(Tree({0}: ["{1;*} Profile: Wall"], {1;0}: ["name:Wall", "colour:{-0.56078431372549, -0.23921568627451, -0.498039215686275}", "bottom, -0.16404, 0.0032808", "bottom, 0.2427792, 0.0032808", "top, 0.2427792, -0.0032808", "top, -0.16404, -0.0032808", "length:cell", "inset:0", "Q{0;1;2;3}", "YZ"]))
pt_5 = Point([Point(-28.19684535, 6.273897615, 0), Point(-29.32253037, -1.947925, 0), Point(-24.959853, -12.73981111, 0), Point(-8.542409238, -16.75806658, 0), Point(3.487324493, -15.39042915, 0), Point(12.62398249, -8.221853698, 0), Point(14.48130034, 5.779465522, 0), Point(10.26522168, 7.74754003, 0), Point(2.946131019, 6.814233167, 0), Point(-2.997560055, 5.389712166, 0), Point(-8.787864292, 4.392082104, 0), Point(-13.66046779, 3.217960779, 0), Point(-20.23917631, 8.779089721, 0)])
pt_6 = Point([Point(-32.33332621, 8.986699518, 0), Point(-32.33332621, 2.155585799, 0), Point(-1.213808154, 2.155585799, 0), Point(-1.213808154, 8.986699518, 0)])

# ----
# Glazing Profiles
# Glazing Parameters
cluster_7 = Cluster_25(unit_conversion=list_2, vent_height=panel_14, min_vent_width=panel_15, glazing_description="Fixed")
cluster_8 = Cluster_31(
    unit_conversion=list_2,
    inner_face_y=panel_8,
    outer_face_y=panel_9,
    header_topside_z=panel_10,
    sill_underside_z=panel_11,
    jamb_thickness=panel_4,
    caulking_thickness=panel_12,
    caulking_recess_y_and_z=panel_13,
    header_z=panel_5,
    sill_topside_z=panel_6,
    mullion_thickness=panel_7)
cluster_9 = Cluster_32(profiles=cluster_8, parameters=cluster_7, name="Type G1", path="2")

# ----
# Envelope Parameters and Profiles
# Wall Profile 2
cluster_10 = Cluster_45(unit_conversion=list_2, layers_start_from_interior=panel_16)
cluster_11 = Cluster_32(profiles=cluster_10, parameters=cluster_7, name="Type W1", path="1")

# ----
# Wall Profile 1
cluster_12 = Cluster_30(unit_conversion=list_2, inner_face_y=panel_8, outer_face_y=panel_9, header_topside_z=panel_10, sill_underside_z=panel_11)
cluster_13 = Cluster_32(profiles=cluster_12, parameters=cluster_7, name="Type W1", path="1")

cluster_14 = Cluster_32(profiles=txt_2, parameters=cluster_7, name="corner", path="3")
cluster_15 = Cluster_32(profiles=txt, parameters=cluster_7, name="Type D1", path="4")

# ----
# Unit Conversion
list_3 = ValueList({"1:1": 1, "mm to ft": 0.0032808, "mm to m": 0.001}, selected="1:1")

# ----
# Unit Conversion
list_4 = ValueList({"1:1": 1, "mm to ft": 0.0032808, "mm to m": 0.001}, selected="1:1")

cluster_16 = Cluster_32(profiles=txt, parameters=cluster_7, name="Type D2", path="5")
cluster_17 = Cluster_5(cell_crvs=cell_crvs, target_pt=move.Geometry)  # -> view_lines_2, cell_planes_2; disabled

# ----
# Creates the XY grid
# This version currently assumes
# that there is only one row of cells
# Needs to be generalized
cluster_18 = Cluster_4(cell_crvs=cell_crvs)

# ----
# Create Cells
# for a virtual mock-up
cluster_19 = Cluster_47(pts=pt_6, cell_width="6", cell_height="10", unit_conversion=list_3, cell_description="Type G1")

# ----
# Create Cells
# by existing Cell Curves
cluster_20 = Cluster_39(unit_conversion=list_3, cell_crvs=cluster_6, cell_description="corner")

# ----
# Create Cells
# by sub-dividing a spline
cluster_21 = Cluster_46(pts=pt_5, cell_width="6", cell_height="10", unit_conversion=list_3, cell_description="Type G1")

# ----
# Facade Cells
cluster_22 = Cluster_38(unit_conversion=list_4, cell_type_descriptions=cluster_4, envelope_description=cluster_5)

# ---- group: Background
mesh_2 = Mesh(mesh)  # disabled

# ---- group: Foreground
mesh_3 = Mesh(mcol)  # disabled

# ----
cluster_23 = Cluster_26(angle_tol="6", lens_length="50", view_lines=cluster_17.view_lines_2)
merge = Merge(Data1=cluster_13, Data2=cluster_9, Data3=cluster_14, Data4=cluster_15, Data5=cluster_16)

# ----
# Reverse Perspective
cluster_24 = Cluster_3(mesh=mesh_2, optics=cluster_23)
cluster_25 = Cluster_3(mesh=mesh_3, optics=cluster_23)

# ----
# XY Meshes
cluster_26 = Cluster_6(
    meshes_to_subtract_from=cluster_24,
    meshes_to_subtract_with=cluster_25,
    cell_planes=cluster_17.cell_planes_2,
    cell_xy_crvs=cluster_18)  # -> foreground_2, foreground_outline_2, foreground_interior_edges_2, background_outline_2, cell_xy_crvs_3

# ----
# Envelope Analytical Data
cluster_27 = Cluster_24(facade_cells=cluster_22, system_descriptors=merge)  # -> energy_modeling_data_2, cells_and_sub_cells_2; disabled

# ----
# Envelope in 3D
cluster_28 = Cluster_44(cells_and_sub_cells=cluster_22, system_descriptors=merge)  # -> profile_qpts_2, box_mesh_2, colour_2

cluster_29 = Cluster_7(
    foreground=cluster_26.foreground_2,
    foreground_outline=cluster_26.foreground_outline_2,
    foreground_interior_edges=cluster_26.foreground_interior_edges_2,
    background_outline=cluster_26.background_outline_2,
    cell_xy_crvs=cluster_26.cell_xy_crvs_3)
preview_2 = CustomPreview(Geometry=cluster_28.box_mesh_2, Shader=cluster_28.colour_2)

# ==== cluster Cluster_3
mesh = ClusterInput()
optics = ClusterInput()
optics_2 = Data(optics)
branch = TreeBranch(Tree=optics_2, Path="{0}", MaintainPaths=True)
split = SplitTree(Data=optics_2, Masks=flatten("{1;*}"))  # -> Positive, Negative
split_2 = SplitTree(Data=optics_2, Masks=flatten("{2;*}"))  # -> Positive, Negative
split_3 = SplitTree(Data=optics_2, Masks=flatten("{3;*}"))  # -> Positive, Negative

# ----
# Separate each mesh object
# These can be re-organized
# down-stream by their mesh colours
mesh_2 = Mesh(mesh)
disjoint = DisjointMesh(Mesh=mesh_2)
pshift = ShiftPaths(Data=disjoint, Offset=-1)
mesh_3 = Mesh(flatten(pshift))

panel = Panel(branch)
path_mapper = PathMapper(split.Positive, source="{A;B}", target="{B}")
path_mapper_2 = PathMapper(split_2.Positive, source="{A;B}", target="{B}")
path_mapper_3 = PathMapper(split_3.Positive, source="{A;B}", target="{B}")

# ---- group: View Pts
pt = Point(path_mapper)

# ---- group: Angle Tolerance
angle_tol = Number(path_mapper_2)

# ---- group: View Projection Planes
pln = Plane(path_mapper_3)

# ----
demesh = DeconstructMesh(Mesh=mesh_3)  # -> Vertices, Faces, Colours, Normals

# ----
# Mesh Face Normals and View Lines
deface = DeconstructFace(Face=demesh.Faces)  # -> CornerA, CornerB, CornerC, CornerD
pt_2 = Point(demesh.Vertices)
item = ListItem(List=demesh.Normals, Index=deface.CornerA, Wrap=True)  # -> graft(Item)
item_2 = ListItem(List=pt_2, Index=deface.CornerA, Wrap=True)  # -> graft(Item)
item_3 = ListItem(List=pt_2, Index=deface.CornerB, Wrap=True)  # -> graft(Item)
item_4 = ListItem(List=pt_2, Index=deface.CornerC, Wrap=True)  # -> graft(Item)
item_5 = ListItem(List=pt_2, Index=deface.CornerD, Wrap=True)  # -> graft(Item)
merge = Merge(Data1=item_2, Data2=item_3, Data3=item_4, Data4=item_5)
avr = Average(Input=merge)

# ---- group: Mesh Face Center Pts
pt_3 = Point(avr)

# ---- group: Meshes
mesh_4 = Mesh(mesh_3)

# ---- group: View Pts
pt_4 = Point(pt)

# ---- group: View Projection Planes
pln_2 = Plane(pln)

# ---- group: Angle Tolerance
angle_tol_2 = Number(angle_tol)

# ---- group: View Lines (per Face, per Mesh)
ln = Line(StartPoint=pt_4, EndPoint=pt_3)

# ---- group: Face Normals
vec = Vector(item)

# ----
# Compare the angle of incidence to an Angle Tolerance.
# This is used to determine which Mesh Faces to keep.
# 
# A 'small angle' (returns false) means that the mesh face
# is almost beyond sight
cluster = Cluster(face_normals=vec, view_lines_vec=ln, angle_tol=angle_tol_2)

# ---- group: Include Face per Angle (per Face, per Mesh)
exceeds_angle_tol = Boolean(cluster)

# ---- group: Meshes
mesh_5 = Mesh(mesh_4)

# ---- group: View Pts
pt_5 = Point(pt_4)

# ---- group: View Lines (per Face, per Mesh)
line = Line(ln)

# ---- group: Meshes
mesh_6 = Mesh(mesh_4)

# ---- group: View Pts
pt_6 = Point(pt_4)

# ---- group: View Projection Planes
pln_3 = Plane(pln_2)

# ----
# Duplicate each Mesh
# by the quantity of View Points (View Lines)
lng = ListLength(List=pt_5)
dup = DuplicateData(Data=graft(mesh_5), Number=lng, Order=True)

lng_2 = ListLength(List=mesh_6)

# ---- group: View Lines (per Mesh, per View Line)
path_mapper_4 = PathMapper(line, source="{A;B;C}(d)", target="{A;B;d}(C)")
view_lines = Line(path_mapper_4)

# ----
# Duplicate each View Point
# and View Projection Plane
# by the quantity of meshes
dup_2 = DuplicateData(Data=graft(pt_6), Number=lng_2, Order=True)  # -> simplify(Data)
dup_3 = DuplicateData(Data=graft(pln_3), Number=lng_2, Order=True)  # -> simplify(Data)

# ---- group: Include Face per Angle (per Mesh, per View Line)
path_mapper_5 = PathMapper(exceeds_angle_tol, source="{A;B;C}(d)", target="{A;B;d}(C)")
bool = Boolean(path_mapper_5)

# ----
pshift_2 = ShiftPaths(Data=dup, Offset=-1)  # -> graft(Data)

# ---- group: Meshes (per Mesh, per View Line)
mesh_7 = Mesh(pshift_2)

# ----
cluster_2 = Cluster_2(meshes=mesh_7, view_lines=view_lines)  # -> intersection_pt_is_view_line_end_pt_2, closest_distance_per_mesh_2

# ---- group: Mesh Faces to remove (per Mesh, per View Line)
or = GateOr(A=bool, B=cluster_2.intersection_pt_is_view_line_end_pt_2)
not = GateNot(A=or)
bool_2 = Boolean(not)

# ----
cullf = CullFaces(Mesh=mesh_7, Pattern=bool_2)
clean = CleanTree(RemoveNulls=True, RemoveInvalid=True, RemoveEmpty=False, Tree=cullf)

# ---- group: Meshes (before sorting)
mesh_8 = Mesh(clean)

# ---- group: View Projection Planes (per View Line)
pln_4 = Plane(dup_3)

# ---- group: Duplicated View Pts (per View Line)
pt_7 = Point(dup_2)

# ----
path_mapper_6 = PathMapper(mesh_8, source="{A;B;C}", target="{C}(B)")
sort = SortList(Keys=cluster_2.closest_distance_per_mesh_2, ValuesA=path_mapper_6)  # -> Keys, ValuesA
path_mapper_7 = PathMapper(pt_7, source="{A}(b)", target="{0;b;A}")
path_mapper_8 = PathMapper(sort.ValuesA, source="{A}(b)", target="{0;b;A}")
path_mapper_9 = PathMapper(pln_4, source="{A}(b)", target="{0;b;A}")

# ---- group: Meshes (sorted)
mesh_9 = Mesh(path_mapper_8)

# ---- group: Duplicated View Pts
pt_8 = Point(path_mapper_7)

# ---- group: Duplicated View Projection Planes
pln_5 = Plane(path_mapper_9)

# ----
panel_2 = Panel(mesh_9)

# ---- group: Meshes (sorted)
mesh_10 = Mesh(mesh_9)

# ----
demesh_2 = DeconstructMesh(Mesh=mesh_10)  # -> Vertices, Faces, Colours, Normals
pshift_3 = ShiftPaths(Data=demesh_2.Vertices, Offset=-1)
ln_2 = Line(StartPoint=pt_8, EndPoint=pshift_3)
null = NullItem(Item=pshift_3)  # -> NullFlags, InvalidFlags, Description
plx = LinePlane(Line=ln_2, Plane=pln_5)  # -> Point, ParamL, ParamP
ma = MassAddition(Input=null.NullFlags)  # -> Result, PartialResults
conmesh = ConstructMesh(Vertices=plx.Point, Faces=demesh_2.Faces, Colours=demesh_2.Colours)
tstat = TreeStatistics(Tree=ma.Result)  # -> Paths, Length, Count
bool_3 = Boolean(flatten(ma.Result))
dispatch = Dispatch(List=tstat.Paths, DispatchPattern=bool_3)  # -> ListA, flatten(ListB)
branch_2 = TreeBranch(Tree=mesh_9, Path=dispatch.ListB, MaintainPaths=True)
pshift_4 = ShiftPaths(Data=conmesh, Offset=-1)
path_mapper_10 = PathMapper(pshift_4, source="{A;B;C}", target="{A;C}(B)")
path_mapper_11 = PathMapper(branch_2, source="{A;B;C}", target="{A;C}(B)")

meshes = Mesh(path_mapper_11)
projected_meshes = Mesh(path_mapper_10)

projected_meshes_2 = ClusterOutput(projected_meshes)
panel_3 = Panel(meshes)

# ==== cluster Cluster_4
cell_crvs = ClusterInput()
cell_crvs_2 = Curve(cell_crvs)

division = Division(A=776, B=405)
multiplication = Multiplication(A=division, B="24")

# ----
# For now, the assumption is made
# that there is only 1 level of cells.
# This will need to eventually be replaced
# with a robust logic for cell layout, in XY
# and in-place
lng = ListLength(List=cell_crvs_2)
extent_x = Integer(lng)
extent_y = Integer("1")

pt = ConstructPoint(XCoordinate="150", YCoordinate=0, ZCoordinate=0)
addition = Addition(A=multiplication, B="4")
addition_2 = Addition(A="24", B="4")
recgrid = Rectangular(Plane=pt, SizeX=addition, SizeY=addition_2, ExtentX=extent_x, ExtentY=extent_y)  # -> simplify(Cells), Points
offset = Offset(Curve=recgrid.Cells, Distance=expr("x * -0.5", "4"), Plane=PlaneXY(0, 0, 0), Corners=1)

# ----
# This is the standard order of 4-side bay curve corner points.
# The same applies to 4-sided cell curves.
crv = Curve(offset)
disc = Discontinuity(Curve=crv, Level=1)  # -> Points, Parameters
avr = Average(Input=disc.Points)
item = ListItem(List=disc.Points, Index=0, Wrap=True)  # -> Item, Item1, Item2, Item3
pshift = ShiftPaths(Data=avr, Offset=-1)

cell_xy_crvs = Curve(offset)
preview = CustomPreview(
    Geometry=crv,
    Shader={ambient=RGB(128, 128, 128), diffuse=RGB(255, 255, 255), emission=RGB(76, 76, 76), shine=0.5, specular=RGB(255, 255, 255), transparency=0})
cell_xy_crvs_2 = ClusterOutput(cell_xy_crvs)

# ---- group: Bottom Left
pt_2 = Point(item.Item)

# ---- group: Bottom Right
pt_3 = Point(item.Item1)

# ---- group: Top Right
pt_4 = Point(item.Item2)

# ---- group: Top Left
pt_5 = Point(item.Item3)

# ---- group: Center
pt_6 = Point(pshift)

# ---- group: Bottom Right
pt_7 = Point(pt_3)

# ---- group: Bottom Left
pt_8 = Point(pt_2)

# ---- group: Top Left
pt_9 = Point(pt_5)

# ---- group: Bottom Left
pt_10 = Point(pt_2)

# ---- group: Bottom Right
pt_11 = Point(pt_3)

# ---- group: Top Left
pt_12 = Point(pt_5)

# ---- group: Bottom Left
pt_13 = Point(pt_2)

# ---- group: Bottom Right
pt_14 = Point(pt_3)

# ----
# This is the direction vector constructor.
# It defines the horizontal and vertical
# directions of the 4-sided bay curve / cell curve.
vec2pt = Vector2Pt(PointA=pt_10, PointB=pt_11, Unitize=False)  # -> Vector, Length
vec2pt_2 = Vector2Pt(PointA=pt_10, PointB=pt_12, Unitize=False)  # -> Vector, Length
pshift_2 = ShiftPaths(Data=vec2pt.Vector, Offset=-1)
pshift_3 = ShiftPaths(Data=vec2pt_2.Vector, Offset=-1)

# ----
# This is the bottom center constructor.
# It defines the mid-point at bottom edge
# of the 4-sided bay curve / cell curve.
merge = Merge(Data1=pt_13, Data2=pt_7)
avr_2 = Average(Input=merge)
pshift_4 = ShiftPaths(Data=avr_2, Offset=-1)

# ----
# This is the standard plane constructor
# for the 4-sided bay curve / cell curve.
pl_3pt = Plane3Pt(PointA=pt_8, PointB=pt_14, PointC=pt_9)

pshift_5 = ShiftPaths(Data=pl_3pt, Offset=-1)

# ---- group: Bottom Center
pt_15 = Point(pshift_4)

# ---- group: Horizontal Direction
vec = Vector(pshift_2)

# ---- group: Vertical Direction
vec_2 = Vector(pshift_3)

# ==== cluster Cluster_5
cell_crvs = ClusterInput()
target_pt = ClusterInput()
cell_crvs_2 = Curve(cell_crvs)
pcen = PolygonCenter(Polyline=flatten(cell_crvs_2))  # -> graft(CenterV), CenterE, CenterA

# ---- group: View Pt
pt = Point(pcen.CenterV)

# ----
target_pt_2 = Point(target_pt)

Z = UnitZ(Factor=1)
ln = Line(StartPoint=pt, EndPoint=target_pt_2)
xprod = CrossProduct(VectorA=ln, VectorB=Z, Unitize=False)  # -> Vector, Length
xprod_2 = CrossProduct(VectorA=xprod.Vector, VectorB=ln, Unitize=False)  # -> Vector, Length
pl = ConstructPlane(Origin=pt, XAxis=xprod.Vector, YAxis=xprod_2.Vector)

view_lines = Line(ln)
view_lines_2 = ClusterOutput(view_lines)
cell_planes = Plane(pl)
cell_planes_2 = ClusterOutput(cell_planes)

# ==== cluster Cluster_6
meshes_to_subtract_from = ClusterInput()
meshes_to_subtract_with = ClusterInput()
cell_planes = ClusterInput()
cell_xy_crvs = ClusterInput()
cell_xy_crvs_2 = Curve(cell_xy_crvs)
meshes_to_subtract_from_2 = Mesh(meshes_to_subtract_from)
meshes_to_subtract_with_2 = Mesh(meshes_to_subtract_with)
cell_planes_2 = Plane(cell_planes)

# ----
# This is the standard order of 4-side bay curve corner points.
# The same applies to 4-sided cell curves.
crv = Curve(cell_xy_crvs_2)
disc = Discontinuity(Curve=crv, Level=1)  # -> Points, Parameters
avr = Average(Input=disc.Points)
item = ListItem(List=disc.Points, Index=0, Wrap=True)  # -> Item, Item1, Item2, Item3
pshift = ShiftPaths(Data=avr, Offset=-1)

cell_xy_crvs_3 = ClusterOutput(cell_xy_crvs_2)
preview = CustomPreview(
    Geometry=crv,
    Shader={ambient=RGB(128, 128, 128), diffuse=RGB(255, 255, 255), emission=RGB(76, 76, 76), shine=0.5, specular=RGB(255, 255, 255), transparency=0})

# ---- group: Bottom Left
pt = Point(item.Item)

# ---- group: Bottom Right
pt_2 = Point(item.Item1)

# ---- group: Top Right
pt_3 = Point(item.Item2)

# ---- group: Top Left
pt_4 = Point(item.Item3)

# ---- group: Center
pt_5 = Point(pshift)

# ---- group: Top Left
pt_6 = Point(pt_4)

# ---- group: Bottom Left
pt_7 = Point(pt)

# ---- group: Bottom Right
pt_8 = Point(pt_2)

# ---- group: Bottom Left
pt_9 = Point(pt)

# ---- group: Bottom Right
pt_10 = Point(pt_2)

# ---- group: Top Left
pt_11 = Point(pt_4)

# ---- group: Bottom Left
pt_12 = Point(pt)

# ---- group: Bottom Right
pt_13 = Point(pt_2)

# ---- group: Center
pt_14 = Point(pt_5)

# ----
# This is the direction vector constructor.
# It defines the horizontal and vertical
# directions of the 4-sided bay curve / cell curve.
vec2pt = Vector2Pt(PointA=pt_12, PointB=pt_13, Unitize=False)  # -> Vector, Length
vec2pt_2 = Vector2Pt(PointA=pt_12, PointB=pt_6, Unitize=False)  # -> Vector, Length

# ----
# This is the bottom center constructor.
# It defines the mid-point at bottom edge
# of the 4-sided bay curve / cell curve.
merge = Merge(Data1=pt_7, Data2=pt_8)
avr_2 = Average(Input=merge)

# ----
# This is the standard plane constructor
# for the 4-sided bay curve / cell curve.
pl_3pt = Plane3Pt(PointA=pt_9, PointB=pt_10, PointC=pt_11)

pshift_2 = ShiftPaths(Data=pl_3pt, Offset=-1)
pl_origin = PlaneOrigin(Base=pshift_2, Origin=pt_14)

# ---- group: Bottom Center
pt_15 = Point(avr_2)

# ---- group: Horizontal Direction
vec = Vector(vec2pt.Vector)

# ---- group: Vertical Direction
vec_2 = Vector(vec2pt_2.Vector)

# ----
cell_xy_crvs_4 = Curve(simplify(cell_xy_crvs_2))

# ---- group: Centered Plane
pln = Plane(pl_origin)

pln_2 = Plane(pln)

# ----
orient = Orient(Geometry=meshes_to_subtract_with_2, Source=cell_planes_2, Target=pln_2)  # -> simplify(Geometry), Transform
project = Project(Geometry=orient.Geometry, Plane=PlaneXY(0, 0, 0))  # -> Geometry, Transform

orient_2 = Orient(Geometry=meshes_to_subtract_from_2, Source=cell_planes_2, Target=pln_2)  # -> Geometry, Transform
project_2 = Project(Geometry=orient_2.Geometry, Plane=PlaneXY(0, 0, 0))  # -> Geometry, Transform

# ----
# Generating the mesh outline by Convex Hull
# Use this mor convex geometry only, for now
medges = MeshEdges(Mesh=project.Geometry)  # -> NakedEdges, InteriorEdges, NonManifoldEdges
end = EndPoints(Curve=medges.NakedEdges)  # -> Start, End
merge_2 = Merge(Data1=end.Start, Data2=end.End)
hull = ConvexHull(Points=merge_2, Plane=PlaneXY(0, 0, 0))  # -> Hull, HullZ, Indices
pshift_3 = ShiftPaths(Data=hull.Hull, Offset=-1)  # -> simplify(Data)

medges_2 = MeshEdges(Mesh=project_2.Geometry)  # -> NakedEdges, InteriorEdges, NonManifoldEdges

# ----
# Generating the mesh outline by Join Curve
# has the following issues:
# - takes longer to calculate
# - may result in self-intersecting curves
join = JoinCurves(Curves=medges.NakedEdges, Preserve=False)
pshift_4 = ShiftPaths(Data=join, Offset=-2)  # -> simplify(Data)
cx = CurveSelf(Curve=pshift_4)  # -> Points, Params

join_2 = JoinCurves(Curves=medges_2.NakedEdges, Preserve=False)  # -> simplify(Curves)
rint = RegionIntersection(CurvesA=cell_xy_crvs_4, CurvesB=join_2)

# ---- group: Mesh B outlines
# Mesh B Outlines
# before Region Difference
crv_2 = Curve(pshift_3)

# ----
cell_xy_crvs_5 = Curve(cell_xy_crvs_4)

lng = ListLength(List=crv_2)
series = Series(Start=0, Step=1, Count=lng)  # -> simplify(Series)
c_script = CSharpScript(outlines=crv_2)  # -> out, A, B; inputs outlines: list of Curve
# ---------- c_script: C# ----------
    List<Curve> newOutlines = new List<Curve>();
    List<int> newIndices = new List<int>();
    List<Curve> foreground_crvs = new List<Curve>();

    Curve outline_background = outlines[1];
    int outline_index = 1;

    Curve outline_foreground = outlines[0];
    Curve[] outline_bool;

    string containment = "nothing yet";

    newOutlines.Add(outline_foreground);
    newIndices.Add(0);

    for (int i = 0; i < outlines.Count - 1; i++)
    {
      containment = "nothing";
      outline_background = outlines[i + 1];
      outline_index = i + 1;

      foreground_crvs.Add(outlines[i]);
      for (int j = 0; j < foreground_crvs.Count; j++)
      {
        Print("j = " + j.ToString());
        outline_bool = Curve.CreateBooleanDifference(outline_background, foreground_crvs[j]);

        if (outline_bool.Length > 0)
        {
          Print("boolean at i = " + i.ToString());
          outline_background = outline_bool[0];
        }
        else
        {
          Point3d ctr = AreaMassProperties.Compute(outline_background).Centroid;
          containment = foreground_crvs[j].Contains(ctr).ToString();
          if (containment == "Inside")
          {
            Print("contains = " + containment);
            break;
          }
        }
      }

      if (containment != "Inside")
      {
        newOutlines.Add(outline_background);
        newIndices.Add(i + 1);
      }


    }

    A = newOutlines;
    B = newIndices;
# ---------- end c_script ----------
int = Integer(series)
difference = SetDifference(SetA=int, SetB=c_script.B)
item_2 = ListItem(List=crv_2, Index=difference, Wrap=True)

rint_2 = RegionIntersection(CurvesA=crv_2, CurvesB=cell_xy_crvs_5)
pshift_5 = ShiftPaths(Data=rint_2, Offset=-1)
runion = RegionUnion(Curves=pshift_5)
pshift_6 = ShiftPaths(Data=runion, Offset=-1)

# ----
# Preserve the distinction between
# 'Green curves' and 'Trunk curves'
panel = Panel("<null>")
dup = DuplicateData(Data=cell_xy_crvs_5, Number=lng, Order=True)  # -> simplify(graft(Data))
ins = InsertItems(List=c_script.A, Item=item_2, Indices=difference, Wrap=True)  # -> simplify(graft(List))
replace = ReplaceItems(List=int, Item=panel, Indices=difference, Wrap=False)  # -> simplify(List)
int_2 = Integer(replace)
rint_3 = RegionIntersection(CurvesA=ins, CurvesB=dup)  # -> simplify(Result)
path_mapper = PathMapper(rint_3, source="{A;B}", target="{A}(B)")
null = NullItem(Item=path_mapper)  # -> NullFlags, InvalidFlags, Description
null_2 = NullItem(Item=int_2)  # -> NullFlags, InvalidFlags, Description
not = GateNot(A=null.NullFlags)
not_2 = GateNot(A=null_2.NullFlags)
and = GateAnd(A=not, B=not_2)

rdiff = RegionDifference(CurvesA=simplify(rint), CurvesB=simplify(pshift_6))

# ---- group: Mesh B before Region Difference
mesh = Mesh(project.Geometry)

# ----
cull = CullPattern(List=path_mapper, CullPattern=and)
mesh_b_outline = Curve(cull)

# ----
# Currently need to fix the colour mismatch
cull_2 = CullPattern(List=mesh, CullPattern=and)
demesh = DeconstructMesh(Mesh=cull_2)  # -> Vertices, Faces, Colours, Normals
cset = CreateSet(List=demesh.Colours)  # -> Set, Map
pshift_7 = ShiftPaths(Data=cset.Set, Offset=-1)

crv_3 = Curve(graft(mesh_b_outline))
medges_3 = MeshEdges(Mesh=cull_2)  # -> NakedEdges, InteriorEdges, NonManifoldEdges
trim = TrimWithRegion(Curve=medges_3.InteriorEdges, Region=crv_3)  # -> Inside, Outside
Z = UnitZ(Factor=0.1)
move = Move(Geometry=trim.Inside, Motion=Z)  # -> Geometry, Transform
panel_2 = Panel(pshift_7)

# ---- group: Foreground Colours
col = Colour(pshift_7)

# ----
mesh_2 = MeshBrep(
    Brep=mesh_b_outline,
    Settings={GridMaxCount=0, GridMinCount=16, JaggedSeams=False, MaxEdgeLength=0, MinEdgeLength=0.0001, MinTolerance=0, Refine=True, RefineAngle=0, RelativeTolerance=0.65, SimplePlanes=True, Tolerance=0})
mcol = MeshColours(Mesh=graft(mesh_2), Colours=graft(col))

# ---- group: Foreground Mesh
foreground = Mesh(mcol)

# ----
foreground_interior_edges = Line(move.Geometry)
foreground_outline = Curve(mesh_b_outline)
background_outline = Curve(rdiff)
foreground_2 = ClusterOutput(foreground)
foreground_outline_2 = ClusterOutput(foreground_outline)
foreground_interior_edges_2 = ClusterOutput(foreground_interior_edges)
background_outline_2 = ClusterOutput(background_outline)

# ==== cluster Cluster_7
foreground = ClusterInput()
foreground_outline = ClusterInput()
foreground_interior_edges = ClusterInput()
background_outline = ClusterInput()
cell_xy_crvs = ClusterInput()
foreground_interior_edges_2 = Line(foreground_interior_edges)
background_outline_2 = Curve(background_outline)
cell_xy_crvs_2 = Curve(cell_xy_crvs)

# ---- group: Foreground Mesh
foreground_2 = Mesh(foreground)

# ----
foreground_outline_2 = Curve(foreground_outline)

area = Area(Geometry=foreground_outline_2)  # -> Area, Centroid
swatch = ColourSwatch(SwatchColor=RGB(0, 0, 0))
int = Integer(area.Area)
move = Move(Geometry=area.Centroid, Motion=Vector(0, 0, 15))  # -> Geometry, Transform
preview = CustomPreview(Geometry=foreground_outline_2, Shader=swatch)
tag = TextTag3D(Location=move.Geometry, Text=int, Size=1.4, Colour=swatch, Justification=5)
preview_2 = CustomPreview(Geometry=foreground_interior_edges_2, Shader=ColourSwatch(SwatchColor=RGB(64, 64, 64)))

boundary = BoundarySurfaces(Edges=background_outline_2)
mesh = MeshBrep(
    Brep=boundary,
    Settings={GridMaxCount=0, GridMinCount=16, JaggedSeams=False, MaxEdgeLength=0, MinEdgeLength=0.0001, MinTolerance=0, Refine=True, RefineAngle=0, RelativeTolerance=0.65, SimplePlanes=True, Tolerance=0})
mcol = MeshColours(Mesh=mesh, Colours=ColourSwatch(SwatchColor=RGB(102, 61, 61)))
preview_3 = CustomPreview(Geometry=cell_xy_crvs_2, Shader=ColourSwatch(SwatchColor=RGB(0, 0, 0)))

# ==== cluster Cluster_8

# ---- group: Green Diameter
panel = Panel("10")

# ---- group: Trunk Height
panel_2 = Panel("4")

# ----
pts = ClusterInput()
coarse_fine = ClusterInput()
pts_2 = Point(pts)
coarse_fine_2 = Integer(coarse_fine)
addition = Addition(A=panel_2, B=panel)
dom = ConstructDomain(DomainStart=expr("x * -0.5", panel), DomainEnd=expr("x * 0.5", panel))
dom_2 = ConstructDomain(DomainStart=panel_2, DomainEnd=addition)
dom_3 = ConstructDomain(DomainStart=expr("x * -1", "1.0"), DomainEnd="1.0")
dom_4 = ConstructDomain(DomainStart=0, DomainEnd=panel_2)

box = DomainBox(Base=pts_2, X=dom, Y=dom, Z=dom_2)
mbox = MeshBox(Base=box, XCount=1, YCount=1, ZCount=1)  # -> graft(Mesh)

box_2 = DomainBox(Base=pts_2, X=dom_3, Y=dom_3, Z=dom_4)
mbox_2 = MeshBox(Base=box_2, XCount=1, YCount=1, ZCount=1)  # -> graft(Mesh)

panel_3 = Panel(panel)
boxprop = BoxProperties(Box=box)  # -> Center, Diagonal, Area, Volume, Degeneracy
msphere = MeshSphere(Base=boxprop.Center, Radius=expr("x * 0.5", panel_3), UCount="12", VCount="16")  # -> graft(Mesh)
custom_mesh_settings = SettingsCustom(
    StitchSeams=True,
    SimplePlanes=False,
    Refine=True,
    MinCount="2",
    MaxCount="8",
    AspectRatio=20,
    MaxDistance=0,
    MaxAngle="60",
    MinEdge=0,
    MaxEdge=0)
cyl = Cylinder(Base=pts_2, Radius=expr("x * 0.5", "1.0"), Length=panel_2)
swatch = ColourSwatch(SwatchColor=RGB(0, 128, 15))
swatch_2 = ColourSwatch(SwatchColor=RGB(128, 68, 0))
mesh = MeshBrep(Brep=cyl, Settings=custom_mesh_settings)  # -> graft(Mesh)
mcol = MeshColours(Mesh=mbox, Colours=swatch)
mcol_2 = MeshColours(Mesh=mbox_2, Colours=swatch_2)
panel_4 = Panel(msphere)
panel_5 = Panel(mesh)
mcol_3 = MeshColours(Mesh=msphere, Colours=swatch)
mcol_4 = MeshColours(Mesh=mesh, Colours=swatch_2)
merge = Merge(Data1=mcol_3, Data2=mcol_4)
merge_2 = Merge(Data1=mcol, Data2=mcol_2)
path_mapper = PathMapper(merge, source="{A;B}", target="{1;A;B}")
path_mapper_2 = PathMapper(merge_2, source="{A;B}", target="{0;A;B}")
expression = Expression(x=coarse_fine_2, Expression="Format(\"{{{0};*}}\", x)")
merge_3 = Merge(Data1=path_mapper, Data2=path_mapper_2)
split = SplitTree(Data=merge_3, Masks=flatten(expression))  # -> Positive, Negative
path_mapper_3 = PathMapper(split.Positive, source="{A;B;C}", target="{B;C}")
mjoin = MeshJoin(Meshes=path_mapper_3)
mesh_trees = Mesh(mjoin)
medges = MeshEdges(Mesh=mesh_trees)  # -> NakedEdges, InteriorEdges, NonManifoldEdges
mesh_trees_2 = ClusterOutput(mesh_trees)
preview = CustomPreview(Geometry=medges.InteriorEdges, Shader=ColourSwatch(SwatchColor=RGB(255, 255, 255)))

# ==== cluster Cluster_9
location_pt = ClusterInput()
length = ClusterInput()
depth_width = ClusterInput()
height = ClusterInput()
length_2 = Number(length)
depth_width_2 = Number(depth_width)
height_2 = Number(height)
dom = ConstructDomain(DomainStart=expr("x * -0.5", length_2), DomainEnd=expr("x * 0.5", length_2))
dom_2 = ConstructDomain(DomainStart=expr("x * -0.5", depth_width_2), DomainEnd=expr("x * 0.5", depth_width_2))
dom_3 = ConstructDomain(DomainStart=0, DomainEnd=height_2)
location_pt_2 = Point(location_pt)
box = DomainBox(Base=location_pt_2, X=dom, Y=dom_2, Z=dom_3)
qty_cells = ClusterInput()

# ----
# Mesh Division
qty_cells_2 = XCount(qty_cells)

mbox = MeshBox(Base=box, XCount=qty_cells_2, YCount=1, ZCount=1)
sprout_space_mesh = Mesh(mbox)
sprout_space_mesh_2 = ClusterOutput(sprout_space_mesh)

# ==== cluster Cluster_13
mesh = ClusterInput()
mesh_2 = Mesh(mesh)
medges = MeshEdges(Mesh=mesh_2)  # -> NakedEdges, InteriorEdges, NonManifoldEdges

# ----
# Mesh Cells
cluster = Cluster_10(mesh=mesh_2)  # -> cell_crvs_2, cell_center_pts_2, cell_normals_2

# ----
# Facade Mesh Cells
cluster_2 = Cluster_11(cell_crvs=cluster.cell_crvs_2, cell_center_pts=cluster.cell_center_pts_2, cell_normals=cluster.cell_normals_2)  # -> cell_crvs_4, cell_center_pts_4, cell_normals_4

# ----
# North Facade
cluster_3 = Cluster_12(cell_crvs=cluster_2.cell_crvs_4, cell_center_pts=cluster_2.cell_center_pts_4, cell_normals=cluster_2.cell_normals_4)  # -> cell_crvs_5, cell_center_pts_4, cell_normals_4

cell_crvs = Curve(cluster_3.cell_crvs_5)
cell_center_pts = Point(cluster_3.cell_center_pts_4)
cell_normals = Vector(cluster_3.cell_normals_4)
cell_crvs_2 = ClusterOutput(cell_crvs)

# ==== cluster Cluster_14
street_cl_pts = ClusterInput()
street_cl_pts_2 = Point(street_cl_pts)
pline = PolyLine(Vertices=street_cl_pts_2, Closed=False)
depth_width = Number("30")
height = Number("8")
dom = ConstructDomain(DomainStart=expr("x * -0.5", depth_width), DomainEnd=expr("x * 0.5", depth_width))
pframe = PerpFrame(Curve=pline, Parameter=0)
dom_2 = ConstructDomain(DomainStart=0, DomainEnd=height)
rectangle = Rectangle(Plane=pframe, XSize=dom_2, YSize=dom, Radius=0)  # -> Rectangle, Length
swp1 = Sweep1(Rail=pline, Sections=rectangle.Rectangle, Miter=1)
cap = CapHoles(Brep=swp1)
smesh = SimpleMesh(Brep=cap)
street_volume_mesh = Mesh(smesh)
street_volume_mesh_2 = ClusterOutput(street_volume_mesh)

# ==== cluster Cluster_24
system_descriptors = ClusterInput()
system_descriptors_2 = Data(system_descriptors)
cluster = Cluster_15(data=system_descriptors_2, path_mask="{2;*}")
branch = TreeBranch(Tree=cluster, Path="{0}", MaintainPaths=True)
cluster_2 = Cluster_15(data=cluster, path_mask="{3;*}")
cluster_3 = Cluster_15(data=cluster, path_mask="{2;*}")
panel = Panel(branch)
facade_cells = ClusterInput()
window_wall_parameters = Data(cluster_2)
window_wall_profiles = Data(cluster_3)
facade_cells_2 = Data(facade_cells)
cluster_4 = Cluster_15(data=window_wall_parameters, path_mask="{6;*}")
cluster_5 = Cluster_15(data=window_wall_parameters, path_mask="{4;*}")
cluster_6 = Cluster_15(data=window_wall_parameters, path_mask="{5;*}")
branch_2 = TreeBranch(Tree=facade_cells_2, Path="{0}", MaintainPaths=True)
branch_3 = TreeBranch(Tree=window_wall_profiles, Path="{0}", MaintainPaths=True)
branch_4 = TreeBranch(Tree=window_wall_parameters, Path="{0}", MaintainPaths=True)
cluster_7 = Cluster_15(data=facade_cells_2, path_mask="{1;*}")
cluster_8 = Cluster_15(data=facade_cells_2, path_mask="{2;*}")
cluster_9 = Cluster_15(data=window_wall_profiles, path_mask="{2;*}")
cluster_10 = Cluster_15(data=window_wall_profiles, path_mask="{1;*}")
cluster_11 = Cluster_15(data=window_wall_profiles, path_mask="{3;*}")
cluster_12 = Cluster_15(data=window_wall_profiles, path_mask="{4;*}")
cluster_13 = Cluster_15(data=window_wall_profiles, path_mask="{5;*}")
cluster_14 = Cluster_15(data=window_wall_profiles, path_mask="{6;*}")
panel_2 = Panel(branch_2)
panel_3 = Panel(branch_3)
panel_4 = Panel(branch_4)
vent_height = Number(cluster_5)
min_vent_width = Number(cluster_6)

# ---- group: Glazing Lite Description
txt = Text(cluster_4)

# ---- group: Jamb Profile YZ
txt_2 = Text(cluster_10)

# ---- group: H. Mullion Profile YZ
txt_3 = Text(cluster_13)

# ---- group: V. Mullion Profile XY
txt_4 = Text(cluster_14)

# ---- group: Caulking Profile YZ
txt_5 = Text(cluster_9)

# ---- group: Header Profile YZ
txt_6 = Text(cluster_11)

# ---- group: Sill Profile YZ
txt_7 = Text(cluster_12)

# ----
cell_crvs = Curve(cluster_7)

# ---- group: Cell Descriptions
txt_8 = Text(cluster_8)

# ----
panel_5 = Panel(cell_crvs)

# ---- group: Header Profile YZ
txt_9 = Text(txt_6)

# ---- group: Sill Profile YZ
txt_10 = Text(txt_7)

# ---- group: Typ. Vent Width
num = Number(min_vent_width)

# ---- group: Glazing Lite Description
txt_11 = Text(txt)

# ----
cell_crvs_2 = Curve(cell_crvs)

# ----
# Offset the 'Vertical' sides
# of the Cell Curves
# to represent the inside edge
# of Window Wall Jambs
cluster_15 = Cluster_22(cell_crvs=cell_crvs_2, header_profile_yz=txt_9, sill_profile_yz=txt_10)

# ---- group: Simplified Glazing Curves
# These Curves are to be used
# for Energy Modeling downstream
crv = Curve(cluster_15)

# ----
# Generate the Glazing Lite Curves
# by using the Glazing Lite Description
# and a Typical Vent Width
# Caution:
# Currently assumes that the Vent width
# is a constant value
# This is NOT necessarily always the case
# 
# Caution:
# Currently assumes that top and bottom edges
# (header and sill) are parallel
# This is NOT necessarily always the case
cluster_16 = Cluster_23(cell_curves=cluster_15, typ_vent_width=num, glazing_lite_description=txt_11)

cell_crvs_3 = Curve(cell_crvs)

# ---- group: Cell Descriptions
txt_12 = Text(txt_8)

# ----
glazing_lite_curves = Curve(cluster_16)
cluster_17 = Cluster_17(data=crv, path="1")
panel_6 = Panel("""{1;*} Cell Curves
{2;*} Cell Descriptions
{3;*} Glazing Lite Curves
{4;*} Glazing Lite Descriptions""")
cluster_18 = Cluster_17(data=cell_crvs_3, path="1")
cluster_19 = Cluster_17(data=glazing_lite_curves, path="3")
cluster_20 = Cluster_17(data=txt_11, path="4")
cluster_21 = Cluster_17(data=txt_12, path="2")

swatch = ColourSwatch(SwatchColor=RGB(74, 246, 255))
material = CreateMaterial(Diffuse=swatch, Specular=RGB(255, 255, 255), Emission=swatch, Transparency="0.8", Shine=0)
mesh = MeshBrep(
    Brep=glazing_lite_curves,
    Settings={GridMaxCount=0, GridMinCount=16, JaggedSeams=False, MaxEdgeLength=0, MinEdgeLength=0.0001, MinTolerance=0, Refine=True, RefineAngle=0, RelativeTolerance=0.65, SimplePlanes=True, Tolerance=0})
preview = CustomPreview(
    Geometry=cell_crvs_3,
    Shader={ambient=RGB(128, 128, 128), diffuse=RGB(255, 255, 255), emission=RGB(76, 76, 76), shine=0.5, specular=RGB(255, 255, 255), transparency=0})
preview_2 = CustomPreview(Geometry=mesh, Shader=material)

merge = Merge(Data1="{1;*} Glazing Curves", Data2=cluster_17, Data3=cluster_19, Data4=cluster_20)
merge_2 = Merge(Data1=panel_6, Data2=cluster_18, Data3=cluster_21, Data4=cluster_19, Data5=cluster_20)
cells_and_sub_cells = Data(merge_2)
energy_modeling_data = Data(merge)
energy_modeling_data_2 = ClusterOutput(energy_modeling_data)
cells_and_sub_cells_2 = ClusterOutput(cells_and_sub_cells)

# ==== cluster Cluster_25
unit_conversion = ClusterInput()
vent_height = ClusterInput()
min_vent_width = ClusterInput()
glazing_description = ClusterInput()
panel = Panel("""{1;*} 
{2;*} 
{3;*} 
{5;*} Min. Vent Width
{6;*} Glazing Lite Descriptions""")
unit_conversion_2 = Number(unit_conversion)
min_vent_width_2 = Number(min_vent_width)
vent_height_2 = Number(vent_height)

# ---- group: Glazing Lite Descriptions
glazing_description_2 = Text(glazing_description)

# ----
cluster = Cluster_17(data=vent_height_2, path="4")
cluster_2 = Cluster_17(data=min_vent_width_2, path="5")
cluster_3 = Cluster_17(data=glazing_description_2, path="6")
panel_2 = Panel(cluster_3)
flatten = FlattenTree(Tree=unit_conversion_2, Path="{-1}")
merge = Merge(Data1=cluster, Data2=cluster_2)
multiplication = Multiplication(A=flatten, B=merge)
merge_2 = Merge(Data1=panel, Data2=multiplication, Data3=cluster_3)
parameters = Data(merge_2)
parameters_2 = ClusterOutput(parameters)

# ==== cluster Cluster_26
angle_tol = ClusterInput()
lens_length = ClusterInput()
view_lines = ClusterInput()

# ---- group: Angle Tolerance
angle_tol_2 = Number(angle_tol)

# ----
view_lines_2 = Line(view_lines)
lens_length_2 = Number(lens_length)
line = Line(flatten(view_lines_2))
end = EndPoints(Curve=line)  # -> Start, End

# ---- group: View Pts
pt = Point(end.Start)

# ---- group: View Lines
line_2 = Line(line)

# ----
lens_length_3 = Number(lens_length_2)

# ----
# View Projection Planes
amp = Amplitude(Vector=line_2, Amplitude=lens_length_3)
move = Move(Geometry=pt, Motion=amp)  # -> Geometry, Transform
crv_cp = CurveClosestPoint(Point=move.Geometry, Curve=line_2)  # -> Point, Parameter, Distance
pframe = PerpFrame(Curve=line_2, Parameter=crv_cp.Parameter)

panel = Panel("""{1;A} View Pts
{2;A} Angle Tolerance
{3;A} View Projection Planes""")

# ---- group: Angle Tolerance
angle_tol_3 = Number(angle_tol_2)

# ---- group: View Pts
pt_2 = Point(pt)

# ---- group: View Projection Planes
pln = Plane(pframe)

# ----
path_mapper = PathMapper(angle_tol_3, source="{A}", target="{2;A}")
path_mapper_2 = PathMapper(pt_2, source="{A}", target="{1;A}")
path_mapper_3 = PathMapper(pln, source="{A}", target="{3;A}")
panel_2 = Panel(pln)
merge = Merge(Data1=panel, Data3=path_mapper, Data4=path_mapper_2, Data5=path_mapper_3)
optics = Data(merge)
optics_2 = ClusterOutput(optics)

# ==== cluster Cluster_29
base_plane = ClusterInput()
module_offset = ClusterInput()
length = ClusterInput()
depth_width = ClusterInput()
base_plane_2 = Plane(base_plane)
module_offset_2 = Number(module_offset)

# ---- group: Module Length
length_2 = Number(length)

# ---- group: Module Width
depth_width_2 = Number(depth_width)

# ---- group: Base Plane
pln = Plane(base_plane_2)

# ---- group: Module Offset
num = Number(module_offset_2)

# ---- group: Base Plane
pln_2 = Plane(pln)

# ---- group: Module Offset
num_2 = Number(num)

# ---- group: Module Length
num_3 = Number(length_2)

# ---- group: Module Width
num_4 = Number(depth_width_2)

# ---- group: Base Plane
pln_3 = Plane(pln)

# ---- group: Module Length
num_5 = Number(length_2)

# ---- group: Classroom Length
num_6 = Number("27.5")

# ---- group: Module Width
num_7 = Number(depth_width_2)

# ---- group: Module Half-Width
num_8 = Number(expr("x / 2", num_4))

# ---- group: Module Half-Length
num_9 = Number(expr("x / 2", num_5))

# ----
dom = ConstructDomain(DomainStart=expr("x * -0.5", num_3), DomainEnd=expr("x * 0.5", num_3))
dom_2 = ConstructDomain(DomainStart=expr("x * -0.5", num_4), DomainEnd=expr("x * 0.5", num_4))

dom_3 = ConstructDomain(DomainStart=expr("x * -1", num_6), DomainEnd=0)
dom_4 = ConstructDomain(DomainStart=expr("x * -1", num_7), DomainEnd=num_7)

# ---- group: Base Plane
pln_4 = Plane(pln_2)

# ----
# Draw the Module curves in plan
deplane = DeconstructPlane(Plane=pln_2)  # -> Origin, XAxis, YAxis, ZAxis
amp = Amplitude(Vector=deplane.XAxis, Amplitude=num_2)
amp_2 = Amplitude(Vector=deplane.YAxis, Amplitude=num_8)
addition = Addition(A=amp, B=amp_2)
move = Move(Geometry=pln_4, Motion=addition)  # -> Geometry, Transform

deplane_2 = DeconstructPlane(Plane=pln_2)  # -> Origin, XAxis, YAxis, ZAxis
amp_3 = Amplitude(Vector=deplane_2.YAxis, Amplitude=expr("x * -1", num_8))
move_2 = Move(Geometry=pln_4, Motion=amp_3)  # -> Geometry, Transform

# ---- group: Base Plane
pln_5 = Plane(pln_3)

# ----
# Draw the Classroom space curve in plan
deplane_3 = DeconstructPlane(Plane=pln_3)  # -> Origin, XAxis, YAxis, ZAxis
amp_4 = Amplitude(Vector=deplane_3.XAxis, Amplitude=num_9)
move_3 = Move(Geometry=pln_5, Motion=amp_4)  # -> Geometry, Transform

# ---- group: Length Domain
domain = Domain(dom)

# ---- group: Width Domain
domain_2 = Domain(dom_2)

# ---- group: Classroom: Plane
pln_6 = Plane(move_3.Geometry)

# ---- group: Length Domain
domain_3 = Domain(dom_3)

# ---- group: Width Domain
domain_4 = Domain(dom_4)

# ---- group: Module 2: Plane
pln_7 = Plane(move_2.Geometry)

# ---- group: Module 1: Plane
pln_8 = Plane(move.Geometry)

# ----
rectangle = Rectangle(Plane=pln_8, XSize=domain, YSize=domain_2, Radius=0)  # -> Rectangle, Length
rectangle_2 = Rectangle(Plane=pln_7, XSize=domain, YSize=domain_2, Radius=0)  # -> Rectangle, Length
rectangle_3 = Rectangle(Plane=pln_6, XSize=domain_3, YSize=domain_4, Radius=0)  # -> Rectangle, Length
merge = Merge(Data1=rectangle.Rectangle, Data2=rectangle_2.Rectangle)

# ---- group: Modules: curves in plan
crv = Curve(merge)

# ----
runion = RegionUnion(Curves=crv)
pshift = ShiftPaths(Data=runion, Offset=-1)
sub_division = ClusterInput()
valley_height = ClusterInput()
max_height = ClusterInput()

# ---- group: Envelope: curves in plan
crv_2 = Curve(pshift)

# ----
sub_division_2 = Data(sub_division)
branch = TreeBranch(Tree=sub_division_2, Path="{0}", MaintainPaths=True)
cluster = Cluster_15(data=sub_division_2, path_mask="{1;*}")
cluster_2 = Cluster_15(data=sub_division_2, path_mask="{2;*}")

# ---- group: Envelope: curves in plan
crv_3 = Curve(crv_2)

# ----
max_height_2 = Number(max_height)
valley_height_2 = Number(valley_height)

# ---- group: Modules: curves in plan
crv_4 = Curve(crv)

# ---- group: Classroom Space: curve in plan
crv_5 = Curve(rectangle_3.Rectangle)

# ----
offset = Offset(Curve=crv_5, Distance=-0.125, Plane=PlaneXY(0, 0, 0), Corners=1)
mesh = MeshBrep(
    Brep=offset,
    Settings={GridMaxCount=0, GridMinCount=16, JaggedSeams=False, MaxEdgeLength=0, MinEdgeLength=0.0001, MinTolerance=0, Refine=True, RefineAngle=0, RelativeTolerance=0.65, SimplePlanes=True, Tolerance=0})
preview = CustomPreview(Geometry=mesh, Shader=ColourSwatch(SwatchColor=RGBA(0, 0, 0, 108)))

disc = Discontinuity(Curve=crv_3, Level=1)  # -> Points, Parameters
panel = Panel("""True
True
False
False""")
pshift_2 = ShiftPaths(Data=disc.Points, Offset=-1)
dispatch = Dispatch(List=pshift_2, DispatchPattern=panel)  # -> ListA, ListB
addition_2 = Addition(A="0.5", B=valley_height_2)
Z = UnitZ(Factor=addition_2)
Z_2 = UnitZ(Factor=max_height_2)
move_4 = Move(Geometry=dispatch.ListA, Motion=Z)  # -> Geometry, Transform
move_5 = Move(Geometry=dispatch.ListB, Motion=Z_2)  # -> Geometry, Transform
not = GateNot(A=panel)
weave = Weave(Pattern=not, Stream0=move_4.Geometry, Stream1=move_5.Geometry, NullGaps=False)
pline = PolyLine(Vertices=weave, Closed=invert(False))
explode = Explode(Curve=pline, Recursive=True)  # -> graft(Segments), Vertices

panel_2 = Panel(branch)
merge_2 = Merge(Data1=cluster, Data2=cluster_2)
Z_3 = UnitZ(Factor=valley_height_2)
lng = ListLength(List=cluster)
lng_2 = ListLength(List=cluster_2)
move_6 = Move(Geometry=crv_3, Motion=Z_3)  # -> Geometry, Transform
merge_3 = Merge(Data1=lng, Data2=lng_2)
dup = DuplicateData(Data=merge_2, Number="8", Order=True)

# ----
# Manual Selection
panel_3 = Panel("0")
explode_2 = Explode(Curve=crv_2, Recursive=True)  # -> Segments, Vertices
item = ListItem(List=explode_2.Segments, Index=panel_3, Wrap=True)
pshift_3 = ShiftPaths(Data=item, Offset=-1)

# ----
# Manual Selection
panel_4 = Panel("2")
explode_3 = Explode(Curve=crv_5, Recursive=True)  # -> Segments, Vertices
item_2 = ListItem(List=explode_3.Segments, Index=panel_4, Wrap=True)
pshift_4 = ShiftPaths(Data=item_2, Offset=-1)

# ----
# Manual Selection
explode_4 = Explode(Curve=move_6.Geometry, Recursive=True)  # -> Segments, Vertices
item_3 = ListItem(List=explode_4.Segments, Index="2", Wrap=True)
pshift_5 = ShiftPaths(Data=item_3, Offset=-1)

# ----
# Manual Selection
explode_5 = Explode(Curve=move_6.Geometry, Recursive=True)  # -> Segments, Vertices
item_4 = ListItem(List=explode_5.Segments, Index="6", Wrap=True)
pshift_6 = ShiftPaths(Data=item_4, Offset=-1)

pshift_7 = ShiftPaths(Data=dup, Offset=-1)
partition = PartitionList(List=pshift_7, Size=merge_3)

# ----
# Manual Edit:
# Defining the location
# for three pairs of doors
cluster_3 = Cluster_28(C=pshift_4)
divide = DivideCurve(Curve=cluster_3, Count=10, Kinks=False)  # -> Points, Tangents, Parameters

# ---- group: Door 1: Classroom Flexible Wall
crv_6 = Curve(cluster_3)

# ---- group: Door 2: Main Entrance
crv_7 = Curve(pshift_3)

# ---- group: Glaazing: Clerestory North
crv_8 = Curve(pshift_5)

# ---- group: Glaazing: Clerestory South
crv_9 = Curve(pshift_6)

# ----
explode_6 = Explode(Curve=crv_3, Recursive=True)  # -> graft(Segments), Vertices
explode_7 = Explode(Curve=move_6.Geometry, Recursive=True)  # -> graft(Segments), Vertices

merge_4 = Merge(Data1="Type D2", Data2=crv_7)
cluster_4 = Cluster_17(data=merge_4, path="3")

merge_5 = Merge(Data1="Type D1", Data2=crv_6)
cluster_5 = Cluster_17(data=merge_5, path="4")

merge_6 = Merge(Data1="Type G1", Data2=crv_8)
cluster_6 = Cluster_17(data=merge_6, path="1")

merge_7 = Merge(Data1="Type G1", Data2=crv_9)
cluster_7 = Cluster_17(data=merge_7, path="2")

# ---- group: Layout Bottom Edge
crv_10 = Curve(explode_6.Segments)

# ---- group: Layout Middle Edge
crv_11 = Curve(explode_7.Segments)

# ---- group: Layout Top Edge (Top of Clerestory)
crv_12 = Curve(explode.Segments)

# ----
cluster_8 = Cluster_27(bottom_edge=crv_10, top_edge=crv_11)  # -> flatten(layout_curve_2)
cluster_9 = Cluster_27(bottom_edge=crv_11, top_edge=crv_12)  # -> flatten(layout_curve_2)
merge_8 = Merge(Data1=cluster_6, Data2=cluster_7, Data3=cluster_4, Data4=cluster_5)

# ---- group: Envelope: segments
data = Data(merge_8)

# ----
cluster_10 = Cluster_17(data=cluster_8, path="1")
cluster_11 = Cluster_17(data=cluster_9, path="2")
merge_9 = Merge(Data1=cluster_10, Data2=cluster_11)  # -> flatten(Result)

# ---- group: Facade Layout curves
crv_13 = Curve(graft(merge_9))

# ---- group: Modules: curves in plan
crv_14 = Curve(crv_4)

# ---- group: Envelope: segments
data_2 = Data(data)

# ----
panel_5 = Panel(data_2)
panel_6 = Panel("""{1;*} Envelope: curves in plan
{2;*} Envelope: curve sub-division
{3;*} Modules: curves in plan
{4;*} Envelope: segments""")
cluster_12 = Cluster_17(data=crv_13, path="1")
cluster_13 = Cluster_17(data=partition, path="2")
cluster_14 = Cluster_17(data=crv_14, path="3")
cluster_15 = Cluster_17(data=data_2, path="4")
merge_10 = Merge(Data1=panel_6, Data2=cluster_12, Data3=cluster_13, Data4=cluster_14, Data5=cluster_15)
envelope_description = Data(merge_10)
envelope_description_2 = ClusterOutput(envelope_description)

# ==== cluster Cluster_30
unit_conversion = ClusterInput()
inner_face_y = ClusterInput()
outer_face_y = ClusterInput()
header_topside_z = ClusterInput()
sill_underside_z = ClusterInput()
inner_face_y_2 = Number(inner_face_y)
outer_face_y_2 = Number(outer_face_y)
header_topside_z_2 = Number(header_topside_z)
sill_underside_z_2 = Number(sill_underside_z)
unit_conversion_2 = Number(unit_conversion)
merge = Merge(Data1=inner_face_y_2, Data2=outer_face_y_2, Data3=header_topside_z_2, Data4=sill_underside_z_2)
multiplication = Multiplication(A=unit_conversion_2, B=merge)
item = ListItem(List=multiplication, Index=0, Wrap=True)  # -> Item, Item1, Item2, Item3, Item4, Item5, Item6, Item7

# ---- group: Inner Face 'Y'
inner_face_y_3 = Number(item.Item)
neg = Negative(Value=inner_face_y_3)

# ----
inner_face_y_4 = Number(neg)
outer_face_y_3 = Number(item.Item1)
header_topside_z_3 = Number(item.Item2)
sill_underside_z_3 = Number(item.Item3)
addition = Addition(A=inner_face_y_4, B=outer_face_y_3)
inner_face_y_5 = Number(inner_face_y_4)

# ---- group: Outer Face 'Y' relative to Inner Face 'Y'
num = Number(addition)

# ----
header_topside_z_4 = Number(header_topside_z_3)
sill_underside_z_4 = Number(sill_underside_z_3)
expression = Expression(y=inner_face_y_5, z=sill_underside_z_4, Expression="Format(\"bottom, {0}, {1}\", y, z)")
expression_2 = Expression(y=num, z=sill_underside_z_4, Expression="Format(\"bottom, {0}, {1}\", y, z)")
expression_3 = Expression(y=num, z=header_topside_z_4, Expression="Format(\"top, {0}, {1}\", y, z)")
expression_4 = Expression(y=inner_face_y_5, z=header_topside_z_4, Expression="Format(\"top, {0}, {1}\", y, z)")
expression_5 = Expression(x=ColourSwatch(SwatchColor=RGB(56, 97, 64)), Expression="Format(\"colour:{0}\", x)")
panel = Panel("""Q{0;1;2;3}
YZ""")
merge_2 = Merge(
    Data1="name:Wall",
    Data2=expression_5,
    Data3=expression,
    Data4=expression_2,
    Data5=expression_3,
    Data6=expression_4,
    Data7="length:cell",
    Data8="inset:0",
    Data9=panel)
unit_conversion_3 = Number(unit_conversion_2)
wall_profile_yz = Text(merge_2)

# ---- group: Z for displaying Profile
panel_2 = Panel("1000")

# ----
multiplication_2 = Multiplication(A=unit_conversion_3, B=panel_2)
wall_profile_yz_2 = Text(wall_profile_yz)

# ---- group: Profile YZ
txt = Text(wall_profile_yz)

# ----
# Display the Profile to ensure the Profile YZ description is correct
pt = ConstructPoint(XCoordinate=0, YCoordinate=0, ZCoordinate=multiplication_2)
pt_2 = ConstructPoint(XCoordinate=0, YCoordinate=0, ZCoordinate=0)
tmatch = MatchText(Text=txt, Pattern="Q*", Case=True)
merge_3 = Merge(Data1=pt, Data2=pt_2)
dispatch = Dispatch(List=txt, DispatchPattern=tmatch)  # -> ListA, ListB
txt_2 = Text(dispatch.ListB)
panel_3 = Panel(dispatch.ListA)
tmatch_2 = MatchText(Text=txt_2, Pattern="XY", Case=True)
tmatch_3 = MatchText(Text=txt_2, Pattern="YZ", Case=True)
or = GateOr(A=tmatch_2, B=tmatch_3)
dispatch_2 = Dispatch(List=txt_2, DispatchPattern=or)  # -> ListA, ListB
tmatch_4 = MatchText(Text=dispatch_2.ListB, Pattern="thickness*", Case=True)
tmatch_5 = MatchText(Text=dispatch_2.ListB, Pattern="length*", Case=True)
or_2 = GateOr(A=tmatch_4, B=tmatch_5)
dispatch_3 = Dispatch(List=dispatch_2.ListB, DispatchPattern=or_2)  # -> ListA, ListB
tmatch_6 = MatchText(Text=dispatch_3.ListB, Pattern="inset*", Case=True)
dispatch_4 = Dispatch(List=dispatch_3.ListB, DispatchPattern=tmatch_6)  # -> ListA, ListB

cluster = Cluster_17(data=wall_profile_yz_2, path="1")
merge_4 = Merge(Data1="{1;*} Profile: Wall", Data2=cluster)
profiles = Data(merge_4)
profiles_2 = ClusterOutput(profiles)

split = TextSplit(Text=dispatch_4.ListB, Separators=",")
trim = TextTrim(Text=split, Start=True, End=True)
item_2 = ListItem(List=trim, Index=0, Wrap=True)  # -> Item, Item1, Item2
tmatch_7 = MatchText(Text=item_2.Item, Pattern="top", Case=True)
vec = VectorXYZ(XComponent=0, YComponent=item_2.Item1, ZComponent=item_2.Item2)  # -> Vector, Length
not = GateNot(A=tmatch_7)
merge_5 = Merge(Data1=tmatch_7, Data2=not)
cull = CullPattern(List=merge_3, CullPattern=merge_5)
move = Move(Geometry=cull, Motion=vec.Vector)  # -> Geometry, Transform
pshift = ShiftPaths(Data=move.Geometry, Offset=-1)

pline = PolyLine(Vertices=pshift, Closed=invert(False))
conmesh = ConstructMesh(Vertices=pshift, Faces=dispatch.ListA)
flip = FlipCurve(Curve=pline)  # -> Curve, Flag
curvepoint = PointOnCurve(flip.Curve, parameter=0)
planar = Planar(Curve=flip.Curve)  # -> Planar, Plane, Deviation

# ==== cluster Cluster_31
unit_conversion = ClusterInput()
inner_face_y = ClusterInput()
outer_face_y = ClusterInput()
header_topside_z = ClusterInput()
sill_underside_z = ClusterInput()
jamb_thickness = ClusterInput()
caulking_thickness = ClusterInput()
caulking_recess_y_and_z = ClusterInput()
header_z = ClusterInput()
sill_topside_z = ClusterInput()
mullion_thickness = ClusterInput()
unit_conversion_2 = Number(unit_conversion)
inner_face_y_2 = Number(inner_face_y)
outer_face_y_2 = Number(outer_face_y)
header_topside_z_2 = Number(header_topside_z)
sill_underside_z_2 = Number(sill_underside_z)
jamb_thickness_2 = Number(jamb_thickness)
caulking_thickness_2 = Number(caulking_thickness)
caulking_recess_y_and_z_2 = Number(caulking_recess_y_and_z)
header_z_2 = Number(header_z)
sill_topside_z_2 = Number(sill_topside_z)
mullion_thickness_2 = Number(mullion_thickness)
merge = Merge(
    Data1=inner_face_y_2,
    Data2=outer_face_y_2,
    Data3=header_topside_z_2,
    Data4=sill_underside_z_2,
    Data5=jamb_thickness_2,
    Data6=caulking_thickness_2,
    Data7=caulking_recess_y_and_z_2,
    Data8=header_z_2,
    Data9=sill_topside_z_2,
    Data10=mullion_thickness_2)
multiplication = Multiplication(A=unit_conversion_2, B=merge)
item = ListItem(List=multiplication, Index=0, Wrap=True)  # -> Item, Item1, Item2, Item3, Item4, Item5, Item6, Item7, Item8, Item9

# ---- group: Inner Face 'Y'
inner_face_y_3 = Number(item.Item)
neg = Negative(Value=inner_face_y_3)

# ----
inner_face_y_4 = Number(neg)
outer_face_y_3 = Number(item.Item1)
header_topside_z_3 = Number(item.Item2)
sill_underside_z_3 = Number(item.Item3)
addition = Addition(A=inner_face_y_4, B=outer_face_y_3)
sill_underside_z_4 = Number(sill_underside_z_3)
jamb_thickness_3 = Number(item.Item4)
# The Jamb Inset is the offset distance
# from the 'vertical' side of a Cell Curve
# to the inside edge of the Window Wall Jamb
caulking_thickness_3 = Number(item.Item5)
inner_face_y_5 = Number(inner_face_y_4)

# ---- group: Outer Face 'Y' relative to Inner Face 'Y'
num = Number(addition)

# ----
header_topside_z_4 = Number(header_topside_z_3)
addition_2 = Addition(A=jamb_thickness_3, B=caulking_thickness_3)

# ---- group: Inset: Header and Sill
num_2 = Number(addition_2)

# ---- group: Inset: Jambs
num_3 = Number(caulking_thickness_3)

# ----
inner_face_y_6 = Number(inner_face_y_5)

# ---- group: Outer Face 'Y' relative to Inner Face 'Y'
num_4 = Number(num)

# ----
header_topside_z_5 = Number(header_topside_z_4)
sill_underside_z_5 = Number(sill_underside_z_4)

# ---- group: Outer Face 'Y' relative to Inner Face 'Y'
num_5 = Number(num)

# ----
sill_underside_z_6 = Number(sill_underside_z_4)
caulking_recess_y_and_z_3 = Number(item.Item6)
inner_face_y_7 = Number(inner_face_y_5)

# ---- group: Sill Topside 'Z'
num_6 = Number(item.Item8)

# ----
inner_face_y_8 = Number(inner_face_y_7)

# ---- group: Outer Face 'Y' relative to Inner Face 'Y'
num_7 = Number(num_5)

# ---- group: Mullion Thickness
num_8 = Number(item.Item9)

# ---- group: Inner Face 'Y'
num_9 = Number(inner_face_y_5)

# ---- group: Outer Face 'Y' relative to Inner Face 'Y'
num_10 = Number(num)

# ---- group: Header Topside 'Z'
num_11 = Number(header_topside_z_4)

# ---- group: Header 'Z'
num_12 = Number(item.Item7)

# ---- group: Mullion Thickness
num_13 = Number(item.Item9)

# ----
inner_face_y_9 = Number(inner_face_y_7)

# ---- group: Outer Face 'Y' relative to Inner Face 'Y'
num_14 = Number(num_5)

# ----
multiplication_2 = Multiplication(A=num_13, B="-0.5")
multiplication_3 = Multiplication(A=num_13, B="0.5")
addition_3 = Addition(A=num_6, B=sill_underside_z_6)

# ---- group: Sill Topside 'Z' relative to Sill Underside 'Z'
header_topside_z_6 = Number(addition_3)

# ----
subtraction = Subtraction(A=header_topside_z_6, B=num_8)
addition_4 = Addition(A=inner_face_y_6, B=caulking_recess_y_and_z_3)
subtraction_2 = Subtraction(A=inner_face_y_6, B=caulking_recess_y_and_z_3)
addition_5 = Addition(A=sill_underside_z_5, B=caulking_recess_y_and_z_3)
subtraction_3 = Subtraction(A=num_11, B=num_12)

# ---- group: Outer Face 'Y' relative to Inner Face 'Y'
num_15 = Number(num_4)

# ----
inner_face_y_10 = Number(inner_face_y_7)

# ---- group: Outer Face 'Y' relative to Inner Face 'Y'
num_16 = Number(num_5)

# ---- group: Sill Topside 'Z' relative to Sill Underside 'Z'
header_topside_z_7 = Number(addition_3)

# ----
sill_underside_z_7 = Number(sill_underside_z_6)

# ---- group: Caulking Inner Face 'Y'
inner_face_y_11 = Number(addition_4)

# ----
header_topside_z_8 = Number(header_topside_z_5)

# ---- group: Header 'Z' relative to Header Topside 'Z'
num_17 = Number(subtraction_3)

# ----
inner_face_y_12 = Number(inner_face_y_8)

# ---- group: Outer Face 'Y' relative to Inner Face 'Y'
num_18 = Number(num_7)

# ---- group: Sill Topside 'Z' relative to Sill Underside 'Z'
header_topside_z_9 = Number(header_topside_z_6)

# ---- group: H. Mullion Underside 'Z'
sill_underside_z_8 = Number(subtraction)

# ---- group: Caulking Sill Underside 'Z'
sill_underside_z_9 = Number(addition_5)

# ----
leftside_x_relative_to_mullion_cl = Number(multiplication_2)
rightside_x_relative_to_mullion_cl = Number(multiplication_3)
inner_face_y_13 = Number(inner_face_y_9)

# ---- group: Outer Face 'Y' relative to Inner Face 'Y'
num_19 = Number(num_14)

# ----
swatch = ColourSwatch(SwatchColor=RGB(191, 191, 191))
expression = Expression(y=inner_face_y_5, z=sill_underside_z_4, Expression="Format(\"bottom, {0}, {1}\", y, z)")
expression_2 = Expression(y=num, z=sill_underside_z_4, Expression="Format(\"bottom, {0}, {1}\", y, z)")
expression_3 = Expression(y=inner_face_y_11, z=sill_underside_z_9, Expression="Format(\"bottom, {0}, {1}\", y, z)")
expression_4 = Expression(y=num_15, z=sill_underside_z_9, Expression="Format(\"bottom, {0}, {1}\", y, z)")
expression_5 = Expression(y=inner_face_y_10, z=sill_underside_z_7, Expression="Format(\"bottom, {0}, {1}\", y, z)")
expression_6 = Expression(y=num_16, z=sill_underside_z_7, Expression="Format(\"bottom, {0}, {1}\", y, z)")
expression_7 = Expression(y=num_16, z=header_topside_z_7, Expression="Format(\"bottom, {0}, {1}\", y, z)")
expression_8 = Expression(y=inner_face_y_10, z=header_topside_z_7, Expression="Format(\"bottom, {0}, {1}\", y, z)")
expression_9 = Expression(y=inner_face_y_12, z=sill_underside_z_8, Expression="Format(\"bottom, {0}, {1}\", y, z)")
expression_10 = Expression(y=inner_face_y_12, z=header_topside_z_9, Expression="Format(\"bottom, {0}, {1}\", y, z)")
expression_11 = Expression(y=num_18, z=header_topside_z_9, Expression="Format(\"bottom, {0}, {1}\", y, z)")
expression_12 = Expression(y=num_18, z=sill_underside_z_8, Expression="Format(\"bottom, {0}, {1}\", y, z)")
expression_13 = Expression(x=leftside_x_relative_to_mullion_cl, y=num_19, Expression="Format(\"bottom, {0}, {1}\", x, y)")
expression_14 = Expression(x=rightside_x_relative_to_mullion_cl, y=num_19, Expression="Format(\"bottom, {0}, {1}\", x, y)")
expression_15 = Expression(x=rightside_x_relative_to_mullion_cl, y=inner_face_y_13, Expression="Format(\"bottom, {0}, {1}\", x, y)")
expression_16 = Expression(x=leftside_x_relative_to_mullion_cl, y=inner_face_y_13, Expression="Format(\"bottom, {0}, {1}\", x, y)")
expression_17 = Expression(y=num, z=header_topside_z_4, Expression="Format(\"top, {0}, {1}\", y, z)")
expression_18 = Expression(y=inner_face_y_5, z=header_topside_z_4, Expression="Format(\"top, {0}, {1}\", y, z)")
expression_19 = Expression(y=num_15, z=header_topside_z_8, Expression="Format(\"top, {0}, {1}\", y, z)")
expression_20 = Expression(y=inner_face_y_11, z=header_topside_z_8, Expression="Format(\"top, {0}, {1}\", y, z)")
expression_21 = Expression(y=num_9, z=num_17, Expression="Format(\"top, {0}, {1}\", y, z)")
expression_22 = Expression(y=num_9, z=num_11, Expression="Format(\"top, {0}, {1}\", y, z)")
expression_23 = Expression(y=num_10, z=num_11, Expression="Format(\"top, {0}, {1}\", y, z)")
expression_24 = Expression(y=num_10, z=num_17, Expression="Format(\"top, {0}, {1}\", y, z)")
expression_25 = Expression(x=jamb_thickness_3, Expression="Format(\"thickness:{0}\", x)")
expression_26 = Expression(x=caulking_thickness_3, Expression="Format(\"thickness:{0}\", x)")
expression_27 = Expression(x=swatch, Expression="Format(\"colour:{0}\", x)")
expression_28 = Expression(x=ColourSwatch(SwatchColor=RGB(0, 0, 0)), Expression="Format(\"colour:{0}\", x)")
expression_29 = Expression(x=swatch, Expression="Format(\"colour:{0}\", x)")
expression_30 = Expression(x=swatch, Expression="Format(\"colour:{0}\", x)")
expression_31 = Expression(x=ColourSwatch(SwatchColor=RGB(128, 0, 255)), Expression="Format(\"colour:{0}\", x)")
expression_32 = Expression(x=ColourSwatch(SwatchColor=RGB(128, 0, 255)), Expression="Format(\"colour:{0}\", x)")
expression_33 = Expression(x=num_3, Expression="Format(\"inset:{0}\", x)")
expression_34 = Expression(x=num_2, Expression="Format(\"inset:{0}\", x)")
panel = Panel("""Q{0;1;2;3}
YZ""")
panel_2 = Panel("""Q{0;1;2;3}
XY""")
merge_2 = Merge(
    Data1="name:Jamb",
    Data2=expression_27,
    Data3=expression,
    Data4=expression_2,
    Data5=expression_17,
    Data6=expression_18,
    Data7=expression_25,
    Data8=expression_33,
    Data9=panel)
merge_3 = Merge(
    Data1="name:Caulking",
    Data2=expression_28,
    Data3=expression_3,
    Data4=expression_4,
    Data5=expression_19,
    Data6=expression_20,
    Data7=expression_26,
    Data8="inset:0",
    Data9=panel)
merge_4 = Merge(
    Data1="name:Sill",
    Data2=expression_30,
    Data3=expression_5,
    Data4=expression_6,
    Data5=expression_7,
    Data6=expression_8,
    Data7="length:cell",
    Data8=expression_34,
    Data9=panel)
merge_5 = Merge(
    Data1="name:Header",
    Data2=expression_29,
    Data3=expression_21,
    Data4=expression_22,
    Data5=expression_23,
    Data6=expression_24,
    Data7="length:cell",
    Data8=expression_34,
    Data9=panel)
merge_6 = Merge(
    Data1="name:H_Mullion",
    Data2=expression_31,
    Data3=expression_9,
    Data4=expression_10,
    Data5=expression_11,
    Data6=expression_12,
    Data7="length:varies",
    Data8=panel)
merge_7 = Merge(
    Data1="name:V_Mullion",
    Data2=expression_32,
    Data3=expression_13,
    Data4=expression_14,
    Data5=expression_15,
    Data6=expression_16,
    Data7="length:varies",
    Data8=panel_2)
jamb_profile_yz = Text(merge_2)
caulking_profile_yz = Text(merge_3)
header_profile_yz = Text(merge_5)
sill_profile_yz = Text(merge_4)
h_mullion_profile_yz = Text(merge_6)
v_mullion_profile_xy = Text(merge_7)
panel_3 = Panel(jamb_profile_yz)

# ---- group: Z for displaying Profile
panel_4 = Panel("1000")

# ----
multiplication_4 = Multiplication(A=unit_conversion_2, B=panel_4)

# ---- group: Profile YZ
txt = Text(header_profile_yz)

# ----
# Display the Profile to ensure the Profile YZ description is correct
pt = ConstructPoint(XCoordinate=0, YCoordinate=0, ZCoordinate=multiplication_4)
pt_2 = ConstructPoint(XCoordinate=0, YCoordinate=0, ZCoordinate=0)
tmatch = MatchText(Text=txt, Pattern="Q*", Case=True)
merge_8 = Merge(Data1=pt, Data2=pt_2)
dispatch = Dispatch(List=txt, DispatchPattern=tmatch)  # -> ListA, ListB
txt_2 = Text(dispatch.ListB)
tmatch_2 = MatchText(Text=txt_2, Pattern="name*", Case=invert(True))
tmatch_3 = MatchText(Text=txt_2, Pattern="colour*", Case=True)
or = GateOr(A=tmatch_2, B=tmatch_3)
dispatch_2 = Dispatch(List=txt_2, DispatchPattern=or)  # -> ListA, ListB
txt_3 = Text(dispatch_2.ListB)
panel_5 = Panel(dispatch.ListA)
tmatch_4 = MatchText(Text=txt_3, Pattern="XY", Case=True)
tmatch_5 = MatchText(Text=txt_3, Pattern="YZ", Case=True)
or_2 = GateOr(A=tmatch_4, B=tmatch_5)
dispatch_3 = Dispatch(List=txt_3, DispatchPattern=or_2)  # -> ListA, ListB
tmatch_6 = MatchText(Text=dispatch_3.ListB, Pattern="thickness*", Case=True)
tmatch_7 = MatchText(Text=dispatch_3.ListB, Pattern="length*", Case=True)
or_3 = GateOr(A=tmatch_6, B=tmatch_7)
dispatch_4 = Dispatch(List=dispatch_3.ListB, DispatchPattern=or_3)  # -> ListA, ListB
tmatch_8 = MatchText(Text=dispatch_4.ListB, Pattern="inset*", Case=True)
dispatch_5 = Dispatch(List=dispatch_4.ListB, DispatchPattern=tmatch_8)  # -> ListA, ListB

# ---- group: Profile XY
txt_4 = Text(v_mullion_profile_xy)

# ----
panel_6 = Panel("""{1;*} Profile: Jamb
{2;*} Profile: Caulking
{3;*} Profile: Header
{4;*} Profile: Sill
{5;*} Profile: Horizontal Mullion
{6;*} Profile: Vertical Mullion""")
jamb_profile_yz_2 = Text(jamb_profile_yz)
caulking_profile_yz_2 = Text(caulking_profile_yz)
header_profile_yz_2 = Text(header_profile_yz)
sill_profile_yz_2 = Text(sill_profile_yz)
h_mullion_profile_yz_2 = Text(h_mullion_profile_yz)
v_mullion_profile_xy_2 = Text(v_mullion_profile_xy)
cluster = Cluster_17(data=caulking_profile_yz_2, path="2")
cluster_2 = Cluster_17(data=jamb_profile_yz_2, path="1")
cluster_3 = Cluster_17(data=header_profile_yz_2, path="3")
cluster_4 = Cluster_17(data=sill_profile_yz_2, path="4")
cluster_5 = Cluster_17(data=v_mullion_profile_xy_2, path="6")  # disabled
cluster_6 = Cluster_17(data=h_mullion_profile_yz_2, path="5")  # disabled
merge_9 = Merge(Data1=panel_6, Data2=cluster_2, Data3=cluster, Data4=cluster_3, Data5=cluster_4, Data6=cluster_6, Data7=cluster_5)
profiles = Data(merge_9)
profiles_2 = ClusterOutput(profiles)

split = TextSplit(Text=dispatch_5.ListB, Separators=",")
trim = TextTrim(Text=split, Start=True, End=True)
item_2 = ListItem(List=trim, Index=0, Wrap=True)  # -> Item, Item1, Item2
tmatch_9 = MatchText(Text=item_2.Item, Pattern="top", Case=True)
vec = VectorXYZ(XComponent=0, YComponent=item_2.Item1, ZComponent=item_2.Item2)  # -> Vector, Length
not = GateNot(A=tmatch_9)
merge_10 = Merge(Data1=tmatch_9, Data2=not)
cull = CullPattern(List=merge_8, CullPattern=merge_10)
move = Move(Geometry=cull, Motion=vec.Vector)  # -> Geometry, Transform
pshift = ShiftPaths(Data=move.Geometry, Offset=-1)

pline = PolyLine(Vertices=pshift, Closed=invert(False))
conmesh = ConstructMesh(Vertices=pshift, Faces=dispatch.ListA)
flip = FlipCurve(Curve=pline)  # -> Curve, Flag
curvepoint = PointOnCurve(flip.Curve, parameter=0)
planar = Planar(Curve=flip.Curve)  # -> Planar, Plane, Deviation

# ----
# Display the Profile to ensure the Profile XY description is correct
panel_7 = Panel("Q*")
tmatch_10 = MatchText(Text=txt_4, Pattern=panel_7, Case=True)
dispatch_6 = Dispatch(List=txt_4, DispatchPattern=tmatch_10)  # -> ListA, ListB
txt_5 = Text(dispatch_6.ListB)
tmatch_11 = MatchText(Text=txt_5, Pattern="name*", Case=invert(True))
tmatch_12 = MatchText(Text=txt_5, Pattern="colour*", Case=True)
or_4 = GateOr(A=tmatch_11, B=tmatch_12)
dispatch_7 = Dispatch(List=txt_5, DispatchPattern=or_4)  # -> ListA, ListB
txt_6 = Text(dispatch_7.ListB)
panel_8 = Panel(dispatch_6.ListA)
tmatch_13 = MatchText(Text=txt_6, Pattern="XY", Case=True)
tmatch_14 = MatchText(Text=txt_6, Pattern="YZ", Case=True)
or_5 = GateOr(A=tmatch_13, B=tmatch_14)
dispatch_8 = Dispatch(List=txt_6, DispatchPattern=or_5)  # -> ListA, ListB
tmatch_15 = MatchText(Text=dispatch_8.ListB, Pattern="length*", Case=True)

tmatch_16 = MatchText(Text=dispatch_8.ListB, Pattern="thickness*", Case=True)

or_6 = GateOr(A=tmatch_16, B=tmatch_15)
dispatch_9 = Dispatch(List=dispatch_8.ListB, DispatchPattern=or_6)  # -> ListA, ListB
tmatch_17 = MatchText(Text=dispatch_9.ListB, Pattern="inset*", Case=True)
dispatch_10 = Dispatch(List=dispatch_9.ListB, DispatchPattern=tmatch_17)  # -> ListA, ListB

split_2 = TextSplit(Text=dispatch_10.ListB, Separators=",")
trim_2 = TextTrim(Text=split_2, Start=True, End=True)
item_3 = ListItem(List=trim_2, Index=0, Wrap=True)  # -> Item, Item1, Item2
tmatch_18 = MatchText(Text=item_3.Item, Pattern="top", Case=True)
vec_2 = VectorXYZ(XComponent=item_3.Item1, YComponent=item_3.Item2, ZComponent=0)  # -> Vector, Length
not_2 = GateNot(A=tmatch_18)
merge_11 = Merge(Data1=tmatch_18, Data2=not_2)
cull_2 = CullPattern(List=merge_8, CullPattern=merge_11)
move_2 = Move(Geometry=cull_2, Motion=vec_2.Vector)  # -> Geometry, Transform
pshift_2 = ShiftPaths(Data=move_2.Geometry, Offset=-1)

pline_2 = PolyLine(Vertices=pshift_2, Closed=invert(False))
conmesh_2 = ConstructMesh(Vertices=pshift_2, Faces=dispatch_6.ListA)

# ==== cluster Cluster_32
profiles = ClusterInput()
parameters = ClusterInput()
profiles_2 = Data(profiles)
parameters_2 = Data(parameters)
branch = TreeBranch(Tree=profiles_2, Path="{0}", MaintainPaths=True)
branch_2 = TreeBranch(Tree=parameters_2, Path="{0}", MaintainPaths=True)
panel = Panel(branch)
panel_2 = Panel(branch_2)
name = ClusterInput()
name_2 = Text(name)
panel_3 = Panel("""{1;*} Name
{2;*} Profiles
{3;*} Parameters""")
cluster = Cluster_17(data=profiles_2, path="2")
cluster_2 = Cluster_17(data=parameters_2, path="3")
cluster_3 = Cluster_17(data=name_2, path="1")
path = ClusterInput()
merge = Merge(Data1=panel_3, Data2=cluster_3, Data3=cluster, Data4=cluster_2)
path_2 = Integer(path)
cluster_4 = Cluster_17(data=merge, path=path_2)
system_descriptor = Data(cluster_4)
system_descriptor_2 = ClusterOutput(system_descriptor)

# ==== cluster Cluster_33
corner_width = ClusterInput()
typical_width = ClusterInput()

# ---- group: Cell Type Names
panel = Panel("corner")
panel_2 = Panel("Type W1")
panel_3 = Panel("Type G1")

# ---- group: Sub-Division
panel_4 = Panel("whole")
panel_5 = Panel("panel")

# ----
txt = Text(panel_2)
corner_width_2 = Number(corner_width)
typical_width_2 = Number(typical_width)
txt_2 = Text(panel)
txt_3 = Text(panel_2)
txt_4 = Text(panel_4)
txt_5 = Text(panel_5)

expression = Expression(x=corner_width_2, y=txt_2, z=txt_4, Expression="Format(\"{0}, {1}, {2}\", x, y, z)")
expression_2 = Expression(x=typical_width_2, y=txt_3, z=txt_5, Expression="Format(\"{0}, {1}, {2}\", x, y, z)")
merge = Merge(Data1=expression, Data2=expression_2, Data3=expression)

expression_3 = Expression(x="layout", y=txt_3, z=txt_4, Expression="Format(\"{0}, {1}, {2}\", x, y, z)")
cluster = Cluster_17(data=merge, path="1")
cluster_2 = Cluster_17(data=expression_3, path="2")
panel_6 = Panel("""{1;*} Cell Type 1
{2;*} Cell Type 2""")
merge_2 = Merge(Data1=panel_6, Data2=cluster, Data3=cluster_2)
sub_division = Data(merge_2)
sub_division_2 = ClusterOutput(sub_division)

# ==== cluster Cluster_38
cell_type_descriptions = ClusterInput()
envelope_description = ClusterInput()
envelope_description_2 = Data(envelope_description)
cell_type_descriptions_2 = Data(cell_type_descriptions)
branch = TreeBranch(Tree=cell_type_descriptions_2, Path="{0}", MaintainPaths=True)
branch_2 = TreeBranch(Tree=envelope_description_2, Path="{0}", MaintainPaths=True)
cluster = Cluster_15(data=envelope_description_2, path_mask="{1;*}")
cluster_2 = Cluster_15(data=envelope_description_2, path_mask="{3;*}")
cluster_3 = Cluster_15(data=envelope_description_2, path_mask="{4;*}")
panel = Panel(branch)
panel_2 = Panel(branch_2)

# ---- group: Envelope: curves in plan
crv = Curve(flatten(cluster))

# ---- group: Envelope: segments
data = Data(cluster_3)

# ---- group: Modules: curves in plan
crv_2 = Curve(cluster_2)

# ----
dispatch = Dispatch(List=crv, DispatchPattern=[True, False])  # -> ListA, ListB
cluster_4 = Cluster_17(data=dispatch.ListB, path="2")
cluster_5 = Cluster_17(data=dispatch.ListA, path="1")

# ---- group: Cell Type Descriptions
data_2 = Data(cell_type_descriptions_2)

# ----
merge = Merge(Data1=cluster_5, Data2=cluster_4)
cluster_6 = Cluster_37(layout_curves=merge, cell_type_descriptions=data_2, envelope_segments=data)  # -> cell_curves_4, cell_descriptions_6

crv_3 = Curve(cluster_6.cell_curves_4)
txt = Text(cluster_6.cell_descriptions_6)

crv_4 = Curve(flatten(crv_3))
txt_2 = Text(flatten(txt))

unit_conversion = ClusterInput()
item = ListItem(List=crv_4, Index=Slider(3, range=0..79), Wrap=True)
boundary = BoundarySurfaces(Edges=item)
cell_crvs = Curve(graft(crv_4))

# ---- group: Cell Descriptions
txt_3 = Text(graft(txt_2))

# ----
panel_3 = Panel("""{-1} Unit Conversion
{1;*} Cell Crvs
{2;*} Cell Descriptions""")
unit_conversion_2 = Number(unit_conversion)
cluster_7 = Cluster_17(data=cell_crvs, path="1")
cluster_8 = Cluster_17(data=txt_3, path="2")
flatten = FlattenTree(Tree=unit_conversion_2, Path="{-1}")
merge_2 = Merge(Data1=panel_3, Data2=flatten, Data3=cluster_7, Data4=cluster_8)
cells = Data(merge_2)
cells_2 = ClusterOutput(cells)

# ==== cluster Cluster_39
cell_crvs = ClusterInput()
cell_description = ClusterInput()
cell_crvs_2 = Curve(graft(cell_crvs))

# ---- group: Cell Descriptions
cell_description_2 = Text(cell_description)

# ----
tstat = TreeStatistics(Tree=cell_crvs_2)  # -> Paths, Length, Count
lng = ListLength(List=tstat.Paths)
panel = Panel("""{-1} Unit Conversion
{1;*} Cell Crvs
{2;*} Cell Descriptions""")
dup = DuplicateData(Data=cell_description_2, Number=lng, Order=True)  # -> graft(Data)
tstat_2 = TreeStatistics(Tree=dup)  # -> Paths, Length, Count
unit_conversion = ClusterInput()
replace = ReplacePaths(Data=dup, Search=tstat_2.Paths, Replace=tstat.Paths)
unit_conversion_2 = Number(unit_conversion)
cluster = Cluster_17(data=cell_crvs_2, path="1")
cluster_2 = Cluster_17(data=replace, path="2")
flatten = FlattenTree(Tree=unit_conversion_2, Path="{-1}")
merge = Merge(Data1=panel, Data2=flatten, Data3=cluster, Data4=cluster_2)
cells = Data(merge)
cells_2 = ClusterOutput(cells)

# ==== cluster Cluster_44
system_descriptors = ClusterInput()
system_descriptors_2 = Data(system_descriptors)

# ----
# Get all the Profiles
# To do this, remove the branches that are not 4 characters,
# since only the Profile branches have this depth
data = Data(system_descriptors_2)
tstat = TreeStatistics(Tree=data)  # -> flatten(Paths), Length, Count
dpath = DeconstructPath(Branch=tstat.Paths)
lng = ListLength(List=dpath)
equals = Equality(FirstNumber=lng, SecondNumber="4")  # -> flatten(Equality), Inequality
cull = CullPattern(List=tstat.Paths, CullPattern=equals.Equality)
branch = TreeBranch(Tree=data, Path=cull, MaintainPaths=True)

cells_and_sub_cells = ClusterInput()
cells_and_sub_cells_2 = Data(cells_and_sub_cells)
split = SplitTree(Data=branch, Masks=flatten("{?;2;*}"))  # -> Positive, Negative
split_2 = SplitTree(Data=system_descriptors_2, Masks=flatten("{?;1;?}"))  # -> Positive, Negative
cluster = Cluster_15(data=cells_and_sub_cells_2, path_mask="{1;*}")
cluster_2 = Cluster_15(data=cells_and_sub_cells_2, path_mask="{2;*}")
cluster_3 = Cluster_15(data=cells_and_sub_cells_2, path_mask="{3;*}")
cluster_4 = Cluster_15(data=cells_and_sub_cells_2, path_mask="{4;*}")
branch_2 = TreeBranch(Tree=cells_and_sub_cells_2, Path="{0}", MaintainPaths=True)

# ----
# Remove the second Branch level
# which is meant to distinguish
# the Profiles from the other content
# in the System Descriptors
path_mapper = PathMapper(split.Positive, source="{A;B;C;D}", target="{A;C;D}")

# ---- group: System Names
txt = Text(split_2.Positive)

# ----
panel = Panel(branch_2)
profiles = Text(path_mapper)

# ---- group: Cell Curves
crv = Curve(cluster)

# ---- group: Cell Descriptions
txt_2 = Text(cluster_2)

# ---- group: Glazing Lite Curves
crv_2 = Curve(cluster_3)

# ---- group: Glazing Lite Descriptions
txt_3 = Text(cluster_4)

# ----
# Match each System Name with
# the Cell Descriptions that are
# included in the System Descriptor > Profiles
ds2 = DesignSeed02(Cells=crv, CellDescription=txt_2, SystemDescription=txt)  # -> Cells, IndexOfMatchedSystem
path_mapper_2 = PathMapper(ds2.Cells, source="{A;B;C}", target="{A}")

cluster_5 = Cluster_41(profile=profiles, find="Q*")  # -> items_2, index_2
cluster_6 = Cluster_41(profile=profiles, find="bottom*")  # -> items_2, index_2
cluster_7 = Cluster_41(profile=profiles, find="top*")  # -> items_2, index_2
cluster_8 = Cluster_41(profile=profiles, find="colour*")  # -> items_2, index_2
cluster_9 = Cluster_41(profile=profiles, find="inset*")  # -> items_2, index_2
cluster_10 = Cluster_41(profile=profiles, find="XY*")  # -> items_2, index_2
cluster_11 = Cluster_41(profile=profiles, find="YZ*")  # -> items_2, index_2
cluster_12 = Cluster_41(profile=profiles, find="thickness*")  # -> items_2, index_2
cluster_13 = Cluster_41(profile=profiles, find="length*")  # -> items_2, index_2
cluster_14 = Cluster_41(profile=profiles, find="name*")  # -> items_2, index_2
cell_crvs = Curve(path_mapper_2)
merge = Merge(Data1=cluster_6.items_2, Data2=cluster_7.items_2)
merge_2 = Merge(Data1=cluster_10.items_2, Data2=cluster_11.items_2)
merge_3 = Merge(Data1=cluster_12.items_2, Data2=cluster_13.items_2)
cell_crvs_2 = Curve(cell_crvs)

# ---- group: name
txt_4 = Text(cluster_14.items_2)

# ---- group: Profile QPts Faces
qpts_faces = Text(cluster_5.items_2)

# ---- group: inset
txt_5 = Text(cluster_9.items_2)

# ---- group: QPts
txt_6 = Text(merge)

# ---- group: Relative Plane
txt_7 = Text(merge_2)

# ---- group: thickness / length
txt_8 = Text(merge_3)

# ---- group: Parse Text
# This data is not in use yet
cluster_15 = Cluster_42(T=txt_4)

cluster_16 = Cluster_42(T=txt_5)

cluster_17 = Cluster_42(T=txt_8)

cluster_18 = Cluster_42(T=cluster_8.items_2)

# ---- group: name
txt_9 = Text(txt_4)

# ----
# In case the Inset value is null
# assign it a value of 0
num = Number(0)
nullrep = ReplaceNulls(Items=cluster_16, Replacements=num)  # -> Items, Count

tstat_2 = TreeStatistics(Tree=cell_crvs_2)  # -> Paths, Length, Count
pshift = ShiftPaths(Data=txt_9, Offset=-2)
lng_2 = ListLength(List=pshift)
dpath_2 = DeconstructPath(Branch=tstat_2.Paths)

# ---- group: Qty of Profiles per System
int = Integer(lng_2)

# ----
# Get the System Branches
# This is needed when there are extra
# Systems that are not in use
# and need to be removed
expression = Expression(x=dpath_2, Expression="Format(\"{{{0};*}}\", x)")  # -> flatten(R)

# ---- group: Inset
box_height = Number(nullrep.Items)

# ---- group: Qty of Profiles per System
int_2 = Integer(int)

# ---- group: System Branches (mask)
txt_10 = Text(expression)

# ----
branch_3 = TreeBranch(Tree=int_2, Path=tstat_2.Paths, MaintainPaths=True)

# ---- group: System Branches (mask)
txt_11 = Text(txt_10)

# ---- group: Qty of Profiles per System
# Unused Systems
# have been removed
int_3 = Integer(branch_3)

# ----
split_3 = SplitTree(Data=txt_9, Masks=flatten(txt_11))  # -> Positive, Negative
cell_crvs_3 = Curve(cell_crvs_2)
tstat_3 = TreeStatistics(Tree=split_3.Positive)  # -> Paths, Length, Count

# ----
# Each Cell is unique at this point
# Branching: {System} (Cell)
viewer = ParamViewer(cell_crvs_3)

# ---- group: System>Profile Branches
txt_12 = Text(tstat_3.Paths)

# ----
# Duplicate each Cell, so that there is a copy for each Profile
lng_3 = ListLength(List=cell_crvs_3)
dup = DuplicateData(Data=cell_crvs_3, Number=int_3, Order=True)
pshift_2 = ShiftPaths(Data=dup, Offset=-1)
partition = PartitionList(List=pshift_2, Size=lng_3)
tstat_4 = TreeStatistics(Tree=partition)  # -> Paths, Length, Count
replace = ReplacePaths(Data=partition, Search=tstat_4.Paths, Replace=txt_12)

# ---- group: Profile QPts Faces
qpts_faces_2 = Text(qpts_faces)

# ---- group: QPts
txt_13 = Text(txt_6)

# ---- group: System Branches (mask)
txt_14 = Text(txt_11)

# ---- group: Relative Plane
txt_15 = Text(txt_7)

# ---- group: Inset
box_height_2 = Number(box_height)

# ---- group: System Branches (mask)
txt_16 = Text(txt_11)

txt_17 = Text(txt_11)

txt_18 = Text(txt_11)

txt_19 = Text(txt_11)

# ----
col = Colour(cluster_18)
box_height_3 = Number(cluster_17)

# ---- group: System Branches (mask)
txt_20 = Text(txt_11)

# ----
split_4 = SplitTree(Data=txt_15, Masks=flatten(txt_17))  # -> Positive, Negative
cell_crvs_4 = Curve(replace)
split_5 = SplitTree(Data=qpts_faces_2, Masks=flatten(txt_18))  # -> Positive, Negative
split_6 = SplitTree(Data=box_height_2, Masks=flatten(txt_16))  # -> Positive, Negative
split_7 = SplitTree(Data=txt_13, Masks=flatten(txt_14))  # -> Positive, Negative
split_8 = SplitTree(Data=box_height_3, Masks=flatten(txt_19))  # -> Positive, Negative
split_9 = SplitTree(Data=col, Masks=flatten(txt_20))  # -> Positive, Negative

# ----
# Each is duplicated, one for each Profile
# Branching: {System; Profile ; 0} (Cell)
viewer_2 = ParamViewer(cell_crvs_4)

# ---- group: Relative Plane
txt_21 = Text(split_4.Positive)

# ---- group: Profile QPts Faces
qpts_faces_3 = Text(split_5.Positive)
# ---- group: QPts
txt_22 = Text(split_7.Positive)

# ----
box_height_4 = Number(split_8.Positive)
col_2 = Colour(split_9.Positive)

# ---- group: Inset
box_height_5 = Number(split_6.Positive)

# ----
cell_crvs_5 = Curve(cell_crvs_4)

# ---- group: Inset
box_height_6 = Number(box_height_5)

# ----
# Inset each Cell Curve
# By the Inset amount from each Profile
cluster_19 = Cluster_40(cell_crvs=cell_crvs_5, inset=box_height_6)

# ---- group: Cell Crvs
crv_3 = Curve(cluster_19)

# ----
# Cell Curves object 1.0
cluster_20 = Cluster_18(cell_curve=crv_3)

panel_2 = Panel(cluster_20)
cluster_21 = Cluster_15(data=cluster_20, path_mask="{1;*}")
cluster_22 = Cluster_15(data=cluster_20, path_mask="{2;*}")
cluster_23 = Cluster_15(data=cluster_20, path_mask="{4;*}")
cluster_24 = Cluster_15(data=cluster_20, path_mask="{5;*}")

# ---- group: Cell Left Pts
pt = Point(cluster_21)

# ---- group: Cell Right Pts
pt_2 = Point(cluster_22)

# ---- group: Cell Section Plane
pln = Plane(cluster_23)

# ---- group: Cell Plan Plane
pln_2 = Plane(cluster_24)

# ---- group: QPts
txt_23 = Text(txt_22)

# ----
cluster_25 = Cluster_43(T=txt_23, C=",")  # -> txt_1_2, txt_2_2, txt_3_2

num_2 = Number(cluster_25.txt_2_2)
num_3 = Number(cluster_25.txt_3_2)

# ---- group: Cell Left Pts
pt_3 = Point(pt)

# ---- group: Cell Right Pts
pt_4 = Point(pt_2)

# ---- group: Relative Plane
txt_24 = Text(txt_21)

# ---- group: Cell Section Plane
pln_3 = Plane(pln)

# ---- group: Cell Plan Plane
pln_4 = Plane(pln_2)

# ----
num_4 = Number(num_3)
num_5 = Number(num_2)

# ----
# Select Corresponding Cell Points
panel_3 = Panel("top")
tmatch = MatchText(Text=cluster_25.txt_1_2, Pattern=panel_3, Case=invert(True))
partition_2 = PartitionList(List=pt_3, Size=2)
partition_3 = PartitionList(List=pt_4, Size=2)
lng_4 = ListLength(List=pt_4)
pshift_3 = ShiftPaths(Data=tmatch, Offset=-1)
division = Division(A=lng_4, B=2)
dup_2 = DuplicateData(Data=pshift_3, Number=division, Order=True)
lng_5 = ListLength(List=pshift_3)
pshift_4 = ShiftPaths(Data=dup_2, Offset=-1)
partition_4 = PartitionList(List=pshift_4, Size=lng_5)
int_4 = Integer(partition_4)
item = ListItem(List=partition_2, Index=int_4, Wrap=True)
item_2 = ListItem(List=partition_3, Index=int_4, Wrap=True)

num_6 = Number(num_4)
num_7 = Number(num_5)

num_8 = Number(num_4)
num_9 = Number(num_5)

tmatch_2 = MatchText(Text=txt_24, Pattern="XY", Case=invert(True))
pshift_5 = ShiftPaths(Data=num_6, Offset=-1)
pshift_6 = ShiftPaths(Data=num_7, Offset=-1)

# ---- group: YZ = 0, XY = 1
int_5 = Integer(tmatch_2)

# ----
merge_4 = Merge(Data1=graft(pln_3), Data2=graft(pln_4))
lng_6 = ListLength(List=pln_3)
dup_3 = DuplicateData(Data=int_5, Number=lng_6, Order=True)
pshift_7 = ShiftPaths(Data=dup_3, Offset=-1)
item_3 = ListItem(List=merge_4, Index=graft(pshift_7), Wrap=True)
pshift_8 = ShiftPaths(Data=item_3, Offset=-1)

# ----
# Locations relative to the YZ Plane
# Locations relative to the XY Plane
num_10 = Number(num_8)
num_11 = Number(num_9)
vec = VectorXYZ(XComponent="0", YComponent=num_11, ZComponent=num_10)  # -> Vector, Length
vec_2 = VectorXYZ(XComponent=num_11, YComponent=num_10, ZComponent="0")  # -> Vector, Length

# ----
# Locations relative to the YZ Plane
# Locations relative to the XY Plane
bnd = Bounds(Numbers=pshift_5)
bnd_2 = Bounds(Numbers=pshift_6)
dedomain = DeconstructDomain(Domain=bnd)  # -> Start, End
dedomain_2 = DeconstructDomain(Domain=bnd_2)  # -> Start, End
merge_5 = Merge(Data1=dedomain.Start, Data2=dedomain.End)
merge_6 = Merge(Data1=dedomain_2.Start, Data2=dedomain_2.End)
vec_3 = VectorXYZ(XComponent=0, YComponent=0, ZComponent=merge_5)  # -> Vector, Length
vec_4 = VectorXYZ(XComponent=merge_6, YComponent=0, ZComponent=0)  # -> Vector, Length

# ----
# Location Vectors
# in both YZ and XY Planes
# Ready to choose from
merge_7 = Merge(Data1=vec.Vector, Data2=vec_2.Vector)
vec_5 = Vector(merge_7)

# ----
# Location Vectors
# in both YZ and XY Planes
# Ready to choose from
merge_8 = Merge(Data1=graft(vec_3.Vector), Data2=graft(vec_4.Vector))
vec_6 = Vector(merge_8)

# ---- group: Cell Right Pt
right_qpts = Point(item_2)

# ---- group: YZ = 0, XY = 1
int_6 = Integer(int_5)

# ---- group: Mesh Plane
pln_5 = Plane(pshift_8)

# ---- group: Cell Left Pt
left_qpts = Point(item)

# ----
pshift_9 = ShiftPaths(Data=vec.Vector, Offset=-1)
lng_7 = ListLength(List=pshift_9)
lng_8 = ListLength(List=vec_3.Vector)

# ---- group: YZ = 0, XY = 1
int_7 = Integer(int_6)

int_8 = Integer(int_6)

# ---- group: Qty Vectors per Profile
int_9 = Integer(lng_7)

int_10 = Integer(lng_8)

# ----
yz = YZPlane(Origin=Point(0, 0, 0))
xy = XYPlane(Origin=Point(0, 0, 0))
dup_4 = DuplicateData(Data=int_8, Number=int_9, Order=True)
dup_5 = DuplicateData(Data=int_7, Number=int_10, Order=True)

merge_9 = Merge(Data1=yz, Data2=xy)
item_4 = ListItem(List=merge_9, Index=int_6, Wrap=True)

pshift_10 = ShiftPaths(Data=dup_4, Offset=-1)
pshift_11 = ShiftPaths(Data=dup_5, Offset=-1)

item_5 = ListItem(List=vec_5, Index=graft(pshift_10), Wrap=True)
pshift_12 = ShiftPaths(Data=item_5, Offset=-1)

item_6 = ListItem(List=vec_6, Index=graft(pshift_11), Wrap=True)
pshift_13 = ShiftPaths(Data=item_6, Offset=-1)

# ---- group: Cell Crvs
crv_4 = Curve(crv_3)

# ---- group: Mesh Plane
pln_6 = Plane(pln_5)

# ---- group: Translate Vector
vec_7 = Vector(pshift_12)

# ---- group: Translate Vector for within Header/Sill
vec_8 = Vector(pshift_13)

# ---- group: Relative World planes
pln_7 = Plane(item_4)

# ----
pt_5 = Point(pln_7)

# ----
# Now, there is one relative plane
# per Profile, per Cell
# 
# Each Data Branch contains all Cells for one Profile
# Branching: {Profile ; 0} (Cell)
viewer_3 = ParamViewer(pln_6)

pl_origin = PlaneOrigin(Base=pln_6, Origin=pt_5)

# ----
# At this point, there are
# four (or more) vectors per Profile
# It has not yet been duplicated per Cell
# Branching: {Profile ; 0} (vector)
viewer_4 = ParamViewer(vec_7)

# ---- group: Mesh Plane (origin)
pln_8 = Plane(pl_origin)

# ---- group: Translate Vector
# These vectors are relative
# to the Section or Plan plane
vec_9 = Vector(vec_7)

# ---- group: Cell Section or Plan Plane
pln_9 = Plane(pln_6)

# ----
box_height_7 = Number(box_height_4)
col_3 = Colour(col_2)

lng_9 = ListLength(List=pln_9)
lng_10 = ListLength(List=col_3)
dup_6 = DuplicateData(Data=col_3, Number=lng_9, Order=True)
pshift_14 = ShiftPaths(Data=dup_6, Offset=-1)
partition_5 = PartitionList(List=pshift_14, Size=lng_10)

lng_11 = ListLength(List=pln_9)
lng_12 = ListLength(List=vec_9)
dup_7 = DuplicateData(Data=vec_9, Number=lng_11, Order=True)
pshift_15 = ShiftPaths(Data=dup_7, Offset=-1)
partition_6 = PartitionList(List=pshift_15, Size=lng_12)

lng_13 = ListLength(List=pln_9)
lng_14 = ListLength(List=box_height_7)
dup_8 = DuplicateData(Data=box_height_7, Number=lng_13, Order=True)
pshift_16 = ShiftPaths(Data=dup_8, Offset=-1)
partition_7 = PartitionList(List=pshift_16, Size=lng_14)

# ---- group: Mesh Plane (origin)
pln_10 = Plane(pln_8)

# ---- group: Relative World planes
pln_11 = Plane(pln_7)

# ----
# Now, there are
# four (or more) vectors per Profile, per Cell
# Branching: {Profile ; 0 ; Cell} (vector)
viewer_5 = ParamViewer(partition_6)

box_height_8 = Number(partition_7)
col_4 = Colour(partition_5)

# ---- group: Translate Vector
vec_10 = Vector(vec_7)

# ---- group: Translate Vector for within Header/Sill
vec_11 = Vector(vec_8)

# ---- group: Relative World planes
pln_12 = Plane(pln_11)

# ----
# The Translate Vectors were originally
# contructed with x,y,z coordinates.
# This now needs to be re-oriented
# to be relative to the Mesh Planes
crossref = CrossReference(ListA=vec_10, ListB=pln_10, CrossMode=1)  # -> ListA, ListB
crossref_2 = CrossReference(ListA=vec_11, ListB=pln_10, CrossMode=1)  # -> ListA, ListB
orient = Orient(Geometry=crossref.ListA, Source=pln_12, Target=crossref.ListB)  # -> Geometry, Transform
orient_2 = Orient(Geometry=crossref_2.ListA, Source=pln_12, Target=crossref_2.ListB)  # -> Geometry, Transform

# ---- group: Profile QPts Faces
qpts_faces_4 = Text(qpts_faces_3)

# ----
lng_15 = ListLength(List=crv_4)
dup_9 = DuplicateData(Data=qpts_faces_4, Number=lng_15, Order=True)
pshift_17 = ShiftPaths(Data=dup_9, Offset=-1)  # -> graft(Data)

# ---- group: Cell Left Pt
left_qpts_2 = Point(left_qpts)

# ---- group: Cell Right Pt
right_qpts_2 = Point(right_qpts)

# ---- group: Translate Vector (Mesh orientation)
vec_12 = Vector(orient.Geometry)

vec_13 = Vector(orient_2.Geometry)

# ----
# There are four (or more) points
# per Cell, per Profile
# Branching: {Profile ; 0 ; Cell} (point)
viewer_6 = ParamViewer(left_qpts_2)

# ---- group: Translate Vector (Mesh orientation)
vec_14 = Vector(vec_12)

# ----
# Translate the Profile YZ description to Points
partition_8 = PartitionList(List=vec_14, Size=4)
move = Move(Geometry=left_qpts_2, Motion=partition_8)  # -> Geometry, Transform
move_2 = Move(Geometry=right_qpts_2, Motion=partition_8)  # -> Geometry, Transform

partition_9 = PartitionList(List=vec_13, Size=4)

short = ShortestList(ListA=left_qpts_2, ListB=partition_9, TrimMode=2)  # -> ListA, ListB
short_2 = ShortestList(ListA=right_qpts_2, ListB=partition_9, TrimMode=2)  # -> ListA, ListB
move_3 = Move(Geometry=short.ListA, Motion=short.ListB)  # -> Geometry, Transform
move_4 = Move(Geometry=short_2.ListA, Motion=short_2.ListB)  # -> Geometry, Transform
item_7 = ListItem(List=move_3.Geometry, Index=0, Wrap=True)  # -> Item, Item1
item_8 = ListItem(List=move_4.Geometry, Index=0, Wrap=True)  # -> Item, Item1

# ---- group: Profile QPts Faces
qpts_faces_5 = Text(pshift_17)

# ---- group: Left Profile QPts
left_qpts_3 = Point(move.Geometry)

# ---- group: Right Profile QPts
right_qpts_3 = Point(move_2.Geometry)

# ---- group: Bottom Left
pt_6 = Point(item_7.Item)

# ---- group: Top Left
pt_7 = Point(item_7.Item1)

# ---- group: Bottom Right
pt_8 = Point(item_8.Item)

# ---- group: Top Right
pt_9 = Point(item_8.Item1)

# ----
pline = PolyLine(Vertices=left_qpts_3, Closed=invert(False))  # disabled
conmesh = ConstructMesh(Vertices=left_qpts_3, Faces=qpts_faces_5)  # disabled
panel_4 = Panel(qpts_faces_5)
merge_10 = Merge(Data1=pt_6, Data2=pt_8, Data3=pt_9, Data4=pt_7)

# ---- group: Profile Z Bounds QPts
bounds_qpts = Point(merge_10)

# ----
pline_2 = PolyLine(Vertices=bounds_qpts, Closed=invert(False))
conmesh_2 = ConstructMesh(Vertices=bounds_qpts, Faces={A=0, B=1, C=2, D=3})
panel_5 = Panel("""{1;A} Profile QPts Faces
{2;A;B} Left Profile QPts
{3;A;B} Right Profile QPts
{4;A;B} Profile Z Bounds QPts""")

# ---- group: Jamb Profile QPts Faces
qpts_faces_6 = Text(qpts_faces_5)

# ---- group: Left Profile QPts
qpts = Point(left_qpts_3)

# ---- group: Right Profile QPts
qpts_2 = Point(right_qpts_3)

# ----
cluster_26 = Cluster_17(data=qpts_faces_5, path="1")  # disabled
cluster_27 = Cluster_17(data=left_qpts_3, path="2")  # disabled
cluster_28 = Cluster_17(data=right_qpts_3, path="3")  # disabled
cluster_29 = Cluster_17(data=bounds_qpts, path="4")  # disabled
merge_11 = Merge(Data1=panel_5, Data2=cluster_26, Data3=cluster_27, Data4=cluster_28, Data5=cluster_29)

# ----
# Construct pairs (Left and Right) of boxes
# out of each Profile
conmesh_3 = ConstructMesh(Vertices=qpts, Faces=qpts_faces_6)
conmesh_4 = ConstructMesh(Vertices=qpts_2, Faces=qpts_faces_6)
faceb = FaceBoundaries(Mesh=conmesh_3)
faceb_2 = FaceBoundaries(Mesh=conmesh_4)
pshift_18 = ShiftPaths(Data=faceb, Offset=-1)
pshift_19 = ShiftPaths(Data=faceb_2, Offset=-1)
explode = Explode(Curve=pshift_18, Recursive=True)  # -> Segments, Vertices
explode_2 = Explode(Curve=pshift_19, Recursive=True)  # -> Segments, Vertices
item_9 = ListItem(List=explode.Vertices, Index=0, Wrap=True)  # -> Item, Item1, Item2
item_10 = ListItem(List=explode_2.Vertices, Index=0, Wrap=True)  # -> Item, Item1, Item2
rec_3pt = Rectangle3Pt(PointA=item_9.Item, PointB=item_9.Item1, PointC=item_9.Item2)  # -> Rectangle, Length
rec_3pt_2 = Rectangle3Pt(PointA=item_10.Item, PointB=item_10.Item1, PointC=item_10.Item2)  # -> Rectangle, Length
pshift_20 = ShiftPaths(Data=rec_3pt.Rectangle, Offset=-1)
pshift_21 = ShiftPaths(Data=rec_3pt_2.Rectangle, Offset=-1)

# ----
# Construct a Mesh (spanning Left to Right)
# out of each Profile
cluster_30 = Cluster_19(T=qpts)
relitem = RelativeItem(Tree=qpts, Offset=cluster_30, WrapPaths=False, WrapItems=invert(False))  # -> graft(ItemA), graft(ItemB)
relitem_2 = RelativeItem(Tree=qpts_2, Offset=cluster_30, WrapPaths=False, WrapItems=invert(False))  # -> graft(ItemA), graft(ItemB)
merge_12 = Merge(Data1=relitem.ItemA, Data2=relitem.ItemB, Data3=relitem_2.ItemB, Data4=relitem_2.ItemA)
conmesh_5 = ConstructMesh(Vertices=merge_12, Faces={A=0, B=1, C=2, D=3})
pshift_22 = ShiftPaths(Data=conmesh_5, Offset=-1)
merge_13 = Merge(Data1=conmesh_3, Data2=conmesh_4, Data3=pshift_22)
mjoin = MeshJoin(Meshes=merge_13)

profile_qpts = Data(merge_11)
profile_qpts_2 = ClusterOutput(profile_qpts)
box_height_9 = Number(box_height_8)
box_height_10 = Number(box_height_9)
box_height_11 = Number(box_height_10)
neg = Negative(Value=box_height_11)

# ---- group: Box Height Left
num_12 = Number(neg)

# ----
neg_2 = Negative(Value=num_12)

# ---- group: Box Height Right
num_13 = Number(neg_2)

# ----
boxrec = BoxRectangle(Rectangle=pshift_20, Height=num_12)
boxrec_2 = BoxRectangle(Rectangle=pshift_21, Height=num_13)
merge_14 = Merge(Data1=boxrec, Data2=boxrec_2)
box_height_12 = Number(box_height_10)
box = Box(merge_14)

# ----
# Choose whether the mesh is from
# A) the Left/Right boxes
# B) the Mesh spanning Left-to-Right (this is usually the width of the Cell, or somewhat inset)
# 
# The criteria for choossing is whether there is a Box Height included in that property of the Profile.
# If the Box Height is not a number, than the Cell-spanning Mesh is used
null = NullItem(Item=box_height_12)  # -> NullFlags, InvalidFlags, Description
mbox = MeshBox(Base=merge_14, XCount=1, YCount=1, ZCount=1)
bool = Boolean(flatten(null.NullFlags))
tstat_5 = TreeStatistics(Tree=mbox)  # -> Paths, Length, Count
dispatch = Dispatch(List=tstat_5.Paths, DispatchPattern=bool)  # -> ListA, ListB
branch_4 = TreeBranch(Tree=mbox, Path=dispatch.ListB, MaintainPaths=True)
branch_5 = TreeBranch(Tree=mjoin, Path=dispatch.ListA, MaintainPaths=True)
merge_15 = Merge(Data1=branch_4, Data2=branch_5)

box_mesh = Mesh(merge_15)
colour = Colour(col_4)
box_mesh_2 = ClusterOutput(box_mesh)
colour_2 = ClusterOutput(colour)

# ==== cluster Cluster_45
unit_conversion = ClusterInput()
layers_start_from_interior = ClusterInput()
unit_conversion_2 = Number(unit_conversion)
layers_start_from_interior_2 = Number(layers_start_from_interior)
multiplication = Multiplication(A=unit_conversion_2, B=layers_start_from_interior_2)

# ----
# Interior face is at Cell Curve
panel = Panel("0")
num = Number(panel)

ma = MassAddition(Input=multiplication)  # -> Result, PartialResults
merge = Merge(Data1=num, Data2=ma.PartialResults)

# ----
# There are no displacements in 'Z'
panel_2 = Panel("0")

relitem = RelativeItem(Tree=merge, Offset="{0}(1)", WrapPaths=False, WrapItems=False)  # -> ItemA, ItemB

num_2 = Number(relitem.ItemA)
bnd = Bounds(Numbers=num_2)
dedomain = DeconstructDomain(Domain=bnd)  # -> Start, End
gradient = Gradient(
    LowerLimit=dedomain.Start,
    UpperLimit=dedomain.End,
    Parameter=num_2,
    stops=[0: RGB(234, 38, 0), 0.25: RGB(234, 126, 0), 0.5: RGB(254, 244, 84), 0.75: RGB(173, 203, 249), 1: RGB(75, 107, 169)])
expression = Expression(x=gradient, Expression="Format(\"colour:{0}\", x)")  # -> graft(R)

expression_2 = Expression(y=relitem.ItemA, z=panel_2, Expression="Format(\"bottom, {0}, {1}\", y, z)")  # -> graft(R)
expression_3 = Expression(y=relitem.ItemB, z=panel_2, Expression="Format(\"bottom, {0}, {1}\", y, z)")  # -> graft(R)
expression_4 = Expression(y=relitem.ItemB, z=panel_2, Expression="Format(\"top, {0}, {1}\", y, z)")  # -> graft(R)
expression_5 = Expression(y=relitem.ItemA, z=panel_2, Expression="Format(\"top, {0}, {1}\", y, z)")  # -> graft(R)
panel_3 = Panel("""Q{0;1;2;3}
YZ""")
merge_2 = Merge(Data1=expression_2, Data2=expression_3, Data3=expression_4, Data4=expression_5, Data5=expression)
path_mapper = PathMapper(merge_2, source="{A;B}", target="{B + 1;A}")
merge_3 = Merge(Data1="name:Wall", Data2="length:cell", Data3="inset:0", Data4=panel_3)
ins = InsertItems(List=path_mapper, Item=merge_3, Indices=0, Wrap=True)
pshift = ShiftPaths(Data=ins, Offset=-1)

# ---- group: Wall Profiles
wall_profile_yz = Text(pshift)

# ----
panel_4 = Panel(pshift)
merge_4 = Merge(Data1="{1;*} Profile: Wall", Data2=wall_profile_yz)
profiles = Data(merge_4)
profiles_2 = ClusterOutput(profiles)
unit_conversion_3 = Number(unit_conversion_2)

# ---- group: Z for displaying Profile
panel_5 = Panel("1000")

# ----
multiplication_2 = Multiplication(A=unit_conversion_3, B=panel_5)

# ---- group: Profile YZ
txt = Text(wall_profile_yz)

# ----
# Display the Profile to ensure the Profile YZ description is correct
pt = ConstructPoint(XCoordinate=0, YCoordinate=0, ZCoordinate=multiplication_2)
pt_2 = ConstructPoint(XCoordinate=0, YCoordinate=0, ZCoordinate=0)
tmatch = MatchText(Text=txt, Pattern="Q*", Case=True)
merge_5 = Merge(Data1=pt, Data2=pt_2)
dispatch = Dispatch(List=txt, DispatchPattern=tmatch)  # -> ListA, ListB
txt_2 = Text(dispatch.ListB)
panel_6 = Panel(dispatch.ListA)
tmatch_2 = MatchText(Text=txt_2, Pattern="XY", Case=True)
tmatch_3 = MatchText(Text=txt_2, Pattern="YZ", Case=True)
or = GateOr(A=tmatch_2, B=tmatch_3)
dispatch_2 = Dispatch(List=txt_2, DispatchPattern=or)  # -> ListA, ListB
tmatch_4 = MatchText(Text=dispatch_2.ListB, Pattern="thickness*", Case=True)
tmatch_5 = MatchText(Text=dispatch_2.ListB, Pattern="length*", Case=True)
or_2 = GateOr(A=tmatch_4, B=tmatch_5)
dispatch_3 = Dispatch(List=dispatch_2.ListB, DispatchPattern=or_2)  # -> ListA, ListB
tmatch_6 = MatchText(Text=dispatch_3.ListB, Pattern="inset*", Case=True)
dispatch_4 = Dispatch(List=dispatch_3.ListB, DispatchPattern=tmatch_6)  # -> ListA, ListB

split = TextSplit(Text=dispatch_4.ListB, Separators=",")
trim = TextTrim(Text=split, Start=True, End=True)
item = ListItem(List=trim, Index=0, Wrap=True)  # -> Item, Item1, Item2
tmatch_7 = MatchText(Text=item.Item, Pattern="top", Case=True)
vec = VectorXYZ(XComponent=0, YComponent=item.Item1, ZComponent=item.Item2)  # -> Vector, Length
not = GateNot(A=tmatch_7)
merge_6 = Merge(Data1=tmatch_7, Data2=not)
cull = CullPattern(List=merge_5, CullPattern=merge_6)
move = Move(Geometry=cull, Motion=vec.Vector)  # -> Geometry, Transform
pshift_2 = ShiftPaths(Data=move.Geometry, Offset=-1)

pline = PolyLine(Vertices=pshift_2, Closed=invert(False))
conmesh = ConstructMesh(Vertices=pshift_2, Faces=dispatch.ListA)
flip = FlipCurve(Curve=pline)  # -> Curve, Flag
curvepoint = PointOnCurve(flip.Curve, parameter=0)
planar = Planar(Curve=flip.Curve)  # -> Planar, Plane, Deviation

# ==== cluster Cluster_46
pts = ClusterInput()
cell_width = ClusterInput()
cell_height = ClusterInput()
pts_2 = Point(pts)
cell_width_2 = Number(cell_width)
cell_height_2 = Number(cell_height)
intcrv = Interpolate(Vertices=pts_2, Degree=3, Periodic=invert(False), KnotStyle=1)  # -> Curve, Length, Domain
len = Length(Curve=intcrv.Curve)
division = Division(A=len, B=cell_width_2)
round = Round(Number=division)  # -> Nearest, Floor, Ceiling
divide = DivideCurve(Curve=intcrv.Curve, Count=round.Floor, Kinks=False)  # -> Points, Tangents, Parameters
Z = UnitZ(Factor=cell_height_2)
pshift = ShiftPaths(Data=divide.Points, Offset=-1)
move = Move(Geometry=pshift, Motion=Z)  # -> Geometry, Transform
relitem = RelativeItem(Tree=pshift, Offset="{0}(1)", WrapPaths=False, WrapItems=invert(False))  # -> graft(ItemA), graft(ItemB)
relitem_2 = RelativeItem(Tree=move.Geometry, Offset="{0}(1)", WrapPaths=False, WrapItems=invert(False))  # -> graft(ItemA), graft(ItemB)
cell_description = ClusterInput()
merge = Merge(Data1=relitem.ItemA, Data2=relitem.ItemB, Data3=relitem_2.ItemB, Data4=relitem_2.ItemA)
pline = PolyLine(Vertices=merge, Closed=invert(False))

# ---- group: Cell Descriptions
cell_description_2 = Text(cell_description)

# ----
cell_crvs = Curve(pline)
tstat = TreeStatistics(Tree=cell_crvs)  # -> Paths, Length, Count
lng = ListLength(List=tstat.Paths)
panel = Panel("""{-1} Unit Conversion
{1;*} Cell Crvs
{2;*} Cell Descriptions""")
dup = DuplicateData(Data=cell_description_2, Number=lng, Order=True)  # -> graft(Data)
tstat_2 = TreeStatistics(Tree=dup)  # -> Paths, Length, Count
unit_conversion = ClusterInput()
replace = ReplacePaths(Data=dup, Search=tstat_2.Paths, Replace=tstat.Paths)
unit_conversion_2 = Number(unit_conversion)
cluster = Cluster_17(data=cell_crvs, path="1")
cluster_2 = Cluster_17(data=replace, path="2")
flatten = FlattenTree(Tree=unit_conversion_2, Path="{-1}")
merge_2 = Merge(Data1=panel, Data2=flatten, Data3=cluster, Data4=cluster_2)
cells = Data(merge_2)
cells_2 = ClusterOutput(cells)

# ==== cluster Cluster_47
pts = ClusterInput()
cell_width = ClusterInput()
cell_height = ClusterInput()
pts_2 = Point(pts)
cell_width_2 = Number(cell_width)
cell_height_2 = Number(cell_height)
item = ListItem(List=pts_2, Index=0, Wrap=True)  # -> Item, Item1, Item2, Item3
ln = Line(StartPoint=item.Item1, EndPoint=item.Item2)
len = Length(Curve=ln)
division = Division(A=len, B=cell_width_2)
round = Round(Number=division)  # -> Nearest, Floor, Ceiling
divide = DivideCurve(Curve=ln, Count=round.Floor, Kinks=False)  # -> Points, Tangents, Parameters
Z = UnitZ(Factor=cell_height_2)
pshift = ShiftPaths(Data=divide.Points, Offset=-1)
merge = Merge(Data1=item.Item, Data2=pshift, Data3=item.Item3)
move = Move(Geometry=merge, Motion=Z)  # -> Geometry, Transform
relitem = RelativeItem(Tree=merge, Offset="{0}(1)", WrapPaths=False, WrapItems=False)  # -> graft(ItemA), graft(ItemB)
relitem_2 = RelativeItem(Tree=move.Geometry, Offset="{0}(1)", WrapPaths=False, WrapItems=False)  # -> graft(ItemA), graft(ItemB)
merge_2 = Merge(Data1=relitem.ItemA, Data2=relitem.ItemB, Data3=relitem_2.ItemB, Data4=relitem_2.ItemA)
cell_description = ClusterInput()
pline = PolyLine(Vertices=merge_2, Closed=invert(False))

# ---- group: Cell Descriptions
cell_description_2 = Text(cell_description)

# ----
cell_crvs = Curve(pline)
tstat = TreeStatistics(Tree=cell_crvs)  # -> Paths, Length, Count
lng = ListLength(List=tstat.Paths)
panel = Panel("""{-1} Unit Conversion
{1;*} Cell Crvs
{2;*} Cell Descriptions""")
dup = DuplicateData(Data=cell_description_2, Number=lng, Order=True)  # -> graft(Data)
tstat_2 = TreeStatistics(Tree=dup)  # -> Paths, Length, Count
replace = ReplacePaths(Data=dup, Search=tstat_2.Paths, Replace=tstat.Paths)
unit_conversion = ClusterInput()
unit_conversion_2 = Number(unit_conversion)
cluster = Cluster_17(data=cell_crvs, path="1")
cluster_2 = Cluster_17(data=replace, path="2")
flatten = FlattenTree(Tree=unit_conversion_2, Path="{-1}")
merge_3 = Merge(Data1=panel, Data2=flatten, Data3=cluster, Data4=cluster_2)
cells = Data(merge_3)
cells_2 = ClusterOutput(cells)

# ==== cluster Cluster
face_normals = ClusterInput()
view_lines_vec = ClusterInput()
angle_tol = ClusterInput()
face_normals_2 = Vector(face_normals)
view_lines_vec_2 = Vector(view_lines_vec)
angle = Angle(VectorA=face_normals_2, VectorB=view_lines_vec_2)  # -> Angle, Reflex
pi = Pi(Factor=0.5)
angle_tol_2 = Number(angle_tol)
subtraction = Subtraction(A=angle.Angle, B=pi)
rad = Radians(Degrees=angle_tol_2)
larger = LargerThan(FirstNumber=subtraction, SecondNumber=rad)  # -> LargerThan, OrEqualTo
exceeds_angle_tol = Boolean(larger.LargerThan)
exceeds_angle_tol_2 = ClusterOutput(exceeds_angle_tol)

# ==== cluster Cluster_2
meshes = ClusterInput()
view_lines = ClusterInput()

# ---- group: Meshes (per Mesh, per View Line)
meshes_2 = Mesh(meshes)

# ---- group: View Lines (per Mesh, per View Line)
view_lines_2 = Line(view_lines)

# ----
end = EndPoints(Curve=view_lines_2)  # -> Start, End
divide = DivideCurve(Curve=view_lines_2, Count=1, Kinks=False)  # -> Points, Tangents, Parameters
panel = Panel(view_lines_2)
eval = EvaluateCurve(Curve=view_lines_2, Parameter=0)  # -> Point, Tangent, Angle

# ----
# Check which Intersection Points
# are equal to the end point of the
# intersecting View Line
meshray = MeshRay(Mesh=meshes_2, Point=end.Start, Direction=view_lines_2)  # -> Point, Hit
dist = Distance(PointA=meshray.Point, PointB=end.End)
equals = Equality(FirstNumber=dist, SecondNumber=0)  # -> Equality, Inequality

# ----
# Measure closest point of each mesh
dist_2 = Distance(PointA=meshray.Point, PointB=end.Start)
pshift = ShiftPaths(Data=dist_2, Offset=-1)
bnd = Bounds(Numbers=pshift)
dedomain = DeconstructDomain(Domain=bnd)  # -> flatten(Start), End
closest_distance_per_mesh = Number(dedomain.Start)

intersection_pt_is_view_line_end_pt = Boolean(equals.Equality)
intersection_pt_is_view_line_end_pt_2 = ClusterOutput(intersection_pt_is_view_line_end_pt)
closest_distance_per_mesh_2 = ClusterOutput(closest_distance_per_mesh)

# ==== cluster Cluster_10
mesh = ClusterInput()
mesh_2 = Mesh(mesh)
demesh = DeconstructMesh(Mesh=mesh_2)  # -> Vertices, Faces, Colours, Normals
deface = DeconstructFace(Face=demesh.Faces)  # -> CornerA, CornerB, CornerC, CornerD
pt = Point(demesh.Vertices)
item = ListItem(List=pt, Index=deface.CornerA, Wrap=True)  # -> graft(Item)
item_2 = ListItem(List=pt, Index=deface.CornerB, Wrap=True)  # -> graft(Item)
item_3 = ListItem(List=pt, Index=deface.CornerC, Wrap=True)  # -> graft(Item)
item_4 = ListItem(List=pt, Index=deface.CornerD, Wrap=True)  # -> graft(Item)
merge = Merge(Data1=item, Data2=item_2, Data3=item_3, Data4=item_4)
mesh_3 = Mesh(mesh_2)
pline = PolyLine(Vertices=merge, Closed=invert(False))
avr = Average(Input=merge)
meshcp = MeshClosestPoint(Point=avr, Mesh=mesh_3)  # -> Point, Index, Parameter
meval = MeshEval(Mesh=mesh_3, Parameter=meshcp.Parameter)  # -> Point, Normal, Colour
amp = Amplitude(Vector=meval.Normal, Amplitude=6)
cell_crvs = Curve(pline)
cell_center_pts = Point(avr)
cell_normals = Vector(meval.Normal)
vdis = VectorDisplay(Anchor=meval.Point, Vector=amp)
cell_crvs_2 = ClusterOutput(cell_crvs)
cell_center_pts_2 = ClusterOutput(cell_center_pts)
cell_normals_2 = ClusterOutput(cell_normals)
panel = Panel(meshcp.Parameter)

# ==== cluster Cluster_11
cell_crvs = ClusterInput()
cell_center_pts = ClusterInput()
cell_normals = ClusterInput()
cell_normals_2 = Vector(cell_normals)
cell_crvs_2 = Curve(cell_crvs)
cell_center_pts_2 = Point(cell_center_pts)
pdecon = Deconstruct(Point=cell_center_pts_2)  # -> XComponent, YComponent, ZComponent
bnd = Bounds(Numbers=flatten(pdecon.ZComponent))
dedomain = DeconstructDomain(Domain=bnd)  # -> Start, End
similar = Similarity(FirstNumber=pdecon.ZComponent, SecondNumber=dedomain.Start, Threshold=0.1)  # -> Similarity, AbsoluteDifference
similar_2 = Similarity(FirstNumber=pdecon.ZComponent, SecondNumber=dedomain.End, Threshold=0.1)  # -> Similarity, AbsoluteDifference
or = GateOr(A=similar.Similarity, B=similar_2.Similarity)
not = GateNot(A=or)

# ----
# Note: Flattened Data
dispatch = Dispatch(List=cell_crvs_2, DispatchPattern=not)  # -> flatten(ListA), ListB
dispatch_2 = Dispatch(List=cell_center_pts_2, DispatchPattern=not)  # -> flatten(ListA), ListB
dispatch_3 = Dispatch(List=cell_normals_2, DispatchPattern=not)  # -> flatten(ListA), ListB
crv = Curve(dispatch.ListA)
pt = Point(dispatch_2.ListA)

vec = Vector(dispatch_3.ListA)
item = ListItem(List=crv, Index=Slider(15, range=0..15), Wrap=True)
cset = CreateSet(List=vec)  # -> Set, Map

lng = ListLength(List=vec)
series = Series(Start=0, Step=1, Count=lng)
int = Integer(series)

vec_2 = Vector(cset.Set)
mesh = MeshBrep(
    Brep=item,
    Settings={GridMaxCount=0, GridMinCount=16, JaggedSeams=False, MaxEdgeLength=0, MinEdgeLength=0.0001, MinTolerance=0, Refine=True, RefineAngle=0, RelativeTolerance=0.65, SimplePlanes=True, Tolerance=0})
cir = Circle(Plane=PlaneXY(0, 0, 0), Radius=1)
pt_2 = Point(vec_2)
alongcrv = SortAlongCurve(Points=pt_2, Curve=cir)  # -> flatten(Points), Indices

# ---- group: Cell Normals Sorted along curve
vec_3 = Vector(graft(alongcrv.Points))

# ----
devec = DeconstructVector(Vector=vec_3)  # -> XComponent, YComponent, ZComponent
devec_2 = DeconstructVector(Vector=vec)  # -> XComponent, YComponent, ZComponent
panel = Panel(vec_3)
similar_3 = Similarity(FirstNumber=devec.XComponent, SecondNumber=devec_2.XComponent, Threshold=0.1)  # -> Similarity, AbsoluteDifference
similar_4 = Similarity(FirstNumber=devec.YComponent, SecondNumber=devec_2.YComponent, Threshold=0.1)  # -> Similarity, AbsoluteDifference
similar_5 = Similarity(FirstNumber=devec.ZComponent, SecondNumber=devec_2.ZComponent, Threshold=0.1)  # -> Similarity, AbsoluteDifference
avr = Average(Input=pt)
and = GateAnd(A=similar_3.Similarity, B=similar_4.Similarity, C=similar_5.Similarity)
cull = CullPattern(List=int, CullPattern=and)
cir_2 = Circle(Plane=avr, Radius=1)

# ---- group: Indices sorted by Cell Normals
int_2 = Integer(cull)

# ----
item_2 = ListItem(List=pt, Index=int_2, Wrap=True)

# ---- group: Cell Center Pts sorted by Cell Normals
pt_3 = Point(item_2)

# ----
alongcrv_2 = SortAlongCurve(Points=pt_3, Curve=cir_2)  # -> Points, Indices
sort_pt = SortPoints(Points=pt_3)  # -> Points, Indices
intcrv = Interpolate(Vertices=alongcrv_2.Points, Degree=3, Periodic=False, KnotStyle=1)  # -> Curve, Length, Domain
cell_normals_3 = Vector(vec)
cell_crvs_3 = Curve(crv)
cell_center_pts_3 = Point(pt)
panel_2 = Panel(alongcrv_2.Points)
cell_crvs_4 = ClusterOutput(cell_crvs_3)
cell_center_pts_4 = ClusterOutput(cell_center_pts_3)
cell_normals_4 = ClusterOutput(cell_normals_3)
curvepoint = PointOnCurve(intcrv.Curve, parameter=1)

# ==== cluster Cluster_12
cell_crvs = ClusterInput()
cell_center_pts = ClusterInput()
cell_normals = ClusterInput()
cell_crvs_2 = Curve(cell_crvs)
cell_center_pts_2 = Point(cell_center_pts)
cell_normals_2 = Vector(cell_normals)
devec = DeconstructVector(Vector=cell_normals_2)  # -> XComponent, YComponent, ZComponent
equals = Equality(FirstNumber=devec.YComponent, SecondNumber=1)  # -> Equality, Inequality
cull = CullPattern(List=cell_crvs_2, CullPattern=equals.Equality)
cull_2 = CullPattern(List=cell_center_pts_2, CullPattern=equals.Equality)
cull_3 = CullPattern(List=cell_normals_2, CullPattern=equals.Equality)

# ----
# This attempts to ensure that the cell is oriented
# clockwise, starting at the bottom-left corner
# as viewed from exterior looking at the facade
pl = PlaneNormal(Origin=cull_2, ZAxis=cull_3)
pi = Pi(Factor=1)
prot = RotatePlane(Plane=pl, Angle=pi)
cell_crvs_3 = Curve(cull)
cir = Circle(Plane=prot, Radius=2)
flip = FlipCurve(Curve=cir)  # -> graft(Curve), Flag
end = EndPoints(Curve=cir)  # -> Start, End
disc = Discontinuity(Curve=cell_crvs_3, Level=1)  # -> Points, Parameters
alongcrv = SortAlongCurve(Points=disc.Points, Curve=flip.Curve)  # -> Points, Indices
pshift = ShiftPaths(Data=alongcrv.Points, Offset=-1)
pline = PolyLine(Vertices=pshift, Closed=invert(False))
pshift_2 = ShiftPaths(Data=pline, Offset=-1)

cell_crvs_4 = Curve(pshift_2)
cell_center_pts_3 = Point(cull_2)
cell_normals_3 = Vector(cull_3)
cell_crvs_5 = ClusterOutput(cell_crvs_4)
cell_center_pts_4 = ClusterOutput(cell_center_pts_3)
cell_normals_4 = ClusterOutput(cell_normals_3)

# ==== cluster Cluster_22
cell_crvs = ClusterInput()
header_profile_yz = ClusterInput()
sill_profile_yz = ClusterInput()
cell_crvs_2 = Curve(cell_crvs)
header_profile_yz_2 = Text(header_profile_yz)
sill_profile_yz_2 = Text(sill_profile_yz)

# ----
# Take the Z Bounds QPts of the Header and Sill Profiles
# and build a Cell Curve that is contained between
# The Header's lowest points and the Sill's highest points
cluster = Cluster_21(cell_crvs=cell_crvs_2, profile_yz=header_profile_yz_2)  # -> profile_qpts_2, box_2, box_mesh_2
cluster_2 = Cluster_21(cell_crvs=cell_crvs_2, profile_yz=sill_profile_yz_2)  # -> profile_qpts_2, box_2, box_mesh_2
cluster_3 = Cluster_16(top_profile_qpts=cluster.profile_qpts_2, bottom_profile_qpts=cluster_2.profile_qpts_2)

# ---- group: Cell within Header and Sill
cell_crvs_3 = Curve(cluster_3)

# ----
cell_crvs_4 = ClusterOutput(cell_crvs_3)

# ==== cluster Cluster_23
cell_curves = ClusterInput()
typ_vent_width = ClusterInput()
glazing_lite_description = ClusterInput()

# ---- group: Cell Curves (Framed)
cell_curves_2 = Curve(cell_curves)

# ----
glazing_lite_description_2 = Text(glazing_lite_description)

split = TextSplit(Text=glazing_lite_description_2, Separators=",")
trim = TextTrim(Text=split, Start=True, End=True)
item = ListItem(List=trim, Index=0, Wrap=True)  # -> Item, Item1, Item2
pshift = ShiftPaths(Data=item.Item, Offset=-1)
tmatch = MatchText(Text=pshift, Pattern="operable", Case=invert(True))
bool = Boolean(tmatch)

# ----
# Cell Curves object 1.0
cluster = Cluster_18(cell_curve=cell_curves_2)

panel = Panel(cluster)
cluster_2 = Cluster_15(data=cluster, path_mask="{1;*}")
cluster_3 = Cluster_15(data=cluster, path_mask="{6;*}")

# ---- group: Cell Left Pts
pt = Point(cluster_2)

# ---- group: Horizontal Direction
vec = Vector(cluster_3)

# ----
int = Integer(bool)
not = GateNot(A=bool)
panel_2 = Panel(int)
vlen = VectorLength(Vector=vec)
ma = MassAddition(Input=bool)  # -> Result, PartialResults
ma_2 = MassAddition(Input=not)  # -> Result, PartialResults

# ---- group: Qty Fixed Lites
panel_3 = Panel(ma_2.Result)

# ---- group: Qty Operable Lites
panel_4 = Panel(ma.Result)

# ---- group: Cell Width (Bottom)
num = Number(vlen)

# ----
typ_vent_width_2 = Number(typ_vent_width)
item_2 = ListItem(List=pt, Index=0, Wrap=True)  # -> Item, Item1
multiplication = Multiplication(A=typ_vent_width_2, B=panel_4)
subtraction = Subtraction(A=num, B=multiplication)
division = Division(A=subtraction, B=panel_3)

# ---- group: Typ. Vent Width
num_2 = Number(typ_vent_width_2)

# ---- group: Index for Operable width
panel_5 = Panel("1")

# ---- group: Fixed Lite Width (Bottom)
num_3 = Number(division)

# ----
ins = InsertItems(List=num_3, Item=num_2, Indices=panel_5, Wrap=True)
pshift_2 = ShiftPaths(Data=ins, Offset=-1)
item_3 = ListItem(List=pshift_2, Index=int, Wrap=True)
ma_3 = MassAddition(Input=item_3)  # -> Result, PartialResults

# ---- group: Index for Operable width
panel_6 = Panel("0")

# ----
ins_2 = InsertItems(List=ma_3.PartialResults, Item=panel_6, Indices=panel_6, Wrap=True)
pshift_3 = ShiftPaths(Data=ins_2, Offset=-1)

# ---- group: Bottom Left
pt_2 = Point(item_2.Item)

# ---- group: Top Left
pt_3 = Point(item_2.Item1)

# ----
amp = Amplitude(Vector=vec, Amplitude=pshift_3)
move = Move(Geometry=pt_2, Motion=amp)  # -> Geometry, Transform
move_2 = Move(Geometry=pt_3, Motion=amp)  # -> Geometry, Transform
panel_7 = Panel(pshift_3)
relitem = RelativeItem(Tree=move.Geometry, Offset="{0;0}(1)", WrapPaths=False, WrapItems=False)  # -> graft(ItemA), graft(ItemB)
relitem_2 = RelativeItem(Tree=move_2.Geometry, Offset="{0;0}(1)", WrapPaths=False, WrapItems=False)  # -> graft(ItemA), graft(ItemB)
merge = Merge(Data1=relitem.ItemA, Data2=relitem.ItemB, Data3=relitem_2.ItemB, Data4=relitem_2.ItemA)
pline = PolyLine(Vertices=merge, Closed=invert(False))
pshift_4 = ShiftPaths(Data=pline, Offset=-1)
glazing_lite_curves = Curve(pshift_4)
glazing_lite_curves_2 = ClusterOutput(glazing_lite_curves)

# ==== cluster Cluster_27
bottom_edge = ClusterInput()
top_edge = ClusterInput()
bottom_edge_2 = Curve(bottom_edge)
top_edge_2 = Curve(top_edge)
end = EndPoints(Curve=bottom_edge_2)  # -> Start, End
end_2 = EndPoints(Curve=top_edge_2)  # -> Start, End

# ---- group: Bottom Left
pt = Point(end.Start)

# ---- group: Top Left
pt_2 = Point(end_2.Start)

# ---- group: Bottom Right
pt_3 = Point(end.End)

# ---- group: Top Right
pt_4 = Point(end_2.End)

# ----
merge = Merge(Data1=pt, Data2=pt_3, Data3=pt_4, Data4=pt_2)
pline = PolyLine(Vertices=merge, Closed=invert(False))
pshift = ShiftPaths(Data=pline, Offset=-1)
layout_curve = Curve(pshift)
layout_curve_2 = ClusterOutput(layout_curve)

# ==== cluster Cluster_28
C = ClusterInput()
C_2 = Curve(reparameterize(C))
len = Length(Curve=C_2)
subtraction = Subtraction(A=len, B="15")
division = Division(A=subtraction, B="2")
subtraction_2 = Subtraction(A=len, B=division)
dom = ConstructDomain(DomainStart=0, DomainEnd=len)
remap = RemapNumbers(Value=subtraction_2, Source=dom, Target=Domain(0, 1))  # -> Mapped, Clipped
remap_2 = RemapNumbers(Value=division, Source=dom, Target=Domain(0, 1))  # -> Mapped, Clipped
dom_2 = ConstructDomain(DomainStart=remap_2.Mapped, DomainEnd=remap.Mapped)
subcrv = SubCurve(BaseCurve=C_2, Domain=dom_2)
C_3 = ClusterOutput(subcrv)

# ==== cluster Cluster_37
cell_type_descriptions = ClusterInput()
envelope_segments = ClusterInput()
envelope_segments_2 = Data(envelope_segments)
cell_type_descriptions_2 = Data(cell_type_descriptions)
panel = Panel(envelope_segments_2)
branch = TreeBranch(Tree=cell_type_descriptions_2, Path="{0}", MaintainPaths=True)
cluster = Cluster_15(data=cell_type_descriptions_2, path_mask="{1;*}")
cluster_2 = Cluster_15(data=cell_type_descriptions_2, path_mask="{2;*}")
split = SplitTree(Data=cell_type_descriptions_2, Masks=flatten("{0}"))  # -> Positive, Negative
panel_2 = Panel(branch)
cell_descriptions = Text(split.Negative)
layout_curves = ClusterInput()
panel_3 = Panel(cell_descriptions)

split_2 = TextSplit(Text=cell_descriptions, Separators=",")
trim = TextTrim(Text=split_2, Start=True, End=True)
item = ListItem(List=trim, Index=0, Wrap=True)  # -> Item, Item1, Item2

layout_curves_2 = Curve(layout_curves)
panel_4 = Panel(layout_curves_2)
pshift = ShiftPaths(Data=item.Item, Offset=-1)
pshift_2 = ShiftPaths(Data=item.Item1, Offset=-1)

# ----
# Cell Curves object 1.0
cluster_3 = Cluster_18(cell_curve=graft(layout_curves_2))

# ---- group: Cell Widths
num = Number(pshift)

# ---- group: Cell Types
txt = Text(pshift_2)

# ----
panel_5 = Panel(cluster_3)
cluster_4 = Cluster_15(data=cluster_3, path_mask="{1;*}")
cluster_5 = Cluster_15(data=cluster_3, path_mask="{6;*}")
cluster_6 = Cluster_15(data=cluster_3, path_mask="{2;*}")

# ---- group: Cell Widths
num_2 = Number(num)

num_3 = Number(graft(num_2))

# ---- group: Cell Types
txt_2 = Text(graft(txt))

# ----
# Only Layout Cells that have Descriptions
# which start with "type", are sub-divided (panelized)
panel_6 = Panel("type*")
tmatch = MatchText(Text=txt_2, Pattern=panel_6, Case=invert(True))
bool = Boolean(tmatch)

# ---- group: Cell Left Pts
pt = Point(cluster_4)

# ---- group: Cell Right Pts
pt_2 = Point(cluster_6)

# ---- group: Horizontal Direction
vec = Vector(cluster_5)

# ----
item_2 = ListItem(List=pt, Index=0, Wrap=True)  # -> Item, Item1
item_3 = ListItem(List=pt_2, Index=0, Wrap=True)  # -> Item, Item1
dispatch = Dispatch(List=num_3, DispatchPattern=bool)  # -> ListA, ListB
dispatch_2 = Dispatch(List=txt_2, DispatchPattern=bool)  # -> ListA, ListB

# ---- group: Horizontal Direction
vec_2 = Vector(vec)

# ----
pshift_3 = ShiftPaths(Data=vec_2, Offset=-1)
vlen = VectorLength(Vector=pshift_3)

# ---- group: Layout Widths
num_4 = Number(vlen)

# ---- group: Cell Widths
num_5 = Number(num_2)

# ---- group: Typ. = true, Atyp. = false
bool_2 = Boolean(bool)

# ---- group: Typ. Cell Widths
typ_bay_width = Number(dispatch.ListA)

# ---- group: Typ. Cell Types
# These are Cells that start with "type"
# However, not all are necessarily
# going to be sub-divided
# This also depends on whether
# their Cell Width is a number
txt_3 = Text(dispatch_2.ListA)

# ---- group: Atypical Cell Widths
typ_bay_width_2 = Number(dispatch.ListB)

# ---- group: Atypical Cell Types
# These are Cells that
# do not start with "type"
# i.e. "corner" Cells
txt_4 = Text(dispatch_2.ListB)

# ----
pshift_4 = ShiftPaths(Data=typ_bay_width_2, Offset=-1)
cluster_7 = Cluster_34(data_1=num_4, data_2=num_5)
ma = MassAddition(Input=pshift_4)  # -> Result, PartialResults

# ---- group: Atypical Cell Widths (Total)
typ_bay_width_3 = Number(ma.Result)

# ----
subtraction = Subtraction(A=num_4, B=typ_bay_width_3)

# ---- group: Layout Widths, typical portion
num_6 = Number(subtraction)

# ---- group: Layout Widths
num_7 = Number(cluster_7)

# ----
cluster_8 = Cluster_34(data_1=num_6, data_2=num_5)
dispatch_3 = Dispatch(List=cluster_8, DispatchPattern=bool_2)  # -> ListA, ListB

# ---- group: Typical Layout Widths
num_8 = Number(dispatch_3.ListA)

# ---- group: Atypical Layout Widths
typ_bay_width_4 = Number(dispatch_3.ListB)

# ---- group: Atypical Cell Widths
typ_bay_width_5 = Number(typ_bay_width_2)

# ---- group: Atypical Cell Types
txt_5 = Text(txt_4)

# ----
clean = CleanTree(RemoveNulls=True, RemoveInvalid=True, RemoveEmpty=invert(False), Tree=num_8)
clean_2 = CleanTree(RemoveNulls=invert(True), RemoveInvalid=True, RemoveEmpty=invert(False), Tree=typ_bay_width)
clean_3 = CleanTree(RemoveNulls=True, RemoveInvalid=True, RemoveEmpty=invert(False), Tree=txt_3)
clean_4 = CleanTree(RemoveNulls=True, RemoveInvalid=True, RemoveEmpty=invert(False), Tree=typ_bay_width_4)
clean_5 = CleanTree(RemoveNulls=True, RemoveInvalid=True, RemoveEmpty=invert(False), Tree=typ_bay_width_5)
clean_6 = CleanTree(RemoveNulls=True, RemoveInvalid=True, RemoveEmpty=invert(False), Tree=txt_5)
panel_7 = Panel(num_8)
null = NullItem(Item=clean_2)  # -> NullFlags, InvalidFlags, Description
cluster_9 = Cluster_34(data_1=clean_5, data_2=clean_4)
cluster_10 = Cluster_34(data_1=clean_6, data_2=clean_4)
dispatch_4 = Dispatch(List=clean, DispatchPattern=null.NullFlags)  # -> ListA, ListB
dispatch_5 = Dispatch(List=clean_2, DispatchPattern=null.NullFlags)  # -> ListA, ListB
dispatch_6 = Dispatch(List=clean_3, DispatchPattern=null.NullFlags)  # -> ListA, ListB
clean_7 = CleanTree(RemoveNulls=True, RemoveInvalid=True, RemoveEmpty=invert(False), Tree=dispatch_4.ListA)
clean_8 = CleanTree(RemoveNulls=True, RemoveInvalid=True, RemoveEmpty=invert(False), Tree=dispatch_4.ListB)
clean_9 = CleanTree(RemoveNulls=True, RemoveInvalid=True, RemoveEmpty=invert(False), Tree=dispatch_5.ListB)
clean_10 = CleanTree(RemoveNulls=True, RemoveInvalid=True, RemoveEmpty=invert(False), Tree=dispatch_6.ListA)
clean_11 = CleanTree(RemoveNulls=True, RemoveInvalid=True, RemoveEmpty=invert(False), Tree=dispatch_6.ListB)

# ---- group: Layout Widths to sub-divide
num_9 = Number(clean_8)

# ---- group: Cell Width sub-dividers
typ_bay_width_6 = Number(clean_9)

# ---- group: Typ. Cell Types
txt_6 = Text(clean_11)

# ----
cluster_11 = Cluster_34(data_1=clean_10, data_2=clean_7)

# ---- group: Bottom Left
pt_3 = Point(item_2.Item)

# ---- group: Top Left
pt_4 = Point(item_2.Item1)

# ---- group: Bottom Right
pt_5 = Point(item_3.Item)

# ---- group: Top Right
pt_6 = Point(item_3.Item1)

# ---- group: Horizontal Direction
vec_3 = Vector(vec)

# ----
cluster_12 = Cluster_35(width_to_sub_divide=num_9, width_sub_divider=typ_bay_width_6, cell_type=txt_6)  # -> cell_widths_2, cell_types_2

# ---- group: Cell Widths (not sub-divided)
num_10 = Number(graft(clean_7))

# ---- group: Cell Types (not sub-divided)
txt_7 = Text(cluster_11)

# ---- group: Atypical Cell Widths
typ_bay_width_7 = Number(cluster_9)

# ---- group: Atypical Cell Types
txt_8 = Text(cluster_10)

# ----
vlen_2 = VectorLength(Vector=vec_3)
dist = Distance(PointA=pt_3, PointB=pt_4)
dist_2 = Distance(PointA=pt_5, PointB=pt_6)

# ---- group: Layout Width (Bottom)
num_11 = Number(vlen_2)

# ---- group: Index 0
panel_8 = Panel("0")

# ----
path_mapper = PathMapper(num_10, source="{A;B;C;D}", target="{A;B;D;C}")
path_mapper_2 = PathMapper(txt_7, source="{A;B;C;D}", target="{A;B;D;C}")
path_mapper_3 = PathMapper(cluster_12.cell_widths_2, source="{A;B;C;D}", target="{A;B;D;C}")
path_mapper_4 = PathMapper(cluster_12.cell_types_2, source="{A;B;C;D}", target="{A;B;D;C}")
path_mapper_5 = PathMapper(typ_bay_width_7, source="{A;B;C;D}", target="{A;B;D;C}")
path_mapper_6 = PathMapper(txt_8, source="{A;B;C;D}", target="{A;B;D;C}")
subtraction_2 = Subtraction(A=dist_2, B=dist)
merge = Merge(Data1=path_mapper, Data2=path_mapper_3, Data3=path_mapper_5)
merge_2 = Merge(Data1=path_mapper_2, Data2=path_mapper_4, Data3=path_mapper_6)
tstat = TreeStatistics(Tree=merge)  # -> Paths, Length, Count

# ---- group: Cell Widths
num_12 = Number(merge)

# ---- group: Cell Types
txt_9 = Text(merge_2)

# ----
pshift_5 = ShiftPaths(Data=num_12, Offset=-1)
pshift_6 = ShiftPaths(Data=txt_9, Offset=-1)
branch_2 = TreeBranch(Tree=merge, Path=tstat.Paths, MaintainPaths=False)
branch_3 = TreeBranch(Tree=merge_2, Path=tstat.Paths, MaintainPaths=False)

# ---- group: Cell Widths
num_13 = Number(pshift_5)

num_14 = Number(num_13)

# ----
ma_2 = MassAddition(Input=num_14)  # -> Result, PartialResults
ins = InsertItems(List=ma_2.PartialResults, Item=panel_8, Indices=panel_8, Wrap=True)
pshift_7 = ShiftPaths(Data=ins, Offset=-1)

# ---- group: Cell Bottom Pt Locations (relative)
num_15 = Number(pshift_7)

# ----
division = Division(A=num_15, B=num_11)
multiplication = Multiplication(A=subtraction_2, B=division)

# ----
# ASUMPTION:
# Facade is always plumb
Z = UnitZ(Factor=multiplication)

amp = Amplitude(Vector=vec_3, Amplitude=num_15)
addition = Addition(A=amp, B=Z)

# ---- group: Cell Types
txt_10 = Text(pshift_6)

txt_11 = Text(txt_10)

# ---- group: Cell Widths
num_16 = Number(branch_2)

# ---- group: Cell Types
txt_12 = Text(branch_3)

# ----
move = Move(Geometry=pt_3, Motion=amp)  # -> Geometry, Transform
move_2 = Move(Geometry=pt_4, Motion=addition)  # -> Geometry, Transform
cluster_13 = Cluster_36(data=move.Geometry, index_offset="(1)")
relitem = RelativeItem(Tree=move.Geometry, Offset=cluster_13, WrapPaths=False, WrapItems=False)  # -> graft(ItemA), graft(ItemB)
relitem_2 = RelativeItem(Tree=move_2.Geometry, Offset=cluster_13, WrapPaths=False, WrapItems=False)  # -> graft(ItemA), graft(ItemB)
merge_3 = Merge(Data1=relitem.ItemA, Data2=relitem.ItemB, Data3=relitem_2.ItemB, Data4=relitem_2.ItemA)
pline = PolyLine(Vertices=merge_3, Closed=invert(False))
pshift_8 = ShiftPaths(Data=pline, Offset=-1)
cell_curves = Curve(pshift_8)
envelope_segments_3 = Data(envelope_segments_2)

# ----
# Cell Curves object 1.0
cluster_14 = Cluster_18(cell_curve=cell_curves)

rectangle = Rectangle(Plane=PlaneXY(0, 0, 0), XSize=Domain(-1, 1), YSize=Domain(-2, 2), Radius=0)  # -> Rectangle, Length
panel_9 = Panel(rectangle.Rectangle)
panel_10 = Panel(cluster_14)
cluster_15 = Cluster_15(data=cluster_14, path_mask="{8;*}")

# ---- group: Bottom Center
pt_7 = Point(graft(cluster_15))

# ----
envelope_segments_4 = Data(envelope_segments_3)
item_4 = ListItem(List=envelope_segments_4, Index=0, Wrap=True)  # -> flatten(Item), flatten(Item1)
cell_descriptions_2 = Text(txt_11)
crv_cp = CurveClosestPoint(Point=pt_7, Curve=item_4.Item1)  # -> Point, Parameter, Distance
panel_11 = Panel(cell_descriptions_2)
lng = ListLength(List=item_4.Item1)
smaller = SmallerThan(FirstNumber=crv_cp.Distance, SecondNumber="0.1")  # -> SmallerThan, OrEqualTo
dispatch_7 = Dispatch(List=item_4.Item, DispatchPattern=smaller.SmallerThan)  # -> ListA, ListB
not = GateNot(A=smaller.SmallerThan)
ma_3 = MassAddition(Input=not)  # -> Result, PartialResults
cell_descriptions_3 = Text(graft(cell_descriptions_2))
equals = Equality(FirstNumber=ma_3.Result, SecondNumber=lng)  # -> Equality, Inequality
dispatch_8 = Dispatch(List=cell_descriptions_3, DispatchPattern=equals.Inequality)  # -> ListA, ListB
tmatch_2 = MatchText(Text=dispatch_8.ListA, Pattern="corner*", Case=invert(True))
dispatch_9 = Dispatch(List=dispatch_7.ListA, DispatchPattern=tmatch_2)  # -> ListA, ListB
rep = ReplaceText(Text=dispatch_9.ListA, Find=dispatch_9.ListA, Replace="corner", RecursiveReplace=False)
panel_12 = Panel(rep)
merge_4 = Merge(Data1=rep, Data2=dispatch_9.ListB)
merge_5 = Merge(Data1=merge_4, Data2=dispatch_8.ListB)
pshift_9 = ShiftPaths(Data=merge_5, Offset=-1)
cell_curves_2 = Curve(cell_curves)
cell_descriptions_4 = Text(pshift_9)
cell_curves_3 = Curve(cell_curves_2)
cell_descriptions_5 = Text(cell_descriptions_4)
panel_13 = Panel(cell_descriptions_5)
cell_curves_4 = ClusterOutput(cell_curves_3)
cell_descriptions_6 = ClusterOutput(cell_descriptions_5)

# ==== cluster Cluster_40
cell_crvs = ClusterInput()
cell_crvs_2 = Curve(cell_crvs)

# ---- group: Cell within Header and Sill
crv = Curve(cell_crvs_2)

# ----
inset = ClusterInput()

# ----
# Cell Curves object 1.0
cluster = Cluster_18(cell_curve=crv)

inset_2 = Number(inset)
disc = Discontinuity(Curve=crv, Level=1)  # -> Points, Parameters
panel = Panel(cluster)
cluster_2 = Cluster_15(data=cluster, path_mask="{6;*}")
item = ListItem(List=disc.Points, Index=0, Wrap=True)  # -> Item, Item1, Item2, Item3

# ---- group: Bottom Right
pt = Point(item.Item1)

# ---- group: Top Right
pt_2 = Point(item.Item2)

# ---- group: Jamb Inset
num = Number(inset_2)

# ---- group: Horizontal Direction
vec = Vector(cluster_2)

# ---- group: Bottom Left
pt_3 = Point(item.Item)

# ---- group: Top Left
pt_4 = Point(item.Item3)

# ----
pshift = ShiftPaths(Data=pt_3, Offset=-1)
pshift_2 = ShiftPaths(Data=pt, Offset=-1)
pshift_3 = ShiftPaths(Data=pt_2, Offset=-1)
pshift_4 = ShiftPaths(Data=pt_4, Offset=-1)

# ----
# Inset the sides of the Cell Curve
# so that the curve is contained
# within the Window Jambs
amp = Amplitude(Vector=vec, Amplitude=num)
rev = Reverse(Vector=amp)
move = Move(Geometry=pshift, Motion=amp)  # -> graft(Geometry), Transform
move_2 = Move(Geometry=pshift_2, Motion=rev)  # -> graft(Geometry), Transform
move_3 = Move(Geometry=pshift_3, Motion=rev)  # -> graft(Geometry), Transform
move_4 = Move(Geometry=pshift_4, Motion=amp)  # -> graft(Geometry), Transform

# ---- group: Bottom Left
pt_5 = Point(move.Geometry)

# ---- group: Top Left
pt_6 = Point(move_4.Geometry)

# ---- group: Bottom Right
pt_7 = Point(move_2.Geometry)

# ---- group: Top Right
pt_8 = Point(move_3.Geometry)

# ----
merge = Merge(Data1=pt_5, Data2=pt_7, Data3=pt_8, Data4=pt_6)
pline = PolyLine(Vertices=merge, Closed=invert(False))
pshift_5 = ShiftPaths(Data=pline, Offset=-1)
tstat = TreeStatistics(Tree=pshift_5)  # -> Paths, Length, Count
tstat_2 = TreeStatistics(Tree=num)  # -> Paths, Length, Count
replace = ReplacePaths(Data=pshift_5, Search=tstat.Paths, Replace=tstat_2.Paths)
cell_crvs_3 = Curve(replace)
cell_crvs_4 = ClusterOutput(cell_crvs_3)

# ==== cluster Cluster_41
profile = ClusterInput()
find = ClusterInput()
profile_2 = Text(profile)
find_2 = Text(find)
tmatch = MatchText(Text=profile_2, Pattern=find_2, Case=invert(True))
bool = Boolean(True)
mindex = MemberIndex(Set=tmatch, Member=bool)  # -> Index, Count
pshift = ShiftPaths(Data=mindex.Index, Offset=-1)
index = Integer(pshift)
item = ListItem(List=profile_2, Index=index, Wrap=True)
items = Text(item)
items_2 = ClusterOutput(items)
index_2 = ClusterOutput(index)

# ==== cluster Cluster_42
T = ClusterInput()
split = TextSplit(Text=T, Separators=":")
trim = TextTrim(Text=split, Start=True, End=True)
item = ListItem(List=trim, Index=0, Wrap=True)  # -> Item, Item1
pshift = ShiftPaths(Data=item.Item1, Offset=-1)
T_2 = Text(pshift)
T_3 = ClusterOutput(T_2)

# ==== cluster Cluster_43
T = ClusterInput()
C = ClusterInput()
split = TextSplit(Text=T, Separators=C)
trim = TextTrim(Text=split, Start=True, End=True)
item = ListItem(List=trim, Index=0, Wrap=True)  # -> Item, Item1, Item2
txt_1 = Text(item.Item)
txt_2 = Text(item.Item1)
txt_3 = Text(item.Item2)
txt_1_2 = ClusterOutput(txt_1)
txt_2_2 = ClusterOutput(txt_2)
txt_3_2 = ClusterOutput(txt_3)

# ==== cluster Cluster_16
top_profile_qpts = ClusterInput()
bottom_profile_qpts = ClusterInput()
top_profile_qpts_2 = Data(top_profile_qpts)
bottom_profile_qpts_2 = Data(bottom_profile_qpts)
branch = TreeBranch(Tree=top_profile_qpts_2, Path="{0}", MaintainPaths=True)
branch_2 = TreeBranch(Tree=bottom_profile_qpts_2, Path="{0}", MaintainPaths=True)
cluster = Cluster_15(data=top_profile_qpts_2, path_mask="{1;*}")
cluster_2 = Cluster_15(data=top_profile_qpts_2, path_mask="{2;*}")
cluster_3 = Cluster_15(data=top_profile_qpts_2, path_mask="{3;*}")
cluster_4 = Cluster_15(data=top_profile_qpts_2, path_mask="{4;*}")
cluster_5 = Cluster_15(data=bottom_profile_qpts_2, path_mask="{1;*}")
cluster_6 = Cluster_15(data=bottom_profile_qpts_2, path_mask="{2;*}")
cluster_7 = Cluster_15(data=bottom_profile_qpts_2, path_mask="{3;*}")
cluster_8 = Cluster_15(data=bottom_profile_qpts_2, path_mask="{4;*}")
panel = Panel(branch)
panel_2 = Panel(branch_2)
conmesh = ConstructMesh(Vertices=cluster_4, Faces={A=0, B=1, C=2, D=3})
item = ListItem(List=cluster_4, Index=0, Wrap=True)  # -> Item, Item1, Item2, Item3
conmesh_2 = ConstructMesh(Vertices=cluster_8, Faces={A=0, B=1, C=2, D=3})
item_2 = ListItem(List=cluster_8, Index=0, Wrap=True)  # -> Item, Item1, Item2, Item3

# ---- group: Top Right
pt = Point(item.Item2)

# ---- group: Bottom Left
pt_2 = Point(item.Item)

# ---- group: Bottom Right
pt_3 = Point(item.Item1)

# ---- group: Top Left
pt_4 = Point(item.Item3)

# ---- group: Bottom Left
pt_5 = Point(item_2.Item)

# ---- group: Bottom Right
pt_6 = Point(item_2.Item1)

# ---- group: Top Right
pt_7 = Point(item_2.Item2)

# ---- group: Top Left
pt_8 = Point(item_2.Item3)

# ---- group: Bottom Left
pt_9 = Point(pt_8)

# ---- group: Top Left
pt_10 = Point(pt_2)

# ---- group: Bottom Right
pt_11 = Point(pt_7)

# ---- group: Top Right
pt_12 = Point(pt_3)

# ----
merge = Merge(Data1=pt_9, Data2=pt_11, Data3=pt_12, Data4=pt_10)
pline = PolyLine(Vertices=merge, Closed=invert(False))
cell_crvs = Curve(pline)
cell_crvs_2 = ClusterOutput(cell_crvs)

# ==== cluster Cluster_21
cell_crvs = ClusterInput()
profile_yz = ClusterInput()
cell_crvs_2 = Curve(cell_crvs)
profile_yz_2 = Text(profile_yz)
profile_yz_3 = Text(profile_yz_2)

tmatch = MatchText(Text=profile_yz_3, Pattern="Q*", Case=True)
dispatch = Dispatch(List=profile_yz_3, DispatchPattern=tmatch)  # -> ListA, ListB

tmatch_2 = MatchText(Text=dispatch.ListB, Pattern="XY", Case=True)
tmatch_3 = MatchText(Text=dispatch.ListB, Pattern="YZ", Case=True)
or = GateOr(A=tmatch_2, B=tmatch_3)
dispatch_2 = Dispatch(List=dispatch.ListB, DispatchPattern=or)  # -> ListA, ListB

tmatch_4 = MatchText(Text=dispatch_2.ListB, Pattern="thickness*", Case=True)
tmatch_5 = MatchText(Text=dispatch_2.ListB, Pattern="length*", Case=True)
or_2 = GateOr(A=tmatch_4, B=tmatch_5)
dispatch_3 = Dispatch(List=dispatch_2.ListB, DispatchPattern=or_2)  # -> ListA, ListB

tmatch_6 = MatchText(Text=dispatch_3.ListB, Pattern="inset*", Case=True)
dispatch_4 = Dispatch(List=dispatch_3.ListB, DispatchPattern=tmatch_6)  # -> ListA, ListB

# ---- group: QPts
txt = Text(dispatch_4.ListB)

# ---- group: thickness / length
txt_2 = Text(dispatch_3.ListA)

# ---- group: inset
txt_3 = Text(dispatch_4.ListA)

# ----
panel = Panel(txt_2)

# ---- group: Profile QPts Faces
qpts_faces = Text(dispatch.ListA)

# ----
split = TextSplit(Text=txt, Separators=",")
trim = TextTrim(Text=split, Start=True, End=True)
item = ListItem(List=trim, Index=0, Wrap=True)  # -> Item, Item1, Item2

split_2 = TextSplit(Text=txt_2, Separators=":")
trim_2 = TextTrim(Text=split_2, Start=True, End=True)
item_2 = ListItem(List=trim_2, Index=0, Wrap=True)  # -> Item, Item1

split_3 = TextSplit(Text=txt_3, Separators=":")
trim_3 = TextTrim(Text=split_3, Start=True, End=True)
item_3 = ListItem(List=trim_3, Index=0, Wrap=True)  # -> Item, Item1

box_height = Number(item_2.Item1)

# ---- group: Inset
box_height_2 = Number(item_3.Item1)

# ----
cluster = Cluster_20(cell_crvs=cell_crvs_2, inset=box_height_2)

# ----
# Cell Curves object 1.0
cluster_2 = Cluster_18(cell_curve=cluster)

crv = Curve(cluster)
panel_2 = Panel(cluster_2)
cluster_3 = Cluster_15(data=cluster_2, path_mask="{1;*}")
cluster_4 = Cluster_15(data=cluster_2, path_mask="{2;*}")
cluster_5 = Cluster_15(data=cluster_2, path_mask="{4;*}")
cluster_6 = Cluster_15(data=cluster_2, path_mask="{5;*}")

# ---- group: Cell Left Pts
pt = Point(cluster_3)

# ---- group: Cell Right Pts
pt_2 = Point(cluster_4)

# ---- group: Cell Section Plane
pln = Plane(cluster_5)

# ---- group: Cell Plan Plane
pln_2 = Plane(cluster_6)

# ---- group: Cell Left Pts
pt_3 = Point(pt)

# ---- group: Cell Right Pts
pt_4 = Point(pt_2)

# ---- group: Cell Section Plane
pln_3 = Plane(graft(pln))

# ---- group: Cell Plan Plane
pln_4 = Plane(graft(pln_2))

# ----
tmatch_7 = MatchText(Text=dispatch_2.ListA, Pattern="XY", Case=True)
int = Integer(tmatch_7)
p_n_c = PickNChoose(Pattern=int, Stream0=pln_3, Stream1=pln_4)
pshift = ShiftPaths(Data=p_n_c, Offset=-1)

num = Number(item.Item1)
num_2 = Number(item.Item2)

int_2 = Integer(int)
pln_5 = Plane(pshift)

# ----
# Locations relative to the YZ Plane
bnd = Bounds(Numbers=flatten(num_2))
dedomain = DeconstructDomain(Domain=bnd)  # -> Start, End
merge = Merge(Data1=dedomain.Start, Data2=dedomain.End)
vec = VectorXYZ(XComponent="0", YComponent=num, ZComponent=num_2)  # -> graft(Vector), Length
vec_2 = VectorXYZ(XComponent=0, YComponent=0, ZComponent=merge)  # -> graft(Vector), Length
yz = YZPlane(Origin=Point(0, 0, 0))

# ----
# Locations relative to the XY Plane
bnd_2 = Bounds(Numbers=flatten(num))
dedomain_2 = DeconstructDomain(Domain=bnd_2)  # -> Start, End
merge_2 = Merge(Data1=dedomain_2.Start, Data2=dedomain_2.End)
vec_3 = VectorXYZ(XComponent=num, YComponent=num_2, ZComponent="0")  # -> graft(Vector), Length
vec_4 = VectorXYZ(XComponent=merge_2, YComponent=0, ZComponent=0)  # -> graft(Vector), Length
xy = XYPlane(Origin=Point(0, 0, 0))

int_3 = Integer(int_2)

tmatch_8 = MatchText(Text=item.Item, Pattern="bottom", Case=invert(True))
not = GateNot(A=tmatch_8)
merge_3 = Merge(Data1=tmatch_8, Data2=not)
bool = Boolean(flatten(merge_3))

p_n_c_2 = PickNChoose(Pattern=int_3, Stream0=vec.Vector, Stream1=vec_3.Vector)
p_n_c_3 = PickNChoose(Pattern=int_3, Stream0=vec_2.Vector, Stream1=vec_4.Vector)
p_n_c_4 = PickNChoose(Pattern=int_3, Stream0=yz, Stream1=xy)
pshift_2 = ShiftPaths(Data=p_n_c_2, Offset=-1)
pshift_3 = ShiftPaths(Data=p_n_c_3, Offset=-1)
vec_5 = Vector(flatten(pshift_2))
pln_6 = Plane(p_n_c_4)
vec_6 = Vector(pshift_3)
pt_5 = Point(pln_6)
pl_origin = PlaneOrigin(Base=pln_5, Origin=pt_5)
orient = Orient(Geometry=vec_5, Source=pln_6, Target=pl_origin)  # -> Geometry, Transform

# ----
# Translate the Profile YZ description to Points
lng = ListLength(List=txt)
dup = DuplicateData(Data=pt_3, Number=lng, Order=True)
dup_2 = DuplicateData(Data=pt_4, Number=lng, Order=True)
pshift_4 = ShiftPaths(Data=dup, Offset=-1)
pshift_5 = ShiftPaths(Data=dup_2, Offset=-1)
cull = CullPattern(List=pshift_4, CullPattern=bool)
cull_2 = CullPattern(List=pshift_5, CullPattern=bool)
move = Move(Geometry=cull, Motion=orient.Geometry)  # -> Geometry, Transform
move_2 = Move(Geometry=cull_2, Motion=orient.Geometry)  # -> Geometry, Transform

orient_2 = Orient(Geometry=vec_6, Source=pln_6, Target=pl_origin)  # -> Geometry, Transform

short = ShortestList(ListA=cull, ListB=orient_2.Geometry, TrimMode=2)  # -> ListA, ListB
short_2 = ShortestList(ListA=cull_2, ListB=orient_2.Geometry, TrimMode=2)  # -> ListA, ListB
move_3 = Move(Geometry=short.ListA, Motion=short.ListB)  # -> Geometry, Transform
move_4 = Move(Geometry=short_2.ListA, Motion=short_2.ListB)  # -> Geometry, Transform
item_4 = ListItem(List=move_3.Geometry, Index=0, Wrap=True)  # -> Item, Item1
item_5 = ListItem(List=move_4.Geometry, Index=0, Wrap=True)  # -> Item, Item1

# ---- group: Profile QPts Faces
qpts_faces_2 = Text(qpts_faces)

# ---- group: Left Profile QPts
left_qpts = Point(move.Geometry)

# ---- group: Right Profile QPts
right_qpts = Point(move_2.Geometry)

# ---- group: Bottom Left
pt_6 = Point(item_4.Item)

# ---- group: Bottom Right
pt_7 = Point(item_5.Item)

# ---- group: Top Right
pt_8 = Point(item_5.Item1)

# ---- group: Top Left
pt_9 = Point(item_4.Item1)

# ----
panel_3 = Panel(left_qpts)
merge_4 = Merge(Data1=pt_6, Data2=pt_7, Data3=pt_8, Data4=pt_9)
pline = PolyLine(Vertices=left_qpts, Closed=invert(False))
conmesh = ConstructMesh(Vertices=left_qpts, Faces=qpts_faces_2)
panel_4 = Panel(qpts_faces_2)

# ---- group: Profile Z Bounds QPts
bounds_qpts = Point(merge_4)

# ----
pline_2 = PolyLine(Vertices=bounds_qpts, Closed=invert(False))
conmesh_2 = ConstructMesh(Vertices=bounds_qpts, Faces={A=0, B=1, C=2, D=3})
panel_5 = Panel("""{1;A} Profile QPts Faces
{2;A;B} Left Profile QPts
{3;A;B} Right Profile QPts
{4;A;B} Profile Z Bounds QPts""")

# ---- group: Jamb Profile QPts Faces
qpts_faces_3 = Text(qpts_faces_2)

# ---- group: Left Profile QPts
qpts = Point(left_qpts)

# ---- group: Right Profile QPts
qpts_2 = Point(right_qpts)

# ----
box_height_3 = Number(box_height)
cluster_7 = Cluster_17(data=qpts_faces_2, path="1")
cluster_8 = Cluster_17(data=left_qpts, path="2")
cluster_9 = Cluster_17(data=right_qpts, path="3")
cluster_10 = Cluster_17(data=bounds_qpts, path="4")
cluster_11 = Cluster_19(T=qpts)
panel_6 = Panel(box_height_3)
merge_5 = Merge(Data1=panel_5, Data2=cluster_7, Data3=cluster_8, Data4=cluster_9, Data5=cluster_10)
relitem = RelativeItem(Tree=qpts, Offset=cluster_11, WrapPaths=False, WrapItems=invert(False))  # -> graft(ItemA), graft(ItemB)
relitem_2 = RelativeItem(Tree=qpts_2, Offset=cluster_11, WrapPaths=False, WrapItems=invert(False))  # -> graft(ItemA), graft(ItemB)

conmesh_3 = ConstructMesh(Vertices=qpts, Faces=qpts_faces_3)
faceb = FaceBoundaries(Mesh=conmesh_3)
pshift_6 = ShiftPaths(Data=faceb, Offset=-1)
explode = Explode(Curve=pshift_6, Recursive=True)  # -> Segments, Vertices
item_6 = ListItem(List=explode.Vertices, Index=0, Wrap=True)  # -> Item, Item1, Item2
rec_3pt = Rectangle3Pt(PointA=item_6.Item, PointB=item_6.Item1, PointC=item_6.Item2)  # -> Rectangle, Length
pshift_7 = ShiftPaths(Data=rec_3pt.Rectangle, Offset=-1)

conmesh_4 = ConstructMesh(Vertices=qpts_2, Faces=qpts_faces_3)
faceb_2 = FaceBoundaries(Mesh=conmesh_4)
pshift_8 = ShiftPaths(Data=faceb_2, Offset=-1)
explode_2 = Explode(Curve=pshift_8, Recursive=True)  # -> Segments, Vertices
item_7 = ListItem(List=explode_2.Vertices, Index=0, Wrap=True)  # -> Item, Item1, Item2
rec_3pt_2 = Rectangle3Pt(PointA=item_7.Item, PointB=item_7.Item1, PointC=item_7.Item2)  # -> Rectangle, Length
pshift_9 = ShiftPaths(Data=rec_3pt_2.Rectangle, Offset=-1)

null = NullItem(Item=box_height_3)  # -> NullFlags, InvalidFlags, Description
profile_qpts = Data(merge_5)
merge_6 = Merge(Data1=relitem.ItemA, Data2=relitem.ItemB, Data3=relitem_2.ItemB, Data4=relitem_2.ItemA)
panel_7 = Panel(null.NullFlags)
neg = Negative(Value=box_height_3)
int_4 = Integer(null.NullFlags)
profile_qpts_2 = ClusterOutput(profile_qpts)
conmesh_5 = ConstructMesh(Vertices=merge_6, Faces={A=0, B=1, C=2, D=3})
pshift_10 = ShiftPaths(Data=conmesh_5, Offset=-1)
merge_7 = Merge(Data1=conmesh_3, Data2=conmesh_4, Data3=pshift_10)
mjoin = MeshJoin(Meshes=merge_7)  # -> graft(Mesh)

# ---- group: Box Height Left
num_3 = Number(neg)

# ----
neg_2 = Negative(Value=num_3)

# ---- group: Box Height Right
num_4 = Number(neg_2)

# ----
boxrec = BoxRectangle(Rectangle=pshift_7, Height=num_3)  # -> graft(Box)
boxrec_2 = BoxRectangle(Rectangle=pshift_9, Height=num_4)  # -> graft(Box)
merge_8 = Merge(Data1=boxrec, Data2=boxrec_2)
mbox = MeshBox(Base=merge_8, XCount=1, YCount=1, ZCount=1)
expression = Expression(x=int_4, Expression="Format(\"{{{0};*}}\", x)")
cluster_12 = Cluster_17(data=mjoin, path="1")
cluster_13 = Cluster_17(data=mbox, path="0")
merge_9 = Merge(Data1=cluster_13, Data2=cluster_12)
split_4 = SplitTree(Data=merge_9, Masks=flatten(expression))  # -> Positive, Negative
box = Box(merge_8)
box_mesh = Mesh(split_4.Positive)
box_2 = ClusterOutput(box)
box_mesh_2 = ClusterOutput(box_mesh)

# ==== cluster Cluster_34
data_2 = ClusterInput()
data_1 = ClusterInput()
data_2_2 = Data(data_2)
lng = ListLength(List=data_2_2)
data_1_2 = Data(data_1)
dup = DuplicateData(Data=data_1_2, Number=lng, Order=True)
lng_2 = ListLength(List=data_1_2)
pshift = ShiftPaths(Data=dup, Offset=-1)
partition = PartitionList(List=pshift, Size=lng_2)
data_1_3 = Data(partition)
data_1_4 = ClusterOutput(data_1_3)

# ==== cluster Cluster_35
width_to_sub_divide = ClusterInput()
width_sub_divider = ClusterInput()
cell_type = ClusterInput()
width_to_sub_divide_2 = Number(width_to_sub_divide)
width_sub_divider_2 = Number(width_sub_divider)
cell_type_2 = Text(cell_type)
division = Division(A=width_to_sub_divide_2, B=width_sub_divider_2)
round = Round(Number=division)  # -> Nearest, Floor, Ceiling
int = Integer("0")
int_2 = Integer("1")
replace = ReplaceMembers(Set=round.Floor, Find=int, Replace=int_2)

# ---- group: Qty Typ. Cells
int_3 = Integer(replace)

# ----
division_2 = Division(A=width_to_sub_divide_2, B=int_3)
panel = Panel(division_2)
panel_2 = Panel(int_3)

# ---- group: Typ. Cell Widths (Adjusted)
num = Number(graft(division_2))

# ---- group: Qty Typ. Cells
int_4 = Integer(graft(int_3))

# ---- group: Cell Types
txt = Text(graft(cell_type_2))

# ----
dup = DuplicateData(Data=num, Number=int_4, Order=True)
dup_2 = DuplicateData(Data=txt, Number=int_4, Order=True)
pshift = ShiftPaths(Data=dup, Offset=-1)
pshift_2 = ShiftPaths(Data=dup_2, Offset=-1)
cell_types = Text(pshift_2)
cell_widths = Number(pshift)
cell_types_2 = ClusterOutput(cell_types)
cell_widths_2 = ClusterOutput(cell_widths)
panel_3 = Panel(cell_widths)

# ==== cluster Cluster_36
data = ClusterInput()
data_2 = Data(data)
index_offset = ClusterInput()
tstat = TreeStatistics(Tree=data_2)  # -> Paths, Length, Count
index_offset_2 = Text(index_offset)
item = ListItem(List=tstat.Paths, Index=0, Wrap=True)
dpath = DeconstructPath(Branch=item)
lng = ListLength(List=dpath)
dup = DuplicateData(Data="0", Number=lng, Order=True)  # -> flatten(Data)
path = ConstructPath(Indices=dup)
concat = Concatenate(FragmentA=path, FragmentB=index_offset_2)
O = Text(concat)
O_2 = ClusterOutput(O)

# ==== cluster Cluster_15
data = ClusterInput()
path_mask = ClusterInput()
data_2 = Data(data)
path_mask_2 = Text(path_mask)
split = SplitTree(Data=data_2, Masks=flatten(path_mask_2))  # -> Positive, Negative
data_3 = Data(split.Positive)
tstat = TreeStatistics(Tree=data_3)  # -> Paths, Length, Count
dpath = DeconstructPath(Branch=tstat.Paths)
cull_i = CullIndex(List=dpath, Indices=0, Wrap=True)
path = ConstructPath(Indices=cull_i)  # -> flatten(Branch)
replace = ReplacePaths(Data=data_3, Search=tstat.Paths, Replace=path)
data_4 = Data(replace)
data_5 = ClusterOutput(data_4)

# ==== cluster Cluster_17
data = ClusterInput()
path = ClusterInput()
data_2 = Data(data)
tstat = TreeStatistics(Tree=data_2)  # -> Paths, Length, Count
path_2 = Integer(path)
dpath = DeconstructPath(Branch=tstat.Paths)
ins = InsertItems(List=dpath, Item=path_2, Indices=0, Wrap=True)
path_3 = ConstructPath(Indices=ins)  # -> flatten(Branch)
replace = ReplacePaths(Data=data_2, Search=tstat.Paths, Replace=path_3)
data_3 = Data(replace)
data_4 = ClusterOutput(data_3)

# ==== cluster Cluster_18
cell_curve = ClusterInput()

# ----
# This is the standard order of 4-side bay curve corner points.
# The same applies to 4-sided cell curves.
cell_curve_2 = Curve(cell_curve)
preview = CustomPreview(
    Geometry=cell_curve_2,
    Shader={ambient=RGB(128, 128, 128), diffuse=RGB(255, 255, 255), emission=RGB(76, 76, 76), shine=0.5, specular=RGB(255, 255, 255), transparency=0})
disc = Discontinuity(Curve=cell_curve_2, Level=1)  # -> Points, Parameters
avr = Average(Input=disc.Points)
pshift = ShiftPaths(Data=avr, Offset=-1)
item = ListItem(List=disc.Points, Index=0, Wrap=True)  # -> Item, Item1, Item2, Item3

# ---- group: Bottom Left
pt = Point(item.Item)

# ---- group: Bottom Right
pt_2 = Point(item.Item1)

# ---- group: Top Right
pt_3 = Point(item.Item2)

# ---- group: Top Left
pt_4 = Point(item.Item3)

# ---- group: Center
pt_5 = Point(pshift)

# ---- group: Bottom Right
pt_6 = Point(pt_2)

# ---- group: Top Right
pt_7 = Point(pt_3)

# ---- group: Bottom Left
pt_8 = Point(pt)

pt_9 = Point(pt)

# ---- group: Bottom Right
pt_10 = Point(pt_2)

# ---- group: Top Left
pt_11 = Point(pt_4)

# ---- group: Bottom Left
pt_12 = Point(pt)

# ---- group: Top Left
pt_13 = Point(pt_4)

# ---- group: Bottom Right
pt_14 = Point(pt_2)

# ---- group: Top Left
pt_15 = Point(pt_4)

# ---- group: Bottom Right
pt_16 = Point(pt_2)

# ---- group: Top Left
pt_17 = Point(pt_4)

# ---- group: Bottom Left
pt_18 = Point(pt)

# ---- group: Bottom Right
pt_19 = Point(pt_2)

# ---- group: Top Left
pt_20 = Point(pt_4)

# ---- group: Bottom Left
pt_21 = Point(pt)

pt_22 = Point(pt)

# ---- group: Bottom Right
pt_23 = Point(pt_2)

# ---- group: Center
pt_24 = Point(pt_5)

# ----
# This is the direction vector constructor.
# It defines the horizontal and vertical
# directions of the 4-sided bay curve / cell curve.
vec2pt = Vector2Pt(PointA=pt_21, PointB=pt_10, Unitize=False)  # -> Vector, Length
vec2pt_2 = Vector2Pt(PointA=pt_21, PointB=pt_11, Unitize=False)  # -> Vector, Length
pshift_2 = ShiftPaths(Data=vec2pt.Vector, Offset=-1)
pshift_3 = ShiftPaths(Data=vec2pt_2.Vector, Offset=-1)

# ----
# This is the standard plane constructor
# for the 4-sided bay curve / cell curve.
pl_3pt = Plane3Pt(PointA=pt_8, PointB=pt_14, PointC=pt_15)
pshift_4 = ShiftPaths(Data=pl_3pt, Offset=-1)

# ----
# This is the bottom center constructor.
# It defines the mid-point at bottom edge
# of the 4-sided bay curve / cell curve.
merge = Merge(Data1=pt_22, Data2=pt_23)
avr_2 = Average(Input=merge)
pshift_5 = ShiftPaths(Data=avr_2, Offset=-1)

# ----
# This constructor defines the order for pairing
# Bottom and Top points
# for the 4-sided bay curve / cell curve.
merge_2 = Merge(Data1=pt_12, Data2=pt_13)
merge_3 = Merge(Data1=pt_6, Data2=pt_7)
pshift_6 = ShiftPaths(Data=merge_2, Offset=-1)
pshift_7 = ShiftPaths(Data=merge_3, Offset=-1)

# ---- group: Cell Left Pts
pt_25 = Point(pshift_6)

# ---- group: Cell Right Pts
pt_26 = Point(pshift_7)

# ---- group: Cell Plane
pln = Plane(pshift_4)

# ---- group: Horizontal Direction
vec = Vector(pshift_2)

# ---- group: Vertical Direction
vec_2 = Vector(pshift_3)

# ---- group: Bottom Center
pt_27 = Point(pshift_5)

# ---- group: Center
pt_28 = Point(pt_24)

# ----
panel = Panel("""{1;*} Cell Left Pts
{2;*} Cell Right Pts
{3;*} Cell Plane
{4;*} Cell Section Plane
{5;*} Cell Plan Plane
{6;*} Horizontal Direction
{7;*} Vertical Direction
{8;*} Bottom Center
{9;*} Center""")
cluster = Cluster_17(data=pt_25, path="1")
cluster_2 = Cluster_17(data=pt_26, path="2")
cluster_3 = Cluster_17(data=pln, path="3")
cluster_4 = Cluster_17(data=vec, path="6")
cluster_5 = Cluster_17(data=vec_2, path="7")
cluster_6 = Cluster_17(data=pt_27, path="8")
cluster_7 = Cluster_17(data=pt_28, path="9")

# ----
# This is the standard section plane constructor
# for the 4-sided bay curve / cell curve.
vec2pt_3 = Vector2Pt(PointA=pt_9, PointB=pt_17, Unitize=False)  # -> Vector, Length
pl_3pt_2 = Plane3Pt(PointA=pt_9, PointB=pt_16, PointC=pt_17)

pl = ConstructPlane(Origin=pt_9, XAxis=pl_3pt_2, YAxis=vec2pt_3.Vector)

pshift_8 = ShiftPaths(Data=pl, Offset=-1)

# ---- group: Cell Section Plane
pln_2 = Plane(pshift_8)

# ----
cluster_8 = Cluster_17(data=pln_2, path="4")

# ----
# This is the standard plan plane constructor
# for the 4-sided bay curve / cell curve.
vec2pt_4 = Vector2Pt(PointA=pt_18, PointB=pt_19, Unitize=False)  # -> Vector, Length
pl_3pt_3 = Plane3Pt(PointA=pt_18, PointB=pt_19, PointC=pt_20)
rev = Reverse(Vector=pl_3pt_3)

pl_2 = ConstructPlane(Origin=pt_18, XAxis=vec2pt_4.Vector, YAxis=rev)

pshift_9 = ShiftPaths(Data=pl_2, Offset=-1)

# ---- group: Cell Plan Plane
pln_3 = Plane(pshift_9)

# ----
cluster_9 = Cluster_17(data=pln_3, path="5")
merge_4 = Merge(
    Data1=panel,
    Data2=cluster,
    Data3=cluster_2,
    Data4=cluster_3,
    Data5=cluster_8,
    Data6=cluster_9,
    Data7=cluster_4,
    Data8=cluster_5,
    Data9=cluster_6,
    Data10=cluster_7)
cell_properties = Data(merge_4)
cell_properties_2 = ClusterOutput(cell_properties)

# ==== cluster Cluster_19
T = ClusterInput()
tstat = TreeStatistics(Tree=T)  # -> Paths, Length, Count
item = ListItem(List=tstat.Paths, Index=0, Wrap=True)
dpath = DeconstructPath(Branch=item)  # -> flatten(Indices)
lng = ListLength(List=dpath)
dup = DuplicateData(Data="0", Number=lng, Order=True)  # -> flatten(Data)
path = ConstructPath(Indices=dup)
expression = Expression(x=path, y="1", Expression="Format(\"{0}({1})\", x, y)")
O = Text(expression)
O_2 = ClusterOutput(O)

# ==== cluster Cluster_20
cell_crvs = ClusterInput()
cell_crvs_2 = Curve(cell_crvs)

# ---- group: Cell within Header and Sill
crv = Curve(cell_crvs_2)

# ----
inset = ClusterInput()

# ----
# Cell Curves object 1.0
cluster = Cluster_18(cell_curve=crv)

inset_2 = Number(inset)
panel = Panel(cluster)
cluster_2 = Cluster_15(data=cluster, path_mask="{6;*}")
disc = Discontinuity(Curve=crv, Level=1)  # -> Points, Parameters
item = ListItem(List=disc.Points, Index=0, Wrap=True)  # -> Item, Item1, Item2, Item3

# ---- group: Bottom Right
pt = Point(item.Item1)

# ---- group: Top Right
pt_2 = Point(item.Item2)

# ---- group: Jamb Inset
num = Number(inset_2)

# ---- group: Horizontal Direction
vec = Vector(cluster_2)

# ---- group: Bottom Left
pt_3 = Point(item.Item)

# ---- group: Top Left
pt_4 = Point(item.Item3)

# ----
# Inset the sides of the Cell Curve
# so that the curve is contained
# within the Window Jambs
amp = Amplitude(Vector=vec, Amplitude=num)
rev = Reverse(Vector=amp)
move = Move(Geometry=pt_3, Motion=amp)  # -> Geometry, Transform
move_2 = Move(Geometry=pt, Motion=rev)  # -> Geometry, Transform
move_3 = Move(Geometry=pt_2, Motion=rev)  # -> Geometry, Transform
move_4 = Move(Geometry=pt_4, Motion=amp)  # -> Geometry, Transform

# ---- group: Bottom Left
pt_5 = Point(move.Geometry)

# ---- group: Top Left
pt_6 = Point(move_4.Geometry)

# ---- group: Bottom Right
pt_7 = Point(move_2.Geometry)

# ---- group: Top Right
pt_8 = Point(move_3.Geometry)

# ----
merge = Merge(Data1=pt_5, Data2=pt_7, Data3=pt_8, Data4=pt_6)
pline = PolyLine(Vertices=merge, Closed=invert(False))
pshift = ShiftPaths(Data=pline, Offset=-1)
cell_crvs_3 = Curve(pshift)
cell_crvs_4 = ClusterOutput(cell_crvs_3)
